# Grasshopper definition Casework3.gh (Grasshopper 1.0.7)

# https://github.com/EverAzureRest/compute.rhino3d/blob/master/src/compute.geometry/IO/GHTypeCodes.cs
# Boolean = 101,
#         Point = 102,
#         Vector = 103,
#         Integer = 104,
#         Number = 105,
#         Text = 106,
#         Line = 107,
#         Curve = 108,
#         Circle = 109,
#         PLane = 110,
#         Rectangle = 111,
#         Box = 112,
#         Surface = 113,
#         Brep = 114,
#         Mesh = 115,
#         Slider = 201,
#         BooleanToggle = 202,
#         Panel = 301
pt = Point([Point(0, 0, 0), Point(0, 108, 0)])
item = ListItem(List=pt, Index=0, Wrap=True)

# ---- group: RH_IN:201:Length
cabinet_depth = Slider(23.25, range=0..100)

# ----
cabinet_base_height = Slider(4, range=0..10)
cabinet_base_recess = Slider(3, range=0..10)
cabinet_thickness = Slider(0.75, range=0..5)
cabinet_panel_thickness = Slider(0.75, range=0..10)
cabinet_middle_vertical_line_2_3 = Slider(0.5, range=0..1)
cabinet_horizontal_line_height_2_3_4 = Slider(5.7, range=0..10)
cabinet_vertical_handle_location_u_2_3_4 = Slider(1.25, range=0..10)
cabinet_vertical_handle_location_v_2_3_4 = Slider(2.75, range=0..10)
cabinet_horizontal_handle_location_v = Slider(1.75, range=-10..10)
cabinet_handle_depth = Slider(0.75, range=0..1)
cabinet_handle_lenght = Slider(4, range=0..100)
cabinet_handle_thickness = Slider(0.5, range=0..1)
drawer_heights_for_type_1 = Panel("""5.5
6
6
6
8""")
cabinet_wheel_offset = Slider(1, range=0..5)
cabinet_wheel_joint_lenght = Slider(4, range=0..10)
cabinet_wheel_joint_width = Slider(1.5, range=0..10)
cabinet_wheel_joint_height = Slider(0.5, range=0..10)
cabinet_wheel_joint_fillet_radius = Slider(0.5, range=0.1..1.1)
cabinet_wheel_joint_triangle_thickness = Slider(0.25, range=0..10)
cabinet_wheel_edge_fillet_raidus = Slider(0.5, range=0..1)

# ---- group: RH_IN:201:Height
cabinet_height = Slider(30.5, range=0..100)

# ---- group: RH_IN:201:Width
cabinet_width = Slider(27, range=0..100)

# ----
cabinet_type = Slider(2, range=1..4)
cabinet_base_type = Slider(3, range=1..3)
pt_2 = Point(item)
equals = Equality(FirstNumber=cabinet_type, SecondNumber=1)  # -> Equality, Inequality
equals_2 = Equality(FirstNumber=cabinet_type, SecondNumber=2)  # -> Equality, Inequality
equals_3 = Equality(FirstNumber=cabinet_type, SecondNumber=3)  # -> Equality, Inequality
equals_4 = Equality(FirstNumber=cabinet_type, SecondNumber=4)  # -> Equality, Inequality
equals_5 = Equality(FirstNumber=cabinet_base_type, SecondNumber=1)  # -> Equality, Inequality
equals_6 = Equality(FirstNumber=cabinet_base_type, SecondNumber=2)  # -> Equality, Inequality
equals_7 = Equality(FirstNumber=cabinet_base_type, SecondNumber=3)  # -> Equality, Inequality
panel = Panel("""0
0""")
panel_2 = Panel("""1
0""")
panel_3 = Panel("""1
1""")
panel_4 = Panel("""1
0
0""")
panel_5 = Panel("""1
1
0""")
panel_6 = Panel("""0
1
0""")
panel_7 = Panel("""1
1
1""")
cull = CullPattern(List=panel_4, CullPattern=equals.Equality)
cull_2 = CullPattern(List=panel_5, CullPattern=equals_2.Equality)
cull_3 = CullPattern(List=panel_6, CullPattern=equals_3.Equality)
cull_4 = CullPattern(List=panel_7, CullPattern=equals_4.Equality)
cull_5 = CullPattern(List=panel, CullPattern=equals_5.Equality)
cull_6 = CullPattern(List=panel_2, CullPattern=equals_6.Equality)
cull_7 = CullPattern(List=panel_3, CullPattern=equals_7.Equality)
merge = Merge(Data1=cull_5, Data2=cull_6, Data3=cull_7)
merge_2 = Merge(Data1=cull, Data2=cull_2, Data3=cull_3, Data4=cull_4)
addition = Addition(A=cabinet_depth, B=cabinet_panel_thickness)
subtraction = Subtraction(A=cabinet_height, B=cabinet_horizontal_line_height_2_3_4)
clean = CleanTree(RemoveNulls=True, RemoveInvalid=True, RemoveEmpty=True, Tree=merge)
clean_2 = CleanTree(RemoveNulls=True, RemoveInvalid=True, RemoveEmpty=True, Tree=merge_2)
subtraction_2 = Subtraction(A=addition, B=cabinet_base_recess)
X = UnitX(Factor=subtraction_2)
X_2 = UnitX(Factor=cabinet_depth)
Y = UnitY(Factor=cabinet_width)
Z = UnitZ(Factor=cabinet_base_height)
Z_2 = UnitZ(Factor=cabinet_height)
X_3 = UnitX(Factor=cabinet_panel_thickness)
item_2 = ListItem(List=clean_2, Index=0, Wrap=True)
item_3 = ListItem(List=clean_2, Index=1, Wrap=True)
item_4 = ListItem(List=clean_2, Index=2, Wrap=True)
item_5 = ListItem(List=clean, Index=0, Wrap=True)
item_6 = ListItem(List=clean, Index=1, Wrap=True)
move = Move(Geometry=pt_2, Motion=X)  # -> Geometry, Transform
move_2 = Move(Geometry=pt_2, Motion=X_2)  # -> Geometry, Transform
cull_8 = CullPattern(List=cabinet_middle_vertical_line_2_3, CullPattern=invert(item_4))
cull_9 = CullPattern(List=0, CullPattern=item_4)
ln = Line(StartPoint=move.Geometry, EndPoint=pt_2)
ln_2 = Line(StartPoint=move_2.Geometry, EndPoint=pt_2)
merge_3 = Merge(Data1=cull_8, Data2=cull_9)
extr = Extrude(Base=ln, Direction=Y)
extr_2 = Extrude(Base=ln_2, Direction=Y)
clean_3 = CleanTree(RemoveNulls=True, RemoveInvalid=True, RemoveEmpty=True, Tree=merge_3)
move_3 = Move(Geometry=extr_2, Motion=Z)  # -> Geometry, Transform
extr_3 = Extrude(Base=extr, Direction=Z)
extr_4 = Extrude(Base=move_3.Geometry, Direction=Z_2)
debrep = DeconstructBrep(Brep=extr_4)  # -> Faces, Edges, Vertices
dim = Dimensions(Surface=move_3.Geometry)  # -> UDimension, VDimension
addition_2 = Addition(A=cabinet_vertical_handle_location_u_2_3_4, B=cabinet_handle_thickness)
subtraction_3 = Subtraction(A=subtraction, B=cabinet_vertical_handle_location_v_2_3_4)
subtraction_4 = Subtraction(A=dim.VDimension, B=cabinet_thickness)
subtraction_5 = Subtraction(A=dim.UDimension, B=cabinet_thickness)
subtraction_6 = Subtraction(A=subtraction_3, B=cabinet_handle_thickness)
division = Division(A=cabinet_thickness, B=dim.UDimension)
division_2 = Division(A=subtraction_5, B=dim.UDimension)
division_3 = Division(A=subtraction_4, B=dim.VDimension)
multiplication = Multiplication(A=cabinet_thickness, B=2)
dom²num = ConstructDomain²(UMin=division, UMax=division_2, VMin=division_3, VMax=0)
item_7 = ListItem(List=debrep.Faces, Index=1, Wrap=True)
subtraction_7 = Subtraction(A=cabinet_height, B=multiplication)
subsrf = Isotrim(Surface=reparameterize(move_3.Geometry), Domain=dom²num)
Z_3 = UnitZ(Factor=cabinet_thickness)
Z_4 = UnitZ(Factor=subtraction_7)
move_4 = Move(Geometry=subsrf, Motion=Z_3)  # -> Geometry, Transform
extr_5 = Extrude(Base=move_4.Geometry, Direction=Z_4)
dim_2 = Dimensions(Surface=item_7)  # -> UDimension, VDimension
sdiff = SolidDifference(BrepsA=extr_4, BrepsB=extr_5)
multiplication_2 = Multiplication(A=dim_2.VDimension, B=clean_3)
subtraction_8 = Subtraction(A=subtraction_6, B=cabinet_handle_lenght)
addition_3 = Addition(A=cabinet_wheel_offset, B=cabinet_wheel_joint_width)
item_8 = ListItem(List=debrep.Faces, Index=0, Wrap=True)
ma = MassAddition(Input=drawer_heights_for_type_1)  # -> Result, PartialResults
num = Number(cabinet_height)
addition_4 = Addition(A=multiplication_2, B=addition_2)
subtraction_9 = Subtraction(A=multiplication_2, B=addition_2)
subtraction_10 = Subtraction(A=addition_4, B=cabinet_handle_thickness)
division_4 = Division(A=cabinet_base_height, B=4)
addition_5 = Addition(A=subtraction_9, B=cabinet_handle_thickness)
dim_3 = Dimensions(Surface=item_8)  # -> UDimension, VDimension
dim_4 = Dimensions(Surface=item_8)  # -> UDimension, VDimension
dim_5 = Dimensions(Surface=item_8)  # -> UDimension, VDimension
dim_6 = Dimensions(Surface=item_8)  # -> UDimension, VDimension
multiplication_3 = Multiplication(A=division_4, B=2.75)
num_2 = Number(multiplication_3)
merge_4 = Merge(Data1=0, Data2=ma.PartialResults)
merge_5 = Merge(Data1=ma.PartialResults, Data2=num)
sort = SortList(Keys=merge_4, ValuesA=merge_4)  # -> Keys, ValuesA
dim_7 = Dimensions(Surface=item_7)  # -> UDimension, VDimension
sort_2 = SortList(Keys=merge_5, ValuesA=merge_5)  # -> Keys, ValuesA
subtraction_11 = Subtraction(A=dim_4.UDimension, B=cabinet_wheel_offset)
subtraction_12 = Subtraction(A=dim_4.UDimension, B=addition_3)
subtraction_13 = Subtraction(A=dim_4.VDimension, B=cabinet_wheel_offset)
subtraction_14 = Subtraction(A=num, B=sort.ValuesA)
dim_8 = Dimensions(Surface=item_7)  # -> UDimension, VDimension
dim_9 = Dimensions(Surface=item_7)  # -> UDimension, VDimension
dim_10 = Dimensions(Surface=item_7)  # -> UDimension, VDimension
dim_11 = Dimensions(Surface=item_7)  # -> UDimension, VDimension
dim_12 = Dimensions(Surface=item_7)  # -> UDimension, VDimension
dim_13 = Dimensions(Surface=item_7)  # -> UDimension, VDimension
dim_14 = Dimensions(Surface=item_7)  # -> UDimension, VDimension
dim_15 = Dimensions(Surface=item_7)  # -> UDimension, VDimension
dim_16 = Dimensions(Surface=item_7)  # -> UDimension, VDimension
dim_17 = Dimensions(Surface=item_7)  # -> UDimension, VDimension
dim_18 = Dimensions(Surface=item_7)  # -> UDimension, VDimension
subtraction_15 = Subtraction(A=num, B=sort_2.ValuesA)
larger = LargerThan(FirstNumber=subtraction_15, SecondNumber=0)  # -> LargerThan, OrEqualTo
larger_2 = LargerThan(FirstNumber=subtraction_14, SecondNumber=0)  # -> LargerThan, OrEqualTo
addition_6 = Addition(A=cabinet_wheel_offset, B=cabinet_wheel_joint_lenght)
subtraction_16 = Subtraction(A=subtraction_13, B=cabinet_wheel_joint_lenght)
num_3 = Number(cabinet_handle_lenght)
num_4 = Number(cabinet_handle_lenght)
cull_10 = CullPattern(List=subtraction_15, CullPattern=larger.OrEqualTo)
cull_11 = CullPattern(List=subtraction_14, CullPattern=larger_2.OrEqualTo)
subtraction_17 = Subtraction(A=subtraction_3, B=num_3)
subtraction_18 = Subtraction(A=subtraction_6, B=num_3)
subtraction_19 = Subtraction(A=subtraction_6, B=num_4)
subtraction_20 = Subtraction(A=subtraction_3, B=num_4)
division_5 = Division(A=cull_10, B=dim_7.UDimension)
division_6 = Division(A=cull_11, B=dim_7.UDimension)
division_7 = Division(A=0, B=dim_7.VDimension)
division_8 = Division(A=dim_7.VDimension, B=dim_7.VDimension)
division_9 = Division(A=0, B=dim_8.UDimension)
division_10 = Division(A=subtraction, B=dim_8.UDimension)
division_11 = Division(A=0, B=dim_8.VDimension)
division_12 = Division(A=0, B=dim_9.UDimension)
division_13 = Division(A=subtraction, B=dim_9.UDimension)
division_14 = Division(A=dim_9.VDimension, B=dim_9.VDimension)
division_15 = Division(A=subtraction, B=dim_10.UDimension)
division_16 = Division(A=dim_10.UDimension, B=dim_10.UDimension)
division_17 = Division(A=0, B=dim_10.VDimension)
division_18 = Division(A=dim_10.VDimension, B=dim_10.VDimension)
division_19 = Division(A=subtraction, B=dim_11.UDimension)
division_20 = Division(A=dim_11.UDimension, B=dim_11.UDimension)
division_21 = Division(A=0, B=dim_11.VDimension)
division_22 = Division(A=dim_11.VDimension, B=dim_11.VDimension)
division_23 = Division(A=subtraction, B=dim_12.UDimension)
division_24 = Division(A=dim_12.UDimension, B=dim_12.UDimension)
division_25 = Division(A=dim_12.VDimension, B=dim_12.VDimension)
division_26 = Division(A=subtraction_3, B=dim_13.UDimension)
division_27 = Division(A=subtraction_6, B=dim_13.UDimension)
division_28 = Division(A=subtraction_9, B=dim_13.VDimension)
division_29 = Division(A=addition_5, B=dim_13.VDimension)
division_30 = Division(A=subtraction_17, B=dim_14.UDimension)
division_31 = Division(A=subtraction_18, B=dim_14.UDimension)
division_32 = Division(A=subtraction_9, B=dim_14.VDimension)
division_33 = Division(A=addition_5, B=dim_14.VDimension)
division_34 = Division(A=subtraction_3, B=dim_15.UDimension)
division_35 = Division(A=subtraction_8, B=dim_15.UDimension)
division_36 = Division(A=subtraction_9, B=dim_15.VDimension)
division_37 = Division(A=addition_5, B=dim_15.VDimension)
division_38 = Division(A=subtraction_6, B=dim_16.UDimension)
division_39 = Division(A=subtraction_3, B=dim_16.UDimension)
division_40 = Division(A=subtraction_10, B=dim_16.VDimension)
division_41 = Division(A=addition_4, B=dim_16.VDimension)
division_42 = Division(A=subtraction_19, B=dim_17.UDimension)
division_43 = Division(A=subtraction_20, B=dim_17.UDimension)
division_44 = Division(A=subtraction_10, B=dim_17.VDimension)
division_45 = Division(A=addition_4, B=dim_17.VDimension)
division_46 = Division(A=subtraction_3, B=dim_18.UDimension)
division_47 = Division(A=subtraction_8, B=dim_18.UDimension)
division_48 = Division(A=subtraction_10, B=dim_18.VDimension)
division_49 = Division(A=addition_4, B=dim_18.VDimension)
division_50 = Division(A=cabinet_wheel_offset, B=dim_3.UDimension)
division_51 = Division(A=addition_3, B=dim_3.UDimension)
division_52 = Division(A=addition_6, B=dim_3.VDimension)
division_53 = Division(A=cabinet_wheel_offset, B=dim_3.VDimension)
division_54 = Division(A=subtraction_11, B=dim_4.UDimension)
division_55 = Division(A=subtraction_12, B=dim_4.UDimension)
division_56 = Division(A=subtraction_13, B=dim_4.VDimension)
division_57 = Division(A=subtraction_16, B=dim_4.VDimension)
division_58 = Division(A=subtraction_12, B=dim_5.UDimension)
division_59 = Division(A=subtraction_11, B=dim_5.UDimension)
division_60 = Division(A=cabinet_wheel_offset, B=dim_5.VDimension)
division_61 = Division(A=addition_6, B=dim_5.VDimension)
division_62 = Division(A=cabinet_wheel_offset, B=dim_6.UDimension)
division_63 = Division(A=addition_3, B=dim_6.UDimension)
division_64 = Division(A=subtraction_13, B=dim_6.VDimension)
division_65 = Division(A=subtraction_16, B=dim_6.VDimension)
division_66 = Division(A=cabinet_wheel_joint_lenght, B=2)
dom²num_2 = ConstructDomain²(UMin=division_5, UMax=division_6, VMin=division_7, VMax=division_8)
dom²num_3 = ConstructDomain²(UMin=division_9, UMax=division_10, VMin=division_11, VMax=clean_3)
dom²num_4 = ConstructDomain²(UMin=division_12, UMax=division_13, VMin=clean_3, VMax=division_14)
dom²num_5 = ConstructDomain²(UMin=division_15, UMax=division_16, VMin=division_17, VMax=division_18)
dom²num_6 = ConstructDomain²(UMin=division_19, UMax=division_20, VMin=division_21, VMax=clean_3)
dom²num_7 = ConstructDomain²(UMin=division_23, UMax=division_24, VMin=clean_3, VMax=division_25)
dom²num_8 = ConstructDomain²(UMin=division_30, UMax=division_31, VMin=division_32, VMax=division_33)
dom²num_9 = ConstructDomain²(UMin=division_34, UMax=division_35, VMin=division_36, VMax=division_37)
dom²num_10 = ConstructDomain²(UMin=division_38, UMax=division_39, VMin=division_40, VMax=division_41)
dom²num_11 = ConstructDomain²(UMin=division_42, UMax=division_43, VMin=division_44, VMax=division_45)
dom²num_12 = ConstructDomain²(UMin=division_46, UMax=division_47, VMin=division_48, VMax=division_49)
dom²num_13 = ConstructDomain²(UMin=division_26, UMax=division_27, VMin=division_28, VMax=division_29)
dom²num_14 = ConstructDomain²(UMin=division_50, UMax=division_51, VMin=division_52, VMax=division_53)
dom²num_15 = ConstructDomain²(UMin=division_54, UMax=division_55, VMin=division_56, VMax=division_57)
dom²num_16 = ConstructDomain²(UMin=division_58, UMax=division_59, VMin=division_60, VMax=division_61)
dom²num_17 = ConstructDomain²(UMin=division_62, UMax=division_63, VMin=division_64, VMax=division_65)
division_67 = Division(A=num_2, B=division_66)
subsrf_2 = Isotrim(Surface=reparameterize(item_7), Domain=dom²num_2)
sqr = Square(Value=division_67)
subtraction_21 = Subtraction(A=cabinet_base_height, B=cabinet_wheel_joint_height)
subsrf_3 = Isotrim(Surface=reparameterize(item_7), Domain=dom²num_3)
subsrf_4 = Isotrim(Surface=reparameterize(item_7), Domain=dom²num_4)
subsrf_5 = Isotrim(Surface=reparameterize(item_7), Domain=dom²num_5)
subsrf_6 = Isotrim(Surface=reparameterize(item_7), Domain=dom²num_6)
subsrf_7 = Isotrim(Surface=reparameterize(item_7), Domain=dom²num_7)
subsrf_8 = Isotrim(Surface=reparameterize(item_7), Domain=dom²num_13)
subsrf_9 = Isotrim(Surface=reparameterize(item_7), Domain=dom²num_8)
subsrf_10 = Isotrim(Surface=reparameterize(item_7), Domain=dom²num_10)
subsrf_11 = Isotrim(Surface=reparameterize(item_7), Domain=dom²num_11)
subsrf_12 = Isotrim(Surface=reparameterize(item_7), Domain=dom²num_12)
subsrf_13 = Isotrim(Surface=reparameterize(item_8), Domain=dom²num_14)
subsrf_14 = Isotrim(Surface=reparameterize(item_8), Domain=dom²num_15)
subsrf_15 = Isotrim(Surface=reparameterize(item_8), Domain=dom²num_16)
subsrf_16 = Isotrim(Surface=reparameterize(item_8), Domain=dom²num_17)
addition_7 = Addition(A=sqr, B=1)
subtraction_22 = Subtraction(A=subtraction_21, B=num_2)
sqrt = SquareRoot(Value=addition_7)
cull_12 = CullPattern(List=subsrf_6, CullPattern=invert(item_2))
cull_13 = CullPattern(List=subsrf_7, CullPattern=invert(item_2))
multiplication_4 = Multiplication(A=sqrt, B=cabinet_wheel_joint_fillet_radius)
cull_14 = CullPattern(List=subsrf_5, CullPattern=item_2)
addition_8 = Addition(A=multiplication_4, B=subtraction_22)
subsrf_17 = Isotrim(Surface=reparameterize(item_7), Domain=dom²num_9)
merge_6 = Merge(Data1=subsrf_8, Data2=subsrf_9)
merge_7 = Merge(Data1=subsrf_10, Data2=subsrf_11)
merge_8 = Merge(Data1=cull_14, Data2=cull_12, Data3=cull_13)
merge_9 = Merge(Data1=subsrf_13, Data2=subsrf_14, Data3=subsrf_15, Data4=subsrf_16)
Z_5 = UnitZ(Factor=cabinet_wheel_joint_height)
clean_4 = CleanTree(RemoveNulls=True, RemoveInvalid=True, RemoveEmpty=True, Tree=merge_8)
X_4 = UnitX(Factor=cabinet_handle_depth)
neg = Negative(Value=Z_5)
move_5 = Move(Geometry=merge_9, Motion=neg)  # -> Geometry, Transform
extr_6 = Extrude(Base=merge_9, Direction=neg)
move_6 = Move(Geometry=merge_6, Motion=X_3)  # -> Geometry, Transform
move_7 = Move(Geometry=subsrf_17, Motion=X_3)  # -> Geometry, Transform
Z_6 = UnitZ(Factor=num_2)
move_8 = Move(Geometry=merge_7, Motion=X_3)  # -> Geometry, Transform
move_9 = Move(Geometry=subsrf_12, Motion=X_3)  # -> Geometry, Transform
debrep_2 = DeconstructBrep(Brep=move_5.Geometry)  # -> Faces, Edges, Vertices
neg_2 = Negative(Value=Z_6)
neg_3 = Negative(Value=Z_6)
merge_10 = Merge(Data1=subsrf_3, Data2=subsrf_4, Data3=clean_4)
item_9 = ListItem(List=debrep_2.Edges, Index=1, Wrap=True)
item_10 = ListItem(List=debrep_2.Edges, Index=3, Wrap=True)
eval = EvaluateLength(Curve=item_9, Length=0.5, Normalized=True)  # -> Point, Tangent, Parameter
eval_2 = EvaluateLength(Curve=item_10, Length=0.5, Normalized=True)  # -> Point, Tangent, Parameter
move_10 = Move(Geometry=eval.Point, Motion=neg_2)  # -> Geometry, Transform
move_11 = Move(Geometry=eval_2.Point, Motion=neg_3)  # -> Geometry, Transform
X_5 = UnitX(Factor=cabinet_handle_thickness)
move_12 = Move(Geometry=move_7.Geometry, Motion=X_4)  # -> Geometry, Transform
extr_7 = ExtrudePoint(Base=item_9, Point=move_10.Geometry)
extr_8 = ExtrudePoint(Base=item_10, Point=move_11.Geometry)
move_13 = Move(Geometry=move_9.Geometry, Motion=X_4)  # -> Geometry, Transform
extr_9 = Extrude(Base=move_6.Geometry, Direction=X_4)
extr_10 = Extrude(Base=move_12.Geometry, Direction=X_5)
extr_11 = Extrude(Base=move_13.Geometry, Direction=X_5)
extr_12 = Extrude(Base=move_8.Geometry, Direction=X_4)
cull_15 = CullPattern(List=subsrf_2, CullPattern=invert(item_3))
cull_16 = CullPattern(List=clean_4, CullPattern=item_3)
cull_17 = CullPattern(List=subsrf_2, CullPattern=invert(item_3))
sunion = SolidUnion(Breps=[extr_9, extr_10])
fillet = Fillet(Curve=extr_7, Parameter=0, Radius=cabinet_wheel_joint_fillet_radius)  # -> Curve, Parameter
fillet_2 = Fillet(Curve=extr_8, Parameter=0, Radius=cabinet_wheel_joint_fillet_radius)  # -> Curve, Parameter
cull_18 = CullPattern(List=merge_10, CullPattern=item_3)
merge_11 = Merge(Data1=cull_15, Data2=cull_16)
explode = Explode(Curve=fillet.Curve, Recursive=True)  # -> Segments, Vertices
explode_2 = Explode(Curve=fillet_2.Curve, Recursive=True)  # -> Segments, Vertices
sunion_2 = SolidUnion(Breps=[extr_11, extr_12])
merge_12 = Merge(Data1=cull_17, Data2=cull_18)
srf = Surface(fillet.Curve)
srf_2 = Surface(fillet_2.Curve)
item_11 = ListItem(List=explode.Segments, Index=3, Wrap=True)
item_12 = ListItem(List=explode_2.Segments, Index=3, Wrap=True)
clean_5 = CleanTree(RemoveNulls=True, RemoveInvalid=True, RemoveEmpty=True, Tree=merge_11)  # -> graft(Tree)
fmerge = MergeFaces(Brep=sunion)  # -> Breps, Before, After
clean_6 = CleanTree(RemoveNulls=True, RemoveInvalid=True, RemoveEmpty=True, Tree=merge_12)
fmerge_2 = MergeFaces(Brep=sunion_2)  # -> Breps, Before, After
darc = DeconstructArc(Arc=item_11)  # -> BasePlane, Radius, Angle
darc_2 = DeconstructArc(Arc=item_12)  # -> BasePlane, Radius, Angle
Y_2 = UnitY(Factor=cabinet_wheel_joint_triangle_thickness)
pt_3 = Point(darc.BasePlane)
pt_4 = Point(darc_2.BasePlane)
neg_4 = Negative(Value=Y_2)
move_14 = Move(Geometry=pt_3, Motion=neg_4)  # -> Geometry, Transform
move_15 = Move(Geometry=pt_4, Motion=Y_2)  # -> Geometry, Transform
extr_13 = Extrude(Base=srf, Direction=neg_4)
extr_14 = Extrude(Base=srf_2, Direction=Y_2)
ln_3 = Line(StartPoint=move_14.Geometry, EndPoint=move_15.Geometry)
pipe = Pipe(Curve=ln_3, Radius=addition_8, Caps=1)
srf_3 = Surface(clean_5)
num_5 = Number(cabinet_handle_thickness)
panel_8 = Panel("""1
2""")
merge_13 = Merge(Data1=extr_6, Data2=extr_13, Data3=extr_14)
filedge = FilletEdge(Shape=pipe, Blend=0, Metric=2, Edges=panel_8, Radii=cabinet_wheel_edge_fillet_raidus)
dim_19 = Dimensions(Surface=srf_3)  # -> UDimension, VDimension
dim_20 = Dimensions(Surface=srf_3)  # -> UDimension, VDimension
dim_21 = Dimensions(Surface=srf_3)  # -> UDimension, VDimension
extr_15 = Extrude(Base=clean_6, Direction=X_3)
dim_22 = Dimensions(Surface=srf_3)  # -> UDimension, VDimension
addition_9 = Addition(A=cabinet_handle_lenght, B=cabinet_handle_thickness)
division_68 = Division(A=dim_22.VDimension, B=2)
division_69 = Division(A=addition_9, B=2)
subtraction_23 = Subtraction(A=dim_22.UDimension, B=cabinet_horizontal_handle_location_v)
subtraction_24 = Subtraction(A=division_68, B=division_69)
addition_10 = Addition(A=division_68, B=division_69)
addition_11 = Addition(A=subtraction_24, B=num_5)
subtraction_25 = Subtraction(A=subtraction_23, B=num_5)
subtraction_26 = Subtraction(A=addition_10, B=num_5)
subtraction_27 = Subtraction(A=addition_10, B=addition_9)
division_70 = Division(A=subtraction_23, B=dim_19.UDimension)
division_71 = Division(A=subtraction_25, B=dim_19.UDimension)
division_72 = Division(A=subtraction_24, B=dim_19.VDimension)
division_73 = Division(A=addition_11, B=dim_19.VDimension)
division_74 = Division(A=subtraction_23, B=dim_20.UDimension)
division_75 = Division(A=subtraction_25, B=dim_20.UDimension)
division_76 = Division(A=subtraction_26, B=dim_20.VDimension)
division_77 = Division(A=addition_10, B=dim_20.VDimension)
division_78 = Division(A=subtraction_23, B=dim_21.UDimension)
division_79 = Division(A=subtraction_25, B=dim_21.UDimension)
division_80 = Division(A=subtraction_27, B=dim_21.VDimension)
division_81 = Division(A=addition_10, B=dim_21.VDimension)
dom²num_18 = ConstructDomain²(UMin=division_70, UMax=division_71, VMin=division_72, VMax=division_73)
dom²num_19 = ConstructDomain²(UMin=division_74, UMax=division_75, VMin=division_76, VMax=division_77)
dom²num_20 = ConstructDomain²(UMin=division_78, UMax=division_79, VMin=division_80, VMax=division_81)
subsrf_18 = Isotrim(Surface=reparameterize(clean_5), Domain=dom²num_20)
subsrf_19 = Isotrim(Surface=reparameterize(clean_5), Domain=dom²num_18)
subsrf_20 = Isotrim(Surface=reparameterize(clean_5), Domain=dom²num_19)
merge_14 = Merge(Data1=subsrf_19, Data2=subsrf_20)
move_16 = Move(Geometry=subsrf_18, Motion=X_3)  # -> Geometry, Transform
move_17 = Move(Geometry=move_16.Geometry, Motion=X_4)  # -> Geometry, Transform
extr_16 = Extrude(Base=move_17.Geometry, Direction=X_5)
move_18 = Move(Geometry=merge_14, Motion=X_3)  # -> Geometry, Transform
extr_17 = Extrude(Base=move_18.Geometry, Direction=X_4)
sunion_3 = SolidUnion(Breps=[extr_17, extr_16])
fmerge_3 = MergeFaces(Brep=sunion_3)  # -> Breps, Before, After
merge_15 = Merge(Data1=fmerge.Breps, Data2=fmerge_2.Breps)
cull_19 = CullPattern(List=merge_15, CullPattern=item_3)
clean_7 = CleanTree(RemoveNulls=True, RemoveInvalid=True, RemoveEmpty=True, Tree=cull_19)
cull_20 = CullPattern(List=extr_3, CullPattern=invert(item_6))
cull_21 = CullPattern(List=[filedge, merge_13], CullPattern=item_6)
cull_22 = CullPattern(List=filedge, CullPattern=item_6)
merge_16 = Merge(Data1=clean_7, Data2=fmerge_3.Breps)
cull_23 = CullPattern(List=cull_20, CullPattern=item_5)
cull_24 = CullPattern(List=cull_21, CullPattern=item_5)
cull_25 = CullPattern(List=cull_22, CullPattern=item_5)
mesh = Mesh(flatten(sdiff))
smesh = SimpleMesh(Brep=cull_23)  # -> flatten(Mesh)
smesh_2 = SimpleMesh(Brep=extr_15)  # -> flatten(Mesh)
mesh_2 = Mesh(flatten(cull_25))
smesh_3 = SimpleMesh(Brep=merge_16)  # -> flatten(Mesh)
mesh_3 = Mesh(flatten(cull_24))
mjoin = MeshJoin(Meshes=mesh)
mjoin_2 = MeshJoin(Meshes=smesh)
mjoin_3 = MeshJoin(Meshes=smesh_2)
mjoin_4 = MeshJoin(Meshes=mesh_2)
mjoin_5 = MeshJoin(Meshes=mesh_3)
mjoin_6 = MeshJoin(Meshes=smesh_3)
merge_17 = Merge(Data2=mjoin, Data3=mjoin_5, Data4=mjoin_3, Data5=mjoin_4, Data6=mjoin_6)

# ---- group: RH_OUT:115:Mesh
mesh_4 = Mesh(merge_17)

# ----
preview = CustomPreview(Geometry=cull_23, Material=ColourSwatch(SwatchColor=RGB(219, 219, 219)))
preview_2 = CustomPreview(Geometry=sdiff, Material=ColourSwatch(SwatchColor=RGBA(255, 255, 255, 180)))
preview_3 = CustomPreview(Geometry=extr_15, Material=ColourSwatch(SwatchColor=RGB(224, 192, 103)))
preview_4 = CustomPreview(Geometry=merge_16, Material=ColourSwatch(SwatchColor=RGB(140, 105, 105)))
preview_5 = CustomPreview(Geometry=cull_24, Material=ColourSwatch(SwatchColor=RGB(181, 181, 181)))
preview_6 = CustomPreview(Geometry=cull_25, Material=ColourSwatch(SwatchColor=RGB(87, 87, 87)))
