# Grasshopper definition Casework6.gh (Grasshopper 1.0.7)

pt = ConstructPoint(XCoordinate=0, YCoordinate=0, ZCoordinate=0)

# ---- group: RH_IN:201:Length
branch_length = Slider(53.41, range=0..90)

# ---- group: RH_IN:201:Width
cell_radius = Slider(26.1, range=0..60)

# ---- group: RH_IN:201:Height
number_slider = Slider(2, range=1..10)

# ----
pegboard_height_from_ground = Slider(120, range=0..1000)
pegboard_length = Slider(52, range=0..100)
pegboard_heigth = Slider(36, range=0..36)
pegboard_thickness = Slider(1, range=0..36)
pegbard_crop_bottom = Slider(5, range=0..100)
pegboard_crop_top = Slider(5, range=0..100)
pegboard_crop_left = Slider(20, range=0..100)
pegboard_crop_right = Slider(4, range=0..100)
pegboard_hook_u_count = Slider(7, range=0..10)
pegboard_hook_v_count = Slider(12, range=0..100)
pegboard_hook_pattern_type = Slider(2, range=1..3)
pegboard_hook_angle = Slider(50, range=-90..90)
pegboard_hook_length = Slider(5, range=0..100)
pegboard_hook_radius = Slider(0.125, range=0..1)
pegboard_base_depth = Slider(2, range=0..10)
pegboard_base_thickness = Slider(0.0625, range=0..1)
pegboard_base_extension_height = Slider(0.75, range=0..10)
pegboard_base_extension_thickness = Slider(0.125, range=0..1)
pegboard_hook_joint_upper_horizontal_sca = Slider(0, range=0..10)  # "Pegboard_Hook_Joint_Upper_Horizontal_Scale"
pegboard_hook_joint_upper_vertical_scale = Slider(0.5, range=0..1)
pegboard_hook_joint_lower_horizontal_sca = Slider(0.25, range=0..10)  # "Pegboard_Hook_Joint_Lower_Horizontal_Scale"
pegboard_hook_joint_upper_vertical_scale_2 = Slider(0.25, range=0..1)
pegboard_hook_joint_thickness = Slider(0.15, range=0..1)
pegboard_hook_joint_fillet = Slider(0, range=0..1)
pt_2 = Point(pt)
series = Series(Start=0, Step=Slider(50, range=0..100), Count=Slider(3, range=0..10))
pt_3 = ConstructPoint(XCoordinate=series, YCoordinate=0, ZCoordinate=0)
xy = XYPlane(Origin=pt_3)
yz = YZPlane(Origin=Point(0, 0, 0))
addition = Addition(A=number_slider, B=pegboard_base_depth)
neg = Negative(Value=pegboard_base_thickness)
neg_2 = Negative(Value=pegboard_base_extension_thickness)
Z = UnitZ(Factor=pegboard_height_from_ground)
Y = UnitY(Factor=branch_length)
Z_2 = UnitZ(Factor=cell_radius)
X = UnitX(Factor=number_slider)
X_2 = UnitX(Factor=addition)
Z_3 = UnitZ(Factor=neg)
Z_4 = UnitZ(Factor=pegboard_base_extension_height)
X_3 = UnitX(Factor=neg_2)
move = Move(Geometry=pt_2, Motion=Z)  # -> Geometry, Transform
move_2 = Move(Geometry=move.Geometry, Motion=Y)  # -> Geometry, Transform
ln = Line(StartPoint=move.Geometry, EndPoint=move_2.Geometry)
extr = Extrude(Base=ln, Direction=Z_2)
move_3 = Move(Geometry=extr, Motion=X)  # -> Geometry, Transform
dim = Dimensions(Surface=move_3.Geometry)  # -> UDimension, VDimension
subtraction = Subtraction(A=dim.UDimension, B=pegboard_crop_top)
subtraction_2 = Subtraction(A=dim.VDimension, B=pegboard_crop_right)
division = Division(A=pegbard_crop_bottom, B=dim.UDimension)
division_2 = Division(A=subtraction, B=dim.UDimension)
division_3 = Division(A=pegboard_crop_left, B=dim.VDimension)
division_4 = Division(A=subtraction_2, B=dim.VDimension)
dom²num = ConstructDomain²(UMin=division, UMax=division_2, VMin=division_3, VMax=division_4)
equals = Equality(FirstNumber=pegboard_hook_pattern_type, SecondNumber=1)  # -> Equality, Inequality
equals_2 = Equality(FirstNumber=pegboard_hook_pattern_type, SecondNumber=2)  # -> Equality, Inequality
equals_3 = Equality(FirstNumber=pegboard_hook_pattern_type, SecondNumber=3)  # -> Equality, Inequality
move_4 = Move(Geometry=ln, Motion=X_2)  # -> Geometry, Transform
panel = Panel("""1
0""")
panel_2 = Panel("""0
1""")
panel_3 = Panel("""1
1""")
subsrf = Isotrim(Surface=reparameterize(move_3.Geometry), Domain=dom²num)
sdivide = DivideSurface(Surface=move_3.Geometry, UCount=pegboard_hook_u_count, VCount=pegboard_hook_v_count)  # -> Points, Normals, Parameters
extr_2 = Extrude(Base=move_4.Geometry, Direction=Z_4)
extr_3 = Extrude(Base=ln, Direction=X_2)
trim = TrimTree(Tree=sdivide.Points, Depth=1)
cull = CullPattern(List=panel, CullPattern=equals.Equality)
cull_2 = CullPattern(List=panel_2, CullPattern=equals_2.Equality)
cull_3 = CullPattern(List=panel_3, CullPattern=equals_3.Equality)
shift = ShiftList(List=trim, Shift=1, Wrap=True)
merge = Merge(Data1=cull, Data2=cull_2, Data3=cull_3)
extr_4 = Extrude(Base=extr_2, Direction=X_3)
extr_5 = Extrude(Base=extr_3, Direction=Z_3)
clean = CleanTree(RemoveNulls=True, RemoveInvalid=True, RemoveEmpty=True, Tree=merge)
sift = SiftPattern(List=shift, SiftPattern=clean)  # -> Output0, Output1
evalsrf = EvaluateSurface(Surface=reparameterize(move_3.Geometry), Point="0.5,0.5")  # -> Point, Normal, UDirection, VDirection, Frame
clean_2 = CleanTree(RemoveNulls=True, RemoveInvalid=True, RemoveEmpty=True, Tree=sift.Output1)
incurve = PointInCurve(Point=clean_2, Curve=graft(subsrf))  # -> Relationship, Point
X_4 = UnitX(Factor=pegboard_hook_length)
cull_4 = CullPattern(List=clean_2, CullPattern=incurve.Relationship)
neg_3 = Negative(Value=pegboard_hook_angle)
move_5 = Move(Geometry=cull_4, Motion=X_4)  # -> Geometry, Transform
rot3d = Rotate3D(Geometry=move_5.Geometry, Angle=degrees(neg_3), Center=cull_4, Axis=Vector(0, 1, 0))  # -> Geometry, Transform
ln_2 = Line(StartPoint=cull_4, EndPoint=rot3d.Geometry)
rad = Radians(Degrees=pegboard_hook_angle)
cos = Cosine(Value=rad)
division_5 = Division(A=pegboard_hook_radius, B=cos)
pl = PlaneNormal(Origin=cull_4, ZAxis=evalsrf.Normal)
circle = CircleCNR(Center=rot3d.Geometry, Normal=ln_2, Radius=pegboard_hook_radius)  # -> graft(Circle)
ellipse = Ellipse(Plane=pl, Radius1=pegboard_hook_radius, Radius2=division_5)  # -> graft(Ellipse), Focus1, Focus2
eval = EvaluateLength(Curve=ellipse.Ellipse, Length=0.25, Normalized=True)  # -> Point, Tangent, Parameter
eval_2 = EvaluateLength(Curve=ellipse.Ellipse, Length=0.75, Normalized=True)  # -> Point, Tangent, Parameter
sph = Sphere(Base=circle, Radius=pegboard_hook_radius)
neg_4 = Negative(Value=pegboard_hook_joint_lower_horizontal_sca)
neg_5 = Negative(Value=pegboard_hook_joint_upper_horizontal_sca)
neg_6 = Negative(Value=pegboard_hook_joint_upper_vertical_scale_2)
neg_7 = Negative(Value=pegboard_hook_joint_upper_vertical_scale_2)
split = SplitBrep(Brep=sph, Cutter=circle)
loft = Loft(
    Curves=[ellipse.Ellipse, circle],
    Options={Adjust=True, Closed=False, LoftEnds=0, LoftSimp=0, LoftType=0, Rebuild=10, Refit=0.01})  # -> simplify(Loft)
Z_5 = UnitZ(Factor=pegboard_hook_joint_upper_vertical_scale)
Y_2 = UnitY(Factor=pegboard_hook_joint_upper_horizontal_sca)
Z_6 = UnitZ(Factor=pegboard_hook_joint_upper_vertical_scale)
Y_3 = UnitY(Factor=neg_5)
Z_7 = UnitZ(Factor=neg_7)
Y_4 = UnitY(Factor=pegboard_hook_joint_lower_horizontal_sca)
Z_8 = UnitZ(Factor=neg_6)
Y_5 = UnitY(Factor=neg_4)
item = ListItem(List=split, Index=0, Wrap=True)  # -> simplify(Item)
addition_2 = Addition(A=Z_8, B=Y_5)
merge_2 = Merge(Data1=extr_4, Data2=extr_5)
addition_3 = Addition(A=Z_7, B=Y_4)
extr_6 = Extrude(Base=extr, Direction=X)
addition_4 = Addition(A=Z_5, B=Y_2)
addition_5 = Addition(A=Z_6, B=Y_3)
join = BrepJoin(Breps=[item, loft])  # -> Breps, Closed
move_6 = Move(Geometry=eval.Point, Motion=addition_4)  # -> graft(Geometry), Transform
move_7 = Move(Geometry=eval.Point, Motion=addition_5)  # -> graft(Geometry), Transform
move_8 = Move(Geometry=eval_2.Point, Motion=addition_3)  # -> graft(Geometry), Transform
move_9 = Move(Geometry=eval_2.Point, Motion=addition_2)  # -> graft(Geometry), Transform
cap = CapHoles(Brep=join.Breps)
intcrv = Interpolate(Vertices=[move_6.Geometry, move_8.Geometry, move_9.Geometry, move_7.Geometry], Degree=3, Periodic=True, KnotStyle=1)  # -> Curve, Length, Domain
X_5 = UnitX(Factor=pegboard_hook_joint_thickness)
move_10 = Move(Geometry=cap, Motion=X_5)  # -> Geometry, Transform
srf = Surface(intcrv.Curve)
extr_7 = Extrude(Base=srf, Direction=X_5)  # -> simplify(Extrusion)
mesh = Mesh(flatten(extr_6))
mesh_2 = Mesh(flatten(merge_2))
mesh_3 = Mesh(flatten(move_10.Geometry))
mjoin = MeshJoin(Meshes=mesh)
mjoin_2 = MeshJoin(Meshes=mesh_2)
mjoin_3 = MeshJoin(Meshes=mesh_3)
filedge = FilletEdge(Shape=extr_7, Blend=0, Metric=0, Edges="1", Radii=pegboard_hook_joint_fillet)
mesh_4 = Mesh(flatten(filedge))
swatch = ColourSwatch(SwatchColor=RGB(74, 74, 74))
swatch_2 = ColourSwatch(SwatchColor=RGB(140, 105, 105))
swatch_3 = ColourSwatch(SwatchColor=RGB(224, 192, 103))
swatch_4 = ColourSwatch(SwatchColor=RGB(158, 156, 152))
mjoin_4 = MeshJoin(Meshes=mesh_4)
merge_3 = Merge(Data1=mjoin_3, Data3=mjoin_2, Data4=mjoin, Data5=mjoin_4)
rotate = Rotate(Geometry=merge_3, Angle=degrees("-90"), Plane=yz)  # -> Geometry, Transform
scale = Scale(Geometry=rotate.Geometry, Center=Point(0, 0, 0), Factor=Slider(0.1, range=0..0.1))  # -> Geometry, Transform

# ---- group: RH_OUT:115:Mesh
mesh_5 = Mesh(scale.Geometry)

# ----
preview = CustomPreview(Geometry=filedge, Material=swatch_4)
preview_2 = CustomPreview(Geometry=move_10.Geometry, Material=swatch)
preview_3 = CustomPreview(Geometry=merge_2, Material=swatch_2)
preview_4 = CustomPreview(Geometry=extr_6, Material=swatch_3)
merge_4 = Merge(Data1=swatch, Data2=swatch_2, Data3=swatch_3, Data4=swatch_4)
argb = SplitARGB(Colour=merge_4, IntegerChannels=True)  # -> Alpha, Red, Green, Blue
c_script = CSharpScript(r=argb.Red, g=argb.Green, b=argb.Blue)  # -> out, A; inputs r: Int32, g: Int32, b: Int32
# ---------- c_script: C# ----------
A = string.Format("{0:X2}{1:X2}{2:X2}", r, g, b);
# ---------- end c_script ----------
panel_4 = Panel(c_script.A)
concat = Concatenate(FragmentA="0x", FragmentB=panel_4)
join_2 = TextJoin(Text=concat, Join=",")
panel_5 = Panel(join_2)
