# Grasshopper definition Casework7.gh (Grasshopper 1.0.7)

pt = ConstructPoint(XCoordinate=0, YCoordinate=0, ZCoordinate=0)

# ---- group: RH_IN:201:Length
branch_length = Slider(53.41, range=0..90)

# ---- group: RH_IN:201:Width
cell_radius = Slider(26.1, range=0..60)

# ---- group: RH_IN:201:Height
number_slider = Slider(2, range=1..10)

# ----
pegboard_height_from_ground = Slider(120, range=0..1000)
pegboard_length = Slider(52, range=0..100)
pegboard_heigth = Slider(36, range=0..36)
pegboard_thickness = Slider(1, range=0..36)
pegbard_crop_bottom = Slider(5, range=0..100)
pegboard_crop_top = Slider(5, range=0..100)
pegboard_crop_left = Slider(20, range=0..100)
pegboard_crop_right = Slider(4, range=0..100)
pegboard_hook_u_count = Slider(7, range=0..10)
pegboard_hook_v_count = Slider(12, range=0..100)
pegboard_hook_pattern_type = Slider(2, range=1..3)
pegboard_hook_angle = Slider(50, range=-90..90)
pegboard_hook_length = Slider(5, range=0..100)
pegboard_hook_radius = Slider(0.125, range=0..1)
pegboard_base_depth = Slider(2, range=0..10)
pegboard_base_thickness = Slider(0.0625, range=0..1)
pegboard_base_extension_height = Slider(0.75, range=0..10)
pegboard_base_extension_thickness = Slider(0.125, range=0..1)
pegboard_hook_joint_upper_horizontal_sca = Slider(0, range=0..10)  # "Pegboard_Hook_Joint_Upper_Horizontal_Scale"
pegboard_hook_joint_upper_vertical_scale = Slider(0.5, range=0..1)
pegboard_hook_joint_lower_horizontal_sca = Slider(0.25, range=0..10)  # "Pegboard_Hook_Joint_Lower_Horizontal_Scale"
pegboard_hook_joint_upper_vertical_scale_2 = Slider(0.25, range=0..1)
pegboard_hook_joint_thickness = Slider(0.15, range=0..1)
pegboard_hook_joint_fillet = Slider(0, range=0..1)
pt_2 = Point(pt)
series = Series(Start=0, Step=Slider(50, range=0..100), Count=Slider(3, range=0..10))
pt_3 = ConstructPoint(XCoordinate=series, YCoordinate=0, ZCoordinate=0)
xy = XYPlane(Origin=pt_3)
# Pegboard
pt_4 = ConstructPoint(XCoordinate=0, YCoordinate=0, ZCoordinate=0)
addition = Addition(A=number_slider, B=pegboard_base_depth)
neg = Negative(Value=pegboard_base_thickness)
neg_2 = Negative(Value=pegboard_base_extension_thickness)
# Lab_Bench
pt_5 = ConstructPoint(XCoordinate=0, YCoordinate=0, ZCoordinate=0)
# Cabinet
pt_6 = ConstructPoint(XCoordinate=0, YCoordinate=0, ZCoordinate=0)
Z = UnitZ(Factor=pegboard_height_from_ground)
Y = UnitY(Factor=branch_length)
Z_2 = UnitZ(Factor=cell_radius)
X = UnitX(Factor=number_slider)
X_2 = UnitX(Factor=addition)
Z_3 = UnitZ(Factor=neg)
Z_4 = UnitZ(Factor=pegboard_base_extension_height)
X_3 = UnitX(Factor=neg_2)
cabinet_type = Slider(2, range=1..4)
cabinet_base_type = Slider(3, range=1..3)
cabinet_height = Slider(30.5, range=0..100)
cabinet_width = Slider(27, range=0..100)
cabinet_depth = Slider(23.25, range=0..100)
cabinet_base_height = Slider(4, range=0..10)
cabinet_base_recess = Slider(3, range=0..10)
cabinet_thickness = Slider(0.75, range=0..5)
cabinet_panel_thickness = Slider(0.75, range=0..10)
cabinet_middle_vertical_line_2_3 = Slider(0.5, range=0..1)
cabinet_horizontal_line_height_2_3_4 = Slider(5.7, range=0..10)
cabinet_vertical_handle_location_u_2_3_4 = Slider(1.25, range=0..10)
cabinet_vertical_handle_location_v_2_3_4 = Slider(2.75, range=0..10)
cabinet_horizontal_handle_location_v = Slider(1.75, range=-10..10)
cabinet_handle_depth = Slider(0.75, range=0..1)
cabinet_handle_lenght = Slider(4, range=0..100)
cabinet_handle_thickness = Slider(0.5, range=0..1)
drawer_heights_for_type_1 = Panel("""5.5
6
6
6
8""")
cabinet_wheel_offset = Slider(1, range=0..5)
cabinet_wheel_joint_lenght = Slider(4, range=0..10)
cabinet_wheel_joint_width = Slider(1.5, range=0..10)
cabinet_wheel_joint_height = Slider(0.5, range=0..10)
cabinet_wheel_joint_fillet_radius = Slider(0.5, range=0.1..1.1)
cabinet_wheel_joint_triangle_thickness = Slider(0.25, range=0..10)
cabinet_wheel_edge_fillet_raidus = Slider(0.5, range=0..1)
pt_7 = Point(pt_6)
wall_cabinet_type = Slider(1, range=1..2)
cabinet_height_from_ground = Slider(50, range=0..100)
wall_cabinet_depth = Slider(13, range=0..100)
wall_cabinet_width = Slider(27, range=0..100)
wall_cabinet_height = Slider(30, range=0..100)
wall_cabinet_thickness = Slider(0.75, range=0..5)
wall_cabinet_middle_vertical_line = Slider(0.5, range=0..1)
# Wall_Cabinet
wall_cabinet_panel_thickness = Slider(0.75, range=0..10)
wall_cabinet_panel_offset_1 = Slider(2, range=0..5)
wall_cabinet_glass_thickness_1 = Slider(0.25, range=0..10)
wall_cabinet_handle_location_v = Slider(3, range=-10..100)
wall_cabinet_handle_location_u = Slider(0.75, range=0..20)
wall_cabinet_handle_lenght = Slider(4, range=0..10)
wall_cabinet_handle_depth = Slider(0.75, range=0..10)
wall_cabinet_handle_thickness = Slider(0.5, range=0..1)
pt_8 = Point(pt_4)
pegboard_height_from_ground_2 = Slider(120, range=0..1000)
pegboard_length_2 = Slider(52, range=0..100)
pegboard_heigth_2 = Slider(36, range=0..36)
pegboard_thickness_2 = Slider(1, range=0..36)
pegbard_crop_bottom_2 = Slider(5, range=0..100)
pegboard_crop_top_2 = Slider(5, range=0..100)
pegboard_crop_left_2 = Slider(20, range=0..100)
pegboard_crop_right_2 = Slider(4, range=0..100)
pegboard_hook_u_count_2 = Slider(7, range=0..10)
pegboard_hook_v_count_2 = Slider(12, range=0..100)
pegboard_hook_pattern_type_2 = Slider(2, range=1..3)
pegboard_hook_angle_2 = Slider(50, range=-90..90)
pegboard_hook_length_2 = Slider(5, range=0..100)
pegboard_hook_radius_2 = Slider(0.125, range=0..1)
pegboard_base_depth_2 = Slider(2, range=0..10)
pegboard_base_thickness_2 = Slider(0.0625, range=0..1)
pegboard_base_extension_height_2 = Slider(0.75, range=0..10)
pegboard_base_extension_thickness_2 = Slider(0.125, range=0..1)
pegboard_hook_joint_upper_horizontal_sca_2 = Slider(0, range=0..10)  # "Pegboard_Hook_Joint_Upper_Horizontal_Scale"
pegboard_hook_joint_upper_vertical_scale_3 = Slider(0.5, range=0..1)
pegboard_hook_joint_lower_horizontal_sca_2 = Slider(0.25, range=0..10)  # "Pegboard_Hook_Joint_Lower_Horizontal_Scale"
pegboard_hook_joint_upper_vertical_scale_4 = Slider(0.25, range=0..1)
pegboard_hook_joint_thickness_2 = Slider(0.15, range=0..1)
pegboard_hook_joint_fillet_2 = Slider(0, range=0..1)
pt_9 = Point(pt_6)
lab_bench_counter_thickness = Slider(1, range=0..10)

# ---- group: RH_IN:201:Lab_Bench_Width
lab_bench_width = Slider(30, range=0..100)

# ---- group: RH_IN:201:Lab_Bench_Height
lab_bench_height = Slider(37, range=0..100)

# ----
lab_bench_front_horizontal_bar_recess = Slider(0, range=0..20)
lab_bench_back_horizontal_bar_recess = Slider(1, range=0..10)
lab_bench_shelf_horizontal_division_numb = Slider(2, range=1..10)  # "Lab_Bench_Shelf_Horizontal_Division_Number"
lab_bench_shelf_lower_bar_height_from_co = Slider(14, range=0..100)  # "Lab_Bench_Shelf_Lower_Bar_Height_From_Counter"
lab_bench_shelf_lower_bar_height = Slider(3, range=0..10)
lab_bench_shelf_vertical_structure_heigh = Slider(48, range=0..100)  # "Lab_Bench_Shelf_Vertical_Structure_Height"
lab_bench_horizontal_bar_thickness = Slider(1.5, range=0..10)
lab_bench_main_structure_thickness = Slider(2, range=0..5)
lab_bench_front_leg_recess = Slider(1, range=0..100)
lab_bench_back_leg_recess = Slider(1.5, range=0..10)
lab_bench_outer_horizontal_frame_thickne = Slider(0.816, range=0..2)  # "Lab_Bench_Outer_Horizontal_Frame_Thickness"
lab_bench_inner_horizontal_frame_thickne = Slider(1.5, range=0..10)  # "Lab_Bench_Inner_Horizontal_Frame_Thickness"
lab_bench_bottom_disk_thickness = Slider(0.25, range=0..10)
lab_bench_bottom_disk_joint_radius = Slider(0.35, range=0..1)
lab_bench_leg_extension_height = Slider(6, range=0..10)
lab_bench_shelf_thickness = Slider(1, range=0..10)
lab_bench_shelf_depth = Slider(12, range=0..100)
lab_bench_top_shelf_depth = Slider(21, range=0..100)
lab_bench_bottom_disk_radius = Slider(1, range=0..10)
lab_bench_bottom_disk_joint_thickness = Slider(0.25, range=0..10)
lab_bench_leg_extension_thickness = Slider(1.25, range=0..10)
lab_bench_shelf_vertical_division_number = Slider(2, range=0..10)

# ---- group: RH_IN:201:Lab_Bench_Length
lab_bench_length = Slider(72, range=0..100)

# ----
pt_10 = Point(pt_5)
move = Move(Geometry=pt_2, Motion=Z)  # -> Geometry, Transform
move_2 = Move(Geometry=move.Geometry, Motion=Y)  # -> Geometry, Transform
ln = Line(StartPoint=move.Geometry, EndPoint=move_2.Geometry)
extr = Extrude(Base=ln, Direction=Z_2)
X_4 = UnitX(Factor=lab_bench_width)
Y_2 = UnitY(Factor=lab_bench_length)
Z_5 = UnitZ(Factor=lab_bench_height)
Z_6 = UnitZ(Factor=lab_bench_counter_thickness)
move_3 = Move(Geometry=extr, Motion=X)  # -> Geometry, Transform
move_4 = Move(Geometry=pt_10, Motion=X_4)  # -> Geometry, Transform
addition_2 = Addition(A=pegboard_thickness_2, B=pegboard_base_depth_2)
neg_3 = Negative(Value=Z_6)
dim = Dimensions(Surface=move_3.Geometry)  # -> UDimension, VDimension
ln_2 = Line(StartPoint=move_4.Geometry, EndPoint=pt_10)
neg_4 = Negative(Value=pegboard_base_thickness_2)
neg_5 = Negative(Value=pegboard_base_extension_thickness_2)
extr_2 = Extrude(Base=ln_2, Direction=Y_2)
Z_7 = UnitZ(Factor=pegboard_height_from_ground_2)
Y_3 = UnitY(Factor=pegboard_length_2)
Z_8 = UnitZ(Factor=pegboard_heigth_2)
X_5 = UnitX(Factor=pegboard_thickness_2)
X_6 = UnitX(Factor=addition_2)
Z_9 = UnitZ(Factor=neg_4)
Z_10 = UnitZ(Factor=pegboard_base_extension_height_2)
X_7 = UnitX(Factor=neg_5)
subtraction = Subtraction(A=dim.UDimension, B=pegboard_crop_top)
subtraction_2 = Subtraction(A=dim.VDimension, B=pegboard_crop_right)
move_5 = Move(Geometry=extr_2, Motion=Z_5)  # -> Geometry, Transform
division = Division(A=pegbard_crop_bottom, B=dim.UDimension)
division_2 = Division(A=subtraction, B=dim.UDimension)
division_3 = Division(A=pegboard_crop_left, B=dim.VDimension)
division_4 = Division(A=subtraction_2, B=dim.VDimension)
move_6 = Move(Geometry=pt_8, Motion=Z_7)  # -> Geometry, Transform
dom²num = ConstructDomain²(UMin=division, UMax=division_2, VMin=division_3, VMax=division_4)
move_7 = Move(Geometry=move_6.Geometry, Motion=Y_3)  # -> Geometry, Transform
equals = Equality(FirstNumber=pegboard_hook_pattern_type, SecondNumber=1)  # -> Equality, Inequality
equals_2 = Equality(FirstNumber=pegboard_hook_pattern_type, SecondNumber=2)  # -> Equality, Inequality
equals_3 = Equality(FirstNumber=pegboard_hook_pattern_type, SecondNumber=3)  # -> Equality, Inequality
move_8 = Move(Geometry=ln, Motion=X_2)  # -> Geometry, Transform
dim_2 = Dimensions(Surface=extr_2)  # -> UDimension, VDimension
ln_3 = Line(StartPoint=move_6.Geometry, EndPoint=move_7.Geometry)
panel = Panel("""1
0""")
panel_2 = Panel("""0
1""")
panel_3 = Panel("""1
1""")
subsrf = Isotrim(Surface=reparameterize(move_3.Geometry), Domain=dom²num)
sdivide = DivideSurface(Surface=move_3.Geometry, UCount=pegboard_hook_u_count, VCount=pegboard_hook_v_count)  # -> Points, Normals, Parameters
extr_3 = Extrude(Base=ln_3, Direction=Z_8)
extr_4 = Extrude(Base=move_8.Geometry, Direction=Z_4)
extr_5 = Extrude(Base=ln, Direction=X_2)
trim = TrimTree(Tree=sdivide.Points, Depth=1)
cull = CullPattern(List=panel, CullPattern=equals.Equality)
cull_2 = CullPattern(List=panel_2, CullPattern=equals_2.Equality)
cull_3 = CullPattern(List=panel_3, CullPattern=equals_3.Equality)
move_9 = Move(Geometry=extr_3, Motion=X_5)  # -> Geometry, Transform
shift = ShiftList(List=trim, Shift=1, Wrap=True)
merge = Merge(Data1=cull, Data2=cull_2, Data3=cull_3)
extr_6 = Extrude(Base=extr_4, Direction=X_3)
extr_7 = Extrude(Base=extr_5, Direction=Z_3)
dim_3 = Dimensions(Surface=move_9.Geometry)  # -> UDimension, VDimension
subtraction_3 = Subtraction(A=dim_2.VDimension, B=lab_bench_back_leg_recess)
clean = CleanTree(RemoveNulls=True, RemoveInvalid=True, RemoveEmpty=True, Tree=merge)
addition_3 = Addition(A=lab_bench_main_structure_thickness, B=lab_bench_front_leg_recess)
sift = SiftPattern(List=shift, SiftPattern=clean)  # -> Output0, Output1
equals_4 = Equality(FirstNumber=cabinet_type, SecondNumber=1)  # -> Equality, Inequality
equals_5 = Equality(FirstNumber=cabinet_type, SecondNumber=2)  # -> Equality, Inequality
equals_6 = Equality(FirstNumber=cabinet_type, SecondNumber=3)  # -> Equality, Inequality
equals_7 = Equality(FirstNumber=cabinet_type, SecondNumber=4)  # -> Equality, Inequality
equals_8 = Equality(FirstNumber=cabinet_base_type, SecondNumber=1)  # -> Equality, Inequality
equals_9 = Equality(FirstNumber=cabinet_base_type, SecondNumber=2)  # -> Equality, Inequality
equals_10 = Equality(FirstNumber=cabinet_base_type, SecondNumber=3)  # -> Equality, Inequality
panel_4 = Panel(subtraction_3)
addition_4 = Addition(A=addition_3, B=lab_bench_front_horizontal_bar_recess)
evalsrf = EvaluateSurface(Surface=reparameterize(move_3.Geometry), Point="0.5,0.5")  # -> Point, Normal, UDirection, VDirection, Frame
clean_2 = CleanTree(RemoveNulls=True, RemoveInvalid=True, RemoveEmpty=True, Tree=sift.Output1)
subtraction_4 = Subtraction(A=dim_3.UDimension, B=pegboard_crop_top_2)
subtraction_5 = Subtraction(A=dim_3.VDimension, B=pegboard_crop_right_2)
panel_5 = Panel("""0
0""")
panel_6 = Panel("""1
0""")
panel_7 = Panel("""1
1""")
panel_8 = Panel("""1
0
0""")
panel_9 = Panel("""1
1
0""")
panel_10 = Panel("""0
1
0""")
panel_11 = Panel("""1
1
1""")
subtraction_6 = Subtraction(A=subtraction_3, B=lab_bench_main_structure_thickness)
cull_4 = CullPattern(List=panel_8, CullPattern=equals_4.Equality)
cull_5 = CullPattern(List=panel_9, CullPattern=equals_5.Equality)
cull_6 = CullPattern(List=panel_10, CullPattern=equals_6.Equality)
cull_7 = CullPattern(List=panel_11, CullPattern=equals_7.Equality)
cull_8 = CullPattern(List=panel_5, CullPattern=equals_8.Equality)
cull_9 = CullPattern(List=panel_6, CullPattern=equals_9.Equality)
cull_10 = CullPattern(List=panel_7, CullPattern=equals_10.Equality)
division_5 = Division(A=pegbard_crop_bottom_2, B=dim_3.UDimension)
division_6 = Division(A=subtraction_4, B=dim_3.UDimension)
division_7 = Division(A=pegboard_crop_left_2, B=dim_3.VDimension)
division_8 = Division(A=subtraction_5, B=dim_3.VDimension)
panel_12 = Panel(subtraction_6)
subtraction_7 = Subtraction(A=dim_2.UDimension, B=lab_bench_main_structure_thickness)
panel_13 = Panel(addition_3)
panel_14 = Panel(addition_4)
merge_2 = Merge(Data1=cull_8, Data2=cull_9, Data3=cull_10)
merge_3 = Merge(Data1=cull_4, Data2=cull_5, Data3=cull_6, Data4=cull_7)
subtraction_8 = Subtraction(A=subtraction_6, B=lab_bench_inner_horizontal_frame_thickne)
dom²num_2 = ConstructDomain²(UMin=division_5, UMax=division_6, VMin=division_7, VMax=division_8)
addition_5 = Addition(A=cabinet_depth, B=cabinet_panel_thickness)
subtraction_9 = Subtraction(A=cabinet_height, B=cabinet_horizontal_line_height_2_3_4)
panel_15 = Panel(subtraction_7)
clean_3 = CleanTree(RemoveNulls=True, RemoveInvalid=True, RemoveEmpty=True, Tree=merge_2)
clean_4 = CleanTree(RemoveNulls=True, RemoveInvalid=True, RemoveEmpty=True, Tree=merge_3)
panel_16 = Panel(subtraction_8)
subtraction_10 = Subtraction(A=addition_5, B=cabinet_base_recess)
equals_11 = Equality(FirstNumber=pegboard_hook_pattern_type_2, SecondNumber=1)  # -> Equality, Inequality
equals_12 = Equality(FirstNumber=pegboard_hook_pattern_type_2, SecondNumber=2)  # -> Equality, Inequality
equals_13 = Equality(FirstNumber=pegboard_hook_pattern_type_2, SecondNumber=3)  # -> Equality, Inequality
incurve = PointInCurve(Point=clean_2, Curve=graft(subsrf))  # -> Relationship, Point
move_10 = Move(Geometry=ln_3, Motion=X_6)  # -> Geometry, Transform
X_8 = UnitX(Factor=subtraction_10)
X_9 = UnitX(Factor=cabinet_depth)
Y_4 = UnitY(Factor=cabinet_width)
Z_11 = UnitZ(Factor=cabinet_base_height)
Z_12 = UnitZ(Factor=cabinet_height)
X_10 = UnitX(Factor=cabinet_panel_thickness)
item = ListItem(List=clean_4, Index=0, Wrap=True)
item_2 = ListItem(List=clean_4, Index=1, Wrap=True)
item_3 = ListItem(List=clean_4, Index=2, Wrap=True)
item_4 = ListItem(List=clean_3, Index=0, Wrap=True)
item_5 = ListItem(List=clean_3, Index=1, Wrap=True)
panel_17 = Panel("""1
0""")
panel_18 = Panel("""0
1""")
panel_19 = Panel("""1
1""")
subsrf_2 = Isotrim(Surface=reparameterize(move_9.Geometry), Domain=dom²num_2)
X_11 = UnitX(Factor=pegboard_hook_length)
cull_11 = CullPattern(List=clean_2, CullPattern=incurve.Relationship)
sdivide_2 = DivideSurface(Surface=move_9.Geometry, UCount=pegboard_hook_u_count_2, VCount=pegboard_hook_v_count_2)  # -> Points, Normals, Parameters
move_11 = Move(Geometry=pt_9, Motion=X_8)  # -> Geometry, Transform
move_12 = Move(Geometry=pt_9, Motion=X_9)  # -> Geometry, Transform
cull_12 = CullPattern(List=cabinet_middle_vertical_line_2_3, CullPattern=invert(item_3))
extr_8 = Extrude(Base=move_10.Geometry, Direction=Z_10)
extr_9 = Extrude(Base=ln_3, Direction=X_6)
cull_13 = CullPattern(List=0, CullPattern=item_3)
trim_2 = TrimTree(Tree=sdivide_2.Points, Depth=1)
cull_14 = CullPattern(List=panel_17, CullPattern=equals_11.Equality)
cull_15 = CullPattern(List=panel_18, CullPattern=equals_12.Equality)
cull_16 = CullPattern(List=panel_19, CullPattern=equals_13.Equality)
ln_4 = Line(StartPoint=move_11.Geometry, EndPoint=pt_9)
ln_5 = Line(StartPoint=move_12.Geometry, EndPoint=pt_9)
merge_4 = Merge(Data1=cull_12, Data2=cull_13)
neg_6 = Negative(Value=pegboard_hook_angle)
shift_2 = ShiftList(List=trim_2, Shift=1, Wrap=True)
extr_10 = Extrude(Base=ln_4, Direction=Y_4)
extr_11 = Extrude(Base=ln_5, Direction=Y_4)
clean_5 = CleanTree(RemoveNulls=True, RemoveInvalid=True, RemoveEmpty=True, Tree=merge_4)
merge_5 = Merge(Data1=cull_14, Data2=cull_15, Data3=cull_16)
extr_12 = Extrude(Base=extr_8, Direction=X_7)
extr_13 = Extrude(Base=extr_9, Direction=Z_9)
move_13 = Move(Geometry=cull_11, Motion=X_11)  # -> Geometry, Transform
clean_6 = CleanTree(RemoveNulls=True, RemoveInvalid=True, RemoveEmpty=True, Tree=merge_5)
move_14 = Move(Geometry=extr_11, Motion=Z_11)  # -> Geometry, Transform
extr_14 = Extrude(Base=extr_10, Direction=Z_11)
rot3d = Rotate3D(Geometry=move_13.Geometry, Angle=degrees(neg_6), Center=cull_11, Axis=Vector(0, 1, 0))  # -> Geometry, Transform
extr_15 = Extrude(Base=move_14.Geometry, Direction=Z_12)
sift_2 = SiftPattern(List=shift_2, SiftPattern=clean_6)  # -> Output0, Output1
subtraction_11 = Subtraction(A=subtraction_8, B=lab_bench_back_horizontal_bar_recess)
addition_6 = Addition(A=lab_bench_front_leg_recess, B=lab_bench_outer_horizontal_frame_thickne)
evalsrf_2 = EvaluateSurface(Surface=reparameterize(move_9.Geometry), Point="0.5,0.5")  # -> Point, Normal, UDirection, VDirection, Frame
addition_7 = Addition(A=addition_3, B=lab_bench_inner_horizontal_frame_thickne)
clean_7 = CleanTree(RemoveNulls=True, RemoveInvalid=True, RemoveEmpty=True, Tree=sift_2.Output1)
debrep = DeconstructBrep(Brep=extr_15)  # -> Faces, Edges, Vertices
ln_6 = Line(StartPoint=cull_11, EndPoint=rot3d.Geometry)
rad = Radians(Degrees=pegboard_hook_angle)
panel_20 = Panel(addition_7)
addition_8 = Addition(A=addition_7, B=lab_bench_front_horizontal_bar_recess)
cos = Cosine(Value=rad)
division_9 = Division(A=pegboard_hook_radius, B=cos)
pl = PlaneNormal(Origin=cull_11, ZAxis=evalsrf.Normal)
subtraction_12 = Subtraction(A=dim_2.UDimension, B=lab_bench_outer_horizontal_frame_thickne)
addition_9 = Addition(A=subtraction_11, B=lab_bench_inner_horizontal_frame_thickne)
panel_21 = Panel(addition_6)
Z_13 = UnitZ(Factor=cabinet_height_from_ground)
X_12 = UnitX(Factor=wall_cabinet_depth)
Y_5 = UnitY(Factor=wall_cabinet_width)
Z_14 = UnitZ(Factor=wall_cabinet_height)
panel_22 = Panel(subtraction_11)
dim_4 = Dimensions(Surface=move_14.Geometry)  # -> UDimension, VDimension
panel_23 = Panel(addition_8)
addition_10 = Addition(A=cabinet_vertical_handle_location_u_2_3_4, B=cabinet_handle_thickness)
incurve_2 = PointInCurve(Point=clean_7, Curve=graft(subsrf_2))  # -> Relationship, Point
panel_24 = Panel(subtraction_12)
panel_25 = Panel(addition_9)
subtraction_13 = Subtraction(A=subtraction_9, B=cabinet_vertical_handle_location_v_2_3_4)
move_15 = Move(Geometry=pt_7, Motion=Z_13)  # -> Geometry, Transform
X_13 = UnitX(Factor=pegboard_hook_length_2)
cull_17 = CullPattern(List=clean_7, CullPattern=incurve_2.Relationship)
subtraction_14 = Subtraction(A=dim_4.VDimension, B=cabinet_thickness)
subtraction_15 = Subtraction(A=dim_4.UDimension, B=cabinet_thickness)
circle = CircleCNR(Center=rot3d.Geometry, Normal=ln_6, Radius=pegboard_hook_radius)  # -> graft(Circle)
ellipse = Ellipse(Plane=pl, Radius1=pegboard_hook_radius, Radius2=division_9)  # -> graft(Ellipse), Focus1, Focus2
move_16 = Move(Geometry=move_15.Geometry, Motion=X_12)  # -> Geometry, Transform
subtraction_16 = Subtraction(A=subtraction_13, B=cabinet_handle_thickness)
division_10 = Division(A=0, B=dim_2.UDimension)
division_11 = Division(A=lab_bench_main_structure_thickness, B=dim_2.UDimension)
division_12 = Division(A=lab_bench_front_leg_recess, B=dim_2.VDimension)
division_13 = Division(A=addition_3, B=dim_2.VDimension)
division_14 = Division(A=subtraction_7, B=dim_2.UDimension)
division_15 = Division(A=dim_2.UDimension, B=dim_2.UDimension)
division_16 = Division(A=lab_bench_front_leg_recess, B=dim_2.VDimension)
division_17 = Division(A=addition_3, B=dim_2.VDimension)
division_18 = Division(A=0, B=dim_2.UDimension)
division_19 = Division(A=lab_bench_main_structure_thickness, B=dim_2.UDimension)
division_20 = Division(A=subtraction_6, B=dim_2.VDimension)
division_21 = Division(A=subtraction_3, B=dim_2.VDimension)
eval = EvaluateLength(Curve=ellipse.Ellipse, Length=0.25, Normalized=True)  # -> Point, Tangent, Parameter
eval_2 = EvaluateLength(Curve=ellipse.Ellipse, Length=0.75, Normalized=True)  # -> Point, Tangent, Parameter
division_22 = Division(A=subtraction_7, B=dim_2.UDimension)
division_23 = Division(A=dim_2.UDimension, B=dim_2.UDimension)
division_24 = Division(A=subtraction_6, B=dim_2.VDimension)
division_25 = Division(A=subtraction_3, B=dim_2.VDimension)
sph = Sphere(Base=circle, Radius=pegboard_hook_radius)
division_26 = Division(A=0, B=dim_2.UDimension)
division_27 = Division(A=lab_bench_outer_horizontal_frame_thickne, B=dim_2.UDimension)
division_28 = Division(A=addition_3, B=dim_2.VDimension)
division_29 = Division(A=subtraction_6, B=dim_2.VDimension)
division_30 = Division(A=subtraction_12, B=dim_2.UDimension)
division_31 = Division(A=dim_2.UDimension, B=dim_2.UDimension)
division_32 = Division(A=addition_3, B=dim_2.VDimension)
division_33 = Division(A=subtraction_6, B=dim_2.VDimension)
division_34 = Division(A=lab_bench_outer_horizontal_frame_thickne, B=dim_2.UDimension)
division_35 = Division(A=subtraction_12, B=dim_2.UDimension)
division_36 = Division(A=addition_4, B=dim_2.VDimension)
division_37 = Division(A=addition_8, B=dim_2.VDimension)
division_38 = Division(A=subtraction_12, B=dim_2.UDimension)
division_39 = Division(A=lab_bench_outer_horizontal_frame_thickne, B=dim_2.UDimension)
division_40 = Division(A=addition_9, B=dim_2.VDimension)
division_41 = Division(A=subtraction_11, B=dim_2.VDimension)
division_42 = Division(A=subtraction_7, B=dim_2.UDimension)
division_43 = Division(A=lab_bench_main_structure_thickness, B=dim_2.UDimension)
division_44 = Division(A=addition_6, B=dim_2.VDimension)
division_45 = Division(A=cabinet_thickness, B=dim_4.UDimension)
division_46 = Division(A=subtraction_15, B=dim_4.UDimension)
division_47 = Division(A=subtraction_14, B=dim_4.VDimension)
division_48 = Division(A=lab_bench_front_leg_recess, B=dim_2.VDimension)
neg_7 = Negative(Value=pegboard_hook_angle_2)
ln_7 = Line(StartPoint=move_16.Geometry, EndPoint=move_15.Geometry)
neg_8 = Negative(Value=pegboard_hook_joint_lower_horizontal_sca)
neg_9 = Negative(Value=pegboard_hook_joint_upper_horizontal_sca)
neg_10 = Negative(Value=pegboard_hook_joint_upper_vertical_scale_2)
dom²num_3 = ConstructDomain²(UMin=division_10, UMax=division_11, VMin=division_12, VMax=division_13)
neg_11 = Negative(Value=pegboard_hook_joint_upper_vertical_scale_2)
dom²num_4 = ConstructDomain²(UMin=division_14, UMax=division_15, VMin=division_16, VMax=division_17)
dom²num_5 = ConstructDomain²(UMin=division_18, UMax=division_19, VMin=division_20, VMax=division_21)
multiplication = Multiplication(A=cabinet_thickness, B=2)
move_17 = Move(Geometry=cull_17, Motion=X_13)  # -> Geometry, Transform
dom²num_6 = ConstructDomain²(UMin=division_22, UMax=division_23, VMin=division_24, VMax=division_25)
split = SplitBrep(Brep=sph, Cutter=circle)
loft = Loft(
    Curves=[ellipse.Ellipse, circle],
    Options={Adjust=True, Closed=False, LoftEnds=0, LoftSimp=0, LoftType=0, Rebuild=10, Refit=0.01})  # -> simplify(Loft)
dom²num_7 = ConstructDomain²(UMin=division_45, UMax=division_46, VMin=division_47, VMax=0)
item_6 = ListItem(List=debrep.Faces, Index=1, Wrap=True)
dom²num_8 = ConstructDomain²(UMin=division_26, UMax=division_27, VMin=division_28, VMax=division_29)
dom²num_9 = ConstructDomain²(UMin=division_30, UMax=division_31, VMin=division_32, VMax=division_33)
dom²num_10 = ConstructDomain²(UMin=division_34, UMax=division_35, VMin=division_36, VMax=division_37)
dom²num_11 = ConstructDomain²(UMin=division_38, UMax=division_39, VMin=division_40, VMax=division_41)
dom²num_12 = ConstructDomain²(UMin=division_42, UMax=division_43, VMin=division_44, VMax=division_48)
Z_15 = UnitZ(Factor=pegboard_hook_joint_upper_vertical_scale)
Y_6 = UnitY(Factor=pegboard_hook_joint_upper_horizontal_sca)
Z_16 = UnitZ(Factor=pegboard_hook_joint_upper_vertical_scale)
Y_7 = UnitY(Factor=neg_9)
Z_17 = UnitZ(Factor=neg_11)
Y_8 = UnitY(Factor=pegboard_hook_joint_lower_horizontal_sca)
Z_18 = UnitZ(Factor=neg_10)
Y_9 = UnitY(Factor=neg_8)
extr_16 = Extrude(Base=ln_7, Direction=Y_5)
multiplication_2 = Multiplication(A=wall_cabinet_thickness, B=2)
dim_5 = Dimensions(Surface=extr_16)  # -> UDimension, VDimension
item_7 = ListItem(List=split, Index=0, Wrap=True)  # -> simplify(Item)
subsrf_3 = Isotrim(Surface=reparameterize(extr_2), Domain=dom²num_4)
subsrf_4 = Isotrim(Surface=reparameterize(extr_2), Domain=dom²num_3)
subsrf_5 = Isotrim(Surface=reparameterize(extr_2), Domain=dom²num_5)
subtraction_17 = Subtraction(A=cabinet_height, B=multiplication)
subsrf_6 = Isotrim(Surface=reparameterize(extr_2), Domain=dom²num_6)
subsrf_7 = Isotrim(Surface=reparameterize(extr_2), Domain=dom²num_8)
subsrf_8 = Isotrim(Surface=reparameterize(extr_2), Domain=dom²num_9)
subsrf_9 = Isotrim(Surface=reparameterize(extr_2), Domain=dom²num_10)
subsrf_10 = Isotrim(Surface=reparameterize(extr_2), Domain=dom²num_11)
subsrf_11 = Isotrim(Surface=reparameterize(extr_2), Domain=dom²num_12)
addition_11 = Addition(A=Z_18, B=Y_9)
merge_6 = Merge(Data1=extr_6, Data2=extr_7)
addition_12 = Addition(A=Z_17, B=Y_8)
extr_17 = Extrude(Base=extr, Direction=X)
addition_13 = Addition(A=Z_15, B=Y_6)
addition_14 = Addition(A=Z_16, B=Y_7)
rot3d_2 = Rotate3D(Geometry=move_17.Geometry, Angle=degrees(neg_7), Center=cull_17, Axis=Vector(0, 1, 0))  # -> Geometry, Transform
subsrf_12 = Isotrim(Surface=reparameterize(move_14.Geometry), Domain=dom²num_7)
Z_19 = UnitZ(Factor=cabinet_thickness)
Z_20 = UnitZ(Factor=subtraction_17)
join = BrepJoin(Breps=[item_7, loft])  # -> Breps, Closed
subtraction_18 = Subtraction(A=dim_5.UDimension, B=wall_cabinet_thickness)
subtraction_19 = Subtraction(A=dim_5.VDimension, B=wall_cabinet_thickness)
subtraction_20 = Subtraction(A=wall_cabinet_height, B=multiplication_2)
move_18 = Move(Geometry=eval.Point, Motion=addition_13)  # -> graft(Geometry), Transform
move_19 = Move(Geometry=eval.Point, Motion=addition_14)  # -> graft(Geometry), Transform
move_20 = Move(Geometry=eval_2.Point, Motion=addition_12)  # -> graft(Geometry), Transform
move_21 = Move(Geometry=eval_2.Point, Motion=addition_11)  # -> graft(Geometry), Transform
cap = CapHoles(Brep=join.Breps)
ln_8 = Line(StartPoint=cull_17, EndPoint=rot3d_2.Geometry)
rad_2 = Radians(Degrees=pegboard_hook_angle_2)
move_22 = Move(Geometry=subsrf_12, Motion=Z_19)  # -> Geometry, Transform
division_49 = Division(A=wall_cabinet_thickness, B=dim_5.UDimension)
division_50 = Division(A=subtraction_18, B=dim_5.UDimension)
division_51 = Division(A=0, B=dim_5.VDimension)
division_52 = Division(A=subtraction_19, B=dim_5.VDimension)
cos_2 = Cosine(Value=rad_2)
intcrv = Interpolate(Vertices=[move_18.Geometry, move_20.Geometry, move_21.Geometry, move_19.Geometry], Degree=3, Periodic=True, KnotStyle=1)  # -> Curve, Length, Domain
X_14 = UnitX(Factor=pegboard_hook_joint_thickness)
extr_18 = Extrude(Base=move_22.Geometry, Direction=Z_20)
dom²num_13 = ConstructDomain²(UMin=division_49, UMax=division_50, VMin=division_51, VMax=division_52)
dim_6 = Dimensions(Surface=item_6)  # -> UDimension, VDimension
move_23 = Move(Geometry=cap, Motion=X_14)  # -> Geometry, Transform
srf = Surface(intcrv.Curve)
division_53 = Division(A=pegboard_hook_radius_2, B=cos_2)
pl_2 = PlaneNormal(Origin=cull_17, ZAxis=evalsrf_2.Normal)
Z_21 = UnitZ(Factor=wall_cabinet_thickness)
merge_7 = Merge(Data1=subsrf_7, Data2=subsrf_8, Data3=subsrf_9, Data4=subsrf_10, Data5=subsrf_11)
extr_19 = Extrude(Base=srf, Direction=X_14)  # -> simplify(Extrusion)
subsrf_13 = Isotrim(Surface=reparameterize(extr_16), Domain=dom²num_13)
Z_22 = UnitZ(Factor=subtraction_20)
sdiff = SolidDifference(BrepsA=extr_15, BrepsB=extr_18)
multiplication_3 = Multiplication(A=dim_6.VDimension, B=clean_5)
mesh = Mesh(flatten(extr_17))
mesh_2 = Mesh(flatten(merge_6))
mesh_3 = Mesh(flatten(move_23.Geometry))
subtraction_21 = Subtraction(A=subtraction_16, B=cabinet_handle_lenght)
move_24 = Move(Geometry=subsrf_13, Motion=Z_21)  # -> Geometry, Transform
mjoin = MeshJoin(Meshes=mesh)
mjoin_2 = MeshJoin(Meshes=mesh_2)
mjoin_3 = MeshJoin(Meshes=mesh_3)
subtraction_22 = Subtraction(A=dim_2.UDimension, B=lab_bench_main_structure_thickness)
circle_2 = CircleCNR(Center=rot3d_2.Geometry, Normal=ln_8, Radius=pegboard_hook_radius_2)  # -> graft(Circle)
ellipse_2 = Ellipse(Plane=pl_2, Radius1=pegboard_hook_radius_2, Radius2=division_53)  # -> graft(Ellipse), Focus1, Focus2
filedge = FilletEdge(Shape=extr_19, Blend=0, Metric=0, Edges="1", Radii=pegboard_hook_joint_fillet)
extr_20 = Extrude(Base=extr_16, Direction=Z_14)
extr_21 = Extrude(Base=move_24.Geometry, Direction=Z_22)
mesh_4 = Mesh(flatten(filedge))
subtraction_23 = Subtraction(A=dim_2.UDimension, B=lab_bench_main_structure_thickness)
addition_15 = Addition(A=cabinet_wheel_offset, B=cabinet_wheel_joint_width)
item_8 = ListItem(List=debrep.Faces, Index=0, Wrap=True)
swatch = ColourSwatch(SwatchColor=RGB(74, 74, 74))
swatch_2 = ColourSwatch(SwatchColor=RGB(140, 105, 105))
swatch_3 = ColourSwatch(SwatchColor=RGB(224, 192, 103))
swatch_4 = ColourSwatch(SwatchColor=RGB(158, 156, 152))
eval_3 = EvaluateLength(Curve=ellipse_2.Ellipse, Length=0.25, Normalized=True)  # -> Point, Tangent, Parameter
eval_4 = EvaluateLength(Curve=ellipse_2.Ellipse, Length=0.75, Normalized=True)  # -> Point, Tangent, Parameter
sph_2 = Sphere(Base=circle_2, Radius=pegboard_hook_radius_2)
mjoin_4 = MeshJoin(Meshes=mesh_4)
division_54 = Division(A=subtraction_22, B=lab_bench_shelf_horizontal_division_numb)
ma = MassAddition(Input=drawer_heights_for_type_1)  # -> Result, PartialResults
num = Number(cabinet_height)
neg_12 = Negative(Value=pegboard_hook_joint_lower_horizontal_sca_2)
neg_13 = Negative(Value=pegboard_hook_joint_upper_horizontal_sca_2)
neg_14 = Negative(Value=pegboard_hook_joint_upper_vertical_scale_4)
neg_15 = Negative(Value=pegboard_hook_joint_upper_vertical_scale_4)
merge_8 = Merge(Data1=subsrf_4, Data2=subsrf_5, Data3=subsrf_3, Data4=subsrf_6)
split_2 = SplitBrep(Brep=sph_2, Cutter=circle_2)
loft_2 = Loft(
    Curves=[ellipse_2.Ellipse, circle_2],
    Options={Adjust=True, Closed=False, LoftEnds=0, LoftSimp=0, LoftType=0, Rebuild=10, Refit=0.01})  # -> simplify(Loft)
division_55 = Division(A=subtraction_23, B=lab_bench_shelf_horizontal_division_numb)
debrep_2 = DeconstructBrep(Brep=extr_20)  # -> Faces, Edges, Vertices
sdiff_2 = SolidDifference(BrepsA=extr_20, BrepsB=extr_21)
Z_23 = UnitZ(Factor=pegboard_hook_joint_upper_vertical_scale_3)
Y_10 = UnitY(Factor=pegboard_hook_joint_upper_horizontal_sca_2)
Z_24 = UnitZ(Factor=pegboard_hook_joint_upper_vertical_scale_3)
Y_11 = UnitY(Factor=neg_13)
Z_25 = UnitZ(Factor=neg_15)
Y_12 = UnitY(Factor=pegboard_hook_joint_lower_horizontal_sca_2)
Z_26 = UnitZ(Factor=neg_14)
Y_13 = UnitY(Factor=neg_12)
merge_9 = Merge(Data1=mjoin_3, Data3=mjoin_2, Data4=mjoin, Data5=mjoin_4)
item_9 = ListItem(List=division_54, Index=0, Wrap=True)
item_10 = ListItem(List=split_2, Index=0, Wrap=True)  # -> simplify(Item)
subtraction_24 = Subtraction(A=lab_bench_shelf_horizontal_division_numb, B=1)
addition_16 = Addition(A=Z_26, B=Y_13)
preview = CustomPreview(Geometry=filedge, Material=swatch_4)
preview_2 = CustomPreview(Geometry=move_23.Geometry, Material=swatch)
preview_3 = CustomPreview(Geometry=merge_6, Material=swatch_2)
preview_4 = CustomPreview(Geometry=extr_17, Material=swatch_3)
item_11 = ListItem(List=division_55, Index=0, Wrap=True)
merge_10 = Merge(Data1=swatch, Data2=swatch_2, Data3=swatch_3, Data4=swatch_4)
addition_17 = Addition(A=multiplication_3, B=addition_10)
merge_11 = Merge(Data1=extr_12, Data2=extr_13)
addition_18 = Addition(A=Z_25, B=Y_12)
extr_22 = Extrude(Base=extr_3, Direction=X_5)
addition_19 = Addition(A=Z_23, B=Y_10)
addition_20 = Addition(A=Z_24, B=Y_11)
subtraction_25 = Subtraction(A=multiplication_3, B=addition_10)
subtraction_26 = Subtraction(A=dim_2.UDimension, B=lab_bench_main_structure_thickness)
item_12 = ListItem(List=debrep_2.Faces, Index=1, Wrap=True)
join_2 = BrepJoin(Breps=[item_10, loft_2])  # -> Breps, Closed
subtraction_27 = Subtraction(A=addition_17, B=cabinet_handle_thickness)
division_56 = Division(A=cabinet_base_height, B=4)
subtraction_28 = Subtraction(A=dim_2.UDimension, B=lab_bench_main_structure_thickness)
series_2 = Series(Start=item_9, Step=item_9, Count=subtraction_24)  # -> graft(Series)
addition_21 = Addition(A=subtraction_25, B=cabinet_handle_thickness)
dim_7 = Dimensions(Surface=item_8)  # -> UDimension, VDimension
dim_8 = Dimensions(Surface=item_8)  # -> UDimension, VDimension
dim_9 = Dimensions(Surface=item_8)  # -> UDimension, VDimension
dim_10 = Dimensions(Surface=item_8)  # -> UDimension, VDimension
move_25 = Move(Geometry=eval_3.Point, Motion=addition_19)  # -> graft(Geometry), Transform
move_26 = Move(Geometry=eval_3.Point, Motion=addition_20)  # -> graft(Geometry), Transform
move_27 = Move(Geometry=eval_4.Point, Motion=addition_18)  # -> graft(Geometry), Transform
move_28 = Move(Geometry=eval_4.Point, Motion=addition_16)  # -> graft(Geometry), Transform
cap_2 = CapHoles(Brep=join_2.Breps)
multiplication_4 = Multiplication(A=division_56, B=2.75)
series_3 = Series(Start=lab_bench_main_structure_thickness, Step=item_11, Count=lab_bench_shelf_horizontal_division_numb)  # -> graft(Series)
series_4 = Series(Start=item_11, Step=item_11, Count=lab_bench_shelf_horizontal_division_numb)  # -> graft(Series)
subtraction_29 = Subtraction(A=lab_bench_height, B=lab_bench_counter_thickness)
yz = YZPlane(Origin=Point(0, 0, 0))
addition_22 = Addition(A=series_2, B=lab_bench_main_structure_thickness)
division_57 = Division(A=subtraction_26, B=lab_bench_shelf_horizontal_division_numb)
dim_11 = Dimensions(Surface=subsrf_4)  # -> UDimension, VDimension
area = Area(Geometry=subsrf_4)  # -> Area, Centroid
dim_12 = Dimensions(Surface=subsrf_5)  # -> UDimension, VDimension
area_2 = Area(Geometry=subsrf_3)  # -> Area, Centroid
num_2 = Number(multiplication_4)
dim_13 = Dimensions(Surface=subsrf_3)  # -> UDimension, VDimension
area_3 = Area(Geometry=subsrf_5)  # -> Area, Centroid
dim_14 = Dimensions(Surface=subsrf_6)  # -> UDimension, VDimension
area_4 = Area(Geometry=subsrf_6)  # -> Area, Centroid
division_58 = Division(A=subtraction_28, B=lab_bench_shelf_horizontal_division_numb)
intcrv_2 = Interpolate(Vertices=[move_25.Geometry, move_27.Geometry, move_28.Geometry, move_26.Geometry], Degree=3, Periodic=True, KnotStyle=1)  # -> Curve, Length, Domain
dom²num_14 = ConstructDomain²(UMin=0, UMax=1, VMin=0, VMax=wall_cabinet_middle_vertical_line)
dom²num_15 = ConstructDomain²(UMin=0, UMax=1, VMin=wall_cabinet_middle_vertical_line, VMax=1)
X_15 = UnitX(Factor=pegboard_hook_joint_thickness_2)
merge_12 = Merge(Data1=0, Data2=ma.PartialResults)
move_29 = Move(Geometry=cap_2, Motion=X_15)  # -> Geometry, Transform
item_13 = ListItem(List=division_57, Index=0, Wrap=True)
srf_2 = Surface(intcrv_2.Curve)
division_59 = Division(A=series_2, B=dim_2.UDimension)
division_60 = Division(A=addition_22, B=dim_2.UDimension)
division_61 = Division(A=subtraction_3, B=dim_2.VDimension)
division_62 = Division(A=subtraction_6, B=dim_2.VDimension)
division_63 = Division(A=series_3, B=dim_2.UDimension)
division_64 = Division(A=series_4, B=dim_2.UDimension)
division_65 = Division(A=subtraction_3, B=dim_2.VDimension)
division_66 = Division(A=subtraction_6, B=dim_2.VDimension)
merge_13 = Merge(Data1=ma.PartialResults, Data2=num)
item_14 = ListItem(List=division_58, Index=0, Wrap=True)
division_67 = Division(A=lab_bench_leg_extension_thickness, B=dim_11.UDimension)
division_68 = Division(A=lab_bench_leg_extension_thickness, B=dim_12.UDimension)
division_69 = Division(A=lab_bench_leg_extension_thickness, B=dim_13.UDimension)
sort = SortList(Keys=merge_12, ValuesA=merge_12)  # -> Keys, ValuesA
dim_15 = Dimensions(Surface=item_6)  # -> UDimension, VDimension
dom²num_16 = ConstructDomain²(UMin=division_59, UMax=division_60, VMin=division_61, VMax=division_62)
division_70 = Division(A=lab_bench_leg_extension_thickness, B=dim_14.UDimension)
extr_23 = Extrude(Base=srf_2, Direction=X_15)  # -> simplify(Extrusion)
sort_2 = SortList(Keys=merge_13, ValuesA=merge_13)  # -> Keys, ValuesA
dom²num_17 = ConstructDomain²(UMin=division_63, UMax=division_64, VMin=division_65, VMax=division_66)
subtraction_30 = Subtraction(A=dim_8.UDimension, B=cabinet_wheel_offset)
subtraction_31 = Subtraction(A=dim_8.UDimension, B=addition_15)
subtraction_32 = Subtraction(A=dim_8.VDimension, B=cabinet_wheel_offset)
subtraction_33 = Subtraction(A=num, B=sort.ValuesA)
dim_16 = Dimensions(Surface=item_6)  # -> UDimension, VDimension
dim_17 = Dimensions(Surface=item_6)  # -> UDimension, VDimension
dim_18 = Dimensions(Surface=item_6)  # -> UDimension, VDimension
dim_19 = Dimensions(Surface=item_6)  # -> UDimension, VDimension
dim_20 = Dimensions(Surface=item_6)  # -> UDimension, VDimension
dim_21 = Dimensions(Surface=item_6)  # -> UDimension, VDimension
dim_22 = Dimensions(Surface=item_6)  # -> UDimension, VDimension
dim_23 = Dimensions(Surface=item_6)  # -> UDimension, VDimension
dim_24 = Dimensions(Surface=item_6)  # -> UDimension, VDimension
dim_25 = Dimensions(Surface=item_6)  # -> UDimension, VDimension
dim_26 = Dimensions(Surface=item_6)  # -> UDimension, VDimension
subtraction_34 = Subtraction(A=num, B=sort_2.ValuesA)
scale = Scale(Geometry=subsrf_5, Center=area_3.Centroid, Factor=division_68)  # -> Geometry, Transform
scale_2 = Scale(Geometry=subsrf_4, Center=area.Centroid, Factor=division_67)  # -> Geometry, Transform
scale_3 = Scale(Geometry=subsrf_3, Center=area_2.Centroid, Factor=division_69)  # -> Geometry, Transform
subsrf_14 = Isotrim(Surface=reparameterize(item_12), Domain=dom²num_14)
subsrf_15 = Isotrim(Surface=reparameterize(item_12), Domain=dom²num_15)
addition_23 = Addition(A=lab_bench_height, B=lab_bench_shelf_lower_bar_height)
subtraction_35 = Subtraction(A=lab_bench_shelf_vertical_structure_heigh, B=lab_bench_counter_thickness)
addition_24 = Addition(A=lab_bench_shelf_lower_bar_height_from_co, B=lab_bench_shelf_lower_bar_height)
division_71 = Division(A=lab_bench_main_structure_thickness, B=dim_2.UDimension)
division_72 = Division(A=subtraction_7, B=dim_2.UDimension)
division_73 = Division(A=subtraction_6, B=dim_2.VDimension)
division_74 = Division(A=subtraction_3, B=dim_2.VDimension)
series_5 = Series(Start=lab_bench_main_structure_thickness, Step=item_13, Count=lab_bench_shelf_horizontal_division_numb)  # -> graft(Series)
series_6 = Series(Start=item_13, Step=item_13, Count=lab_bench_shelf_horizontal_division_numb)  # -> graft(Series)
subtraction_36 = Subtraction(A=lab_bench_width, B=lab_bench_top_shelf_depth)
scale_4 = Scale(Geometry=subsrf_6, Center=area_4.Centroid, Factor=division_70)  # -> Geometry, Transform
addition_25 = Addition(A=lab_bench_shelf_vertical_structure_heigh, B=subtraction_29)
subtraction_37 = Subtraction(A=lab_bench_width, B=lab_bench_shelf_depth)
series_7 = Series(Start=lab_bench_main_structure_thickness, Step=item_14, Count=lab_bench_shelf_horizontal_division_numb)  # -> graft(Series)
series_8 = Series(Start=item_14, Step=item_14, Count=lab_bench_shelf_horizontal_division_numb)  # -> graft(Series)
larger = LargerThan(FirstNumber=subtraction_34, SecondNumber=0)  # -> LargerThan, OrEqualTo
larger_2 = LargerThan(FirstNumber=subtraction_33, SecondNumber=0)  # -> LargerThan, OrEqualTo
addition_26 = Addition(A=cabinet_wheel_offset, B=cabinet_wheel_joint_lenght)
subtraction_38 = Subtraction(A=subtraction_32, B=cabinet_wheel_joint_lenght)
subsrf_16 = Isotrim(Surface=reparameterize(extr_2), Domain=dom²num_17)
dom²num_18 = ConstructDomain²(UMin=division_71, UMax=division_72, VMin=division_73, VMax=division_74)
filedge_2 = FilletEdge(Shape=extr_23, Blend=0, Metric=0, Edges="1", Radii=pegboard_hook_joint_fillet_2)
num_3 = Number(cabinet_handle_lenght)
num_4 = Number(cabinet_handle_lenght)
cull_18 = CullPattern(List=subtraction_34, CullPattern=larger.OrEqualTo)
subtraction_39 = Subtraction(A=addition_25, B=lab_bench_shelf_thickness)
cull_19 = CullPattern(List=subtraction_33, CullPattern=larger_2.OrEqualTo)
division_75 = Division(A=series_5, B=dim_2.UDimension)
division_76 = Division(A=series_6, B=dim_2.UDimension)
division_77 = Division(A=subtraction_36, B=dim_2.VDimension)
division_78 = Division(A=lab_bench_width, B=dim_2.VDimension)
dim_27 = Dimensions(Surface=subsrf_15)  # -> UDimension, VDimension
dim_28 = Dimensions(Surface=subsrf_14)  # -> UDimension, VDimension
Z_27 = UnitZ(Factor=addition_23)
subsrf_17 = Isotrim(Surface=reparameterize(extr_2), Domain=dom²num_18)
division_79 = Division(A=series_7, B=dim_2.UDimension)
division_80 = Division(A=series_8, B=dim_2.UDimension)
division_81 = Division(A=subtraction_37, B=dim_2.VDimension)
division_82 = Division(A=lab_bench_width, B=dim_2.VDimension)
Z_28 = UnitZ(Factor=subtraction_39)
Z_29 = UnitZ(Factor=lab_bench_height)
subtraction_40 = Subtraction(A=lab_bench_height, B=lab_bench_counter_thickness)
subtraction_41 = Subtraction(A=lab_bench_shelf_vertical_division_number, B=1)
dom²num_19 = ConstructDomain²(UMin=division_75, UMax=division_76, VMin=division_77, VMax=division_78)
subtraction_42 = Subtraction(A=subtraction_13, B=num_3)
subtraction_43 = Subtraction(A=subtraction_16, B=num_3)
subtraction_44 = Subtraction(A=subtraction_16, B=num_4)
subtraction_45 = Subtraction(A=subtraction_13, B=num_4)
merge_14 = Merge(Data1=subsrf_5, Data2=subsrf_6)
subsrf_18 = Isotrim(Surface=reparameterize(extr_2), Domain=dom²num_16)
subtraction_46 = Subtraction(A=subtraction_35, B=addition_24)
division_83 = Division(A=subtraction_46, B=lab_bench_shelf_vertical_division_number)
dom²num_20 = ConstructDomain²(UMin=division_79, UMax=division_80, VMin=division_81, VMax=division_82)
merge_15 = Merge(Data1=scale_2.Geometry, Data2=scale.Geometry, Data3=scale_3.Geometry, Data4=scale_4.Geometry)
Z_30 = UnitZ(Factor=lab_bench_shelf_lower_bar_height_from_co)
Z_31 = UnitZ(Factor=lab_bench_shelf_lower_bar_height)
Z_32 = UnitZ(Factor=subtraction_40)
move_30 = Move(Geometry=subsrf_17, Motion=Z_29)  # -> Geometry, Transform
series_9 = Series(Start=division_83, Step=division_83, Count=subtraction_41)
move_31 = Move(Geometry=subsrf_16, Motion=Z_28)  # -> Geometry, Transform
neg_16 = Negative(Value=lab_bench_main_structure_thickness)
division_84 = Division(A=cull_18, B=dim_15.UDimension)
division_85 = Division(A=cull_19, B=dim_15.UDimension)
division_86 = Division(A=0, B=dim_15.VDimension)
division_87 = Division(A=dim_15.VDimension, B=dim_15.VDimension)
division_88 = Division(A=0, B=dim_16.UDimension)
division_89 = Division(A=subtraction_9, B=dim_16.UDimension)
division_90 = Division(A=0, B=dim_16.VDimension)
division_91 = Division(A=0, B=dim_17.UDimension)
division_92 = Division(A=subtraction_9, B=dim_17.UDimension)
division_93 = Division(A=dim_17.VDimension, B=dim_17.VDimension)
division_94 = Division(A=subtraction_9, B=dim_18.UDimension)
division_95 = Division(A=dim_18.UDimension, B=dim_18.UDimension)
division_96 = Division(A=0, B=dim_18.VDimension)
division_97 = Division(A=dim_18.VDimension, B=dim_18.VDimension)
division_98 = Division(A=subtraction_9, B=dim_19.UDimension)
division_99 = Division(A=dim_19.UDimension, B=dim_19.UDimension)
division_100 = Division(A=0, B=dim_19.VDimension)
division_101 = Division(A=dim_19.VDimension, B=dim_19.VDimension)
division_102 = Division(A=subtraction_9, B=dim_20.UDimension)
division_103 = Division(A=dim_20.UDimension, B=dim_20.UDimension)
division_104 = Division(A=dim_20.VDimension, B=dim_20.VDimension)
division_105 = Division(A=subtraction_13, B=dim_21.UDimension)
division_106 = Division(A=subtraction_16, B=dim_21.UDimension)
division_107 = Division(A=subtraction_25, B=dim_21.VDimension)
division_108 = Division(A=addition_21, B=dim_21.VDimension)
division_109 = Division(A=subtraction_42, B=dim_22.UDimension)
division_110 = Division(A=subtraction_43, B=dim_22.UDimension)
division_111 = Division(A=subtraction_25, B=dim_22.VDimension)
division_112 = Division(A=addition_21, B=dim_22.VDimension)
division_113 = Division(A=subtraction_13, B=dim_23.UDimension)
division_114 = Division(A=subtraction_21, B=dim_23.UDimension)
division_115 = Division(A=subtraction_25, B=dim_23.VDimension)
division_116 = Division(A=addition_21, B=dim_23.VDimension)
division_117 = Division(A=subtraction_16, B=dim_24.UDimension)
division_118 = Division(A=subtraction_13, B=dim_24.UDimension)
division_119 = Division(A=subtraction_27, B=dim_24.VDimension)
division_120 = Division(A=addition_17, B=dim_24.VDimension)
division_121 = Division(A=subtraction_44, B=dim_25.UDimension)
division_122 = Division(A=subtraction_45, B=dim_25.UDimension)
division_123 = Division(A=subtraction_27, B=dim_25.VDimension)
division_124 = Division(A=addition_17, B=dim_25.VDimension)
division_125 = Division(A=subtraction_13, B=dim_26.UDimension)
division_126 = Division(A=subtraction_21, B=dim_26.UDimension)
division_127 = Division(A=subtraction_27, B=dim_26.VDimension)
division_128 = Division(A=addition_17, B=dim_26.VDimension)
division_129 = Division(A=cabinet_wheel_offset, B=dim_7.UDimension)
division_130 = Division(A=addition_15, B=dim_7.UDimension)
division_131 = Division(A=addition_26, B=dim_7.VDimension)
division_132 = Division(A=cabinet_wheel_offset, B=dim_7.VDimension)
division_133 = Division(A=subtraction_30, B=dim_8.UDimension)
division_134 = Division(A=subtraction_31, B=dim_8.UDimension)
division_135 = Division(A=subtraction_32, B=dim_8.VDimension)
division_136 = Division(A=subtraction_38, B=dim_8.VDimension)
division_137 = Division(A=subtraction_31, B=dim_9.UDimension)
division_138 = Division(A=subtraction_30, B=dim_9.UDimension)
division_139 = Division(A=cabinet_wheel_offset, B=dim_9.VDimension)
division_140 = Division(A=addition_26, B=dim_9.VDimension)
division_141 = Division(A=cabinet_wheel_offset, B=dim_10.UDimension)
division_142 = Division(A=addition_15, B=dim_10.UDimension)
division_143 = Division(A=subtraction_32, B=dim_10.VDimension)
division_144 = Division(A=subtraction_38, B=dim_10.VDimension)
division_145 = Division(A=cabinet_wheel_joint_lenght, B=2)
move_32 = Move(Geometry=subsrf_18, Motion=Z_27)  # -> Geometry, Transform
subsrf_19 = Isotrim(Surface=reparameterize(extr_2), Domain=dom²num_19)
move_33 = Move(Geometry=move_30.Geometry, Motion=Z_30)  # -> Geometry, Transform
subtraction_47 = Subtraction(A=dim_28.VDimension, B=wall_cabinet_panel_offset_1)
subtraction_48 = Subtraction(A=dim_27.VDimension, B=wall_cabinet_panel_offset_1)
Z_33 = UnitZ(Factor=lab_bench_shelf_lower_bar_height_from_co)
subtraction_49 = Subtraction(A=dim_28.UDimension, B=wall_cabinet_panel_offset_1)
subtraction_50 = Subtraction(A=dim_27.UDimension, B=wall_cabinet_panel_offset_1)
preview_5 = CustomPreview(Geometry=filedge_2, Material=ColourSwatch(SwatchColor=RGB(158, 156, 152)))
preview_6 = CustomPreview(Geometry=move_29.Geometry, Material=ColourSwatch(SwatchColor=RGB(74, 74, 74)))
preview_7 = CustomPreview(Geometry=merge_11, Material=ColourSwatch(SwatchColor=RGB(140, 105, 105)))
preview_8 = CustomPreview(Geometry=extr_22, Material=ColourSwatch(SwatchColor=RGB(224, 192, 103)))
Z_34 = UnitZ(Factor=lab_bench_shelf_vertical_structure_heigh)
move_34 = Move(Geometry=merge_14, Motion=Z_32)  # -> Geometry, Transform
subsrf_20 = Isotrim(Surface=reparameterize(extr_2), Domain=dom²num_20)
addition_27 = Addition(A=addition_23, B=lab_bench_shelf_lower_bar_height_from_co)
dom²num_21 = ConstructDomain²(UMin=division_84, UMax=division_85, VMin=division_86, VMax=division_87)
dom²num_22 = ConstructDomain²(UMin=division_88, UMax=division_89, VMin=division_90, VMax=clean_5)
dom²num_23 = ConstructDomain²(UMin=division_91, UMax=division_92, VMin=clean_5, VMax=division_93)
dom²num_24 = ConstructDomain²(UMin=division_94, UMax=division_95, VMin=division_96, VMax=division_97)
dom²num_25 = ConstructDomain²(UMin=division_98, UMax=division_99, VMin=division_100, VMax=clean_5)
dom²num_26 = ConstructDomain²(UMin=division_102, UMax=division_103, VMin=clean_5, VMax=division_104)
dom²num_27 = ConstructDomain²(UMin=division_109, UMax=division_110, VMin=division_111, VMax=division_112)
dom²num_28 = ConstructDomain²(UMin=division_113, UMax=division_114, VMin=division_115, VMax=division_116)
dom²num_29 = ConstructDomain²(UMin=division_117, UMax=division_118, VMin=division_119, VMax=division_120)
dom²num_30 = ConstructDomain²(UMin=division_121, UMax=division_122, VMin=division_123, VMax=division_124)
dom²num_31 = ConstructDomain²(UMin=division_125, UMax=division_126, VMin=division_127, VMax=division_128)
Z_35 = UnitZ(Factor=neg_16)
dom²num_32 = ConstructDomain²(UMin=division_105, UMax=division_106, VMin=division_107, VMax=division_108)
dom²num_33 = ConstructDomain²(UMin=division_129, UMax=division_130, VMin=division_131, VMax=division_132)
dom²num_34 = ConstructDomain²(UMin=division_133, UMax=division_134, VMin=division_135, VMax=division_136)
dom²num_35 = ConstructDomain²(UMin=division_137, UMax=division_138, VMin=division_139, VMax=division_140)
dom²num_36 = ConstructDomain²(UMin=division_141, UMax=division_142, VMin=division_143, VMax=division_144)
division_146 = Division(A=wall_cabinet_panel_offset_1, B=dim_28.UDimension)
division_147 = Division(A=subtraction_49, B=dim_28.UDimension)
division_148 = Division(A=wall_cabinet_panel_offset_1, B=dim_28.VDimension)
division_149 = Division(A=subtraction_47, B=dim_28.VDimension)
division_150 = Division(A=wall_cabinet_panel_offset_1, B=dim_27.UDimension)
division_151 = Division(A=subtraction_50, B=dim_27.UDimension)
division_152 = Division(A=wall_cabinet_panel_offset_1, B=dim_27.VDimension)
division_153 = Division(A=subtraction_48, B=dim_27.VDimension)
move_35 = Move(Geometry=move_32.Geometry, Motion=Z_33)  # -> Geometry, Transform
division_154 = Division(A=num_2, B=division_145)
Z_36 = UnitZ(Factor=subtraction_46)
subsrf_21 = Isotrim(Surface=reparameterize(item_6), Domain=dom²num_21)
sqr = Square(Value=division_154)
subtraction_51 = Subtraction(A=cabinet_base_height, B=cabinet_wheel_joint_height)
subsrf_22 = Isotrim(Surface=reparameterize(item_6), Domain=dom²num_22)
subsrf_23 = Isotrim(Surface=reparameterize(item_6), Domain=dom²num_23)
subsrf_24 = Isotrim(Surface=reparameterize(item_6), Domain=dom²num_24)
subsrf_25 = Isotrim(Surface=reparameterize(item_6), Domain=dom²num_25)
subsrf_26 = Isotrim(Surface=reparameterize(item_6), Domain=dom²num_26)
subsrf_27 = Isotrim(Surface=reparameterize(item_6), Domain=dom²num_32)
subsrf_28 = Isotrim(Surface=reparameterize(item_6), Domain=dom²num_27)
subsrf_29 = Isotrim(Surface=reparameterize(item_6), Domain=dom²num_29)
subsrf_30 = Isotrim(Surface=reparameterize(item_6), Domain=dom²num_30)
subsrf_31 = Isotrim(Surface=reparameterize(item_6), Domain=dom²num_31)
subsrf_32 = Isotrim(Surface=reparameterize(item_8), Domain=dom²num_33)
subsrf_33 = Isotrim(Surface=reparameterize(item_8), Domain=dom²num_34)
subsrf_34 = Isotrim(Surface=reparameterize(item_8), Domain=dom²num_35)
subsrf_35 = Isotrim(Surface=reparameterize(item_8), Domain=dom²num_36)
dom²num_37 = ConstructDomain²(UMin=division_146, UMax=division_147, VMin=division_148, VMax=division_149)
dom²num_38 = ConstructDomain²(UMin=division_150, UMax=division_151, VMin=division_152, VMax=division_153)
addition_28 = Addition(A=sqr, B=1)
subtraction_52 = Subtraction(A=subtraction_51, B=num_2)
addition_29 = Addition(A=series_9, B=addition_27)
extr_24 = Extrude(Base=move_31.Geometry, Direction=Z_35)
sqrt = SquareRoot(Value=addition_28)
extr_25 = Extrude(Base=move_35.Geometry, Direction=Z_36)
Z_37 = UnitZ(Factor=addition_29)
Z_38 = UnitZ(Factor=addition_27)
extr_26 = Extrude(Base=move_33.Geometry, Direction=Z_31)
extr_27 = Extrude(Base=move_34.Geometry, Direction=Z_34)
cull_20 = CullPattern(List=subsrf_25, CullPattern=invert(item))
cull_21 = CullPattern(List=subsrf_26, CullPattern=invert(item))
multiplication_5 = Multiplication(A=sqrt, B=cabinet_wheel_joint_fillet_radius)
cull_22 = CullPattern(List=subsrf_24, CullPattern=item)
subsrf_36 = Isotrim(Surface=reparameterize(subsrf_14), Domain=dom²num_37)
subsrf_37 = Isotrim(Surface=reparameterize(subsrf_15), Domain=dom²num_38)
move_36 = Move(Geometry=graft(subsrf_20), Motion=Z_37)  # -> Geometry, Transform
division_155 = Division(A=lab_bench_shelf_thickness, B=2)
move_37 = Move(Geometry=subsrf_20, Motion=Z_38)  # -> Geometry, Transform
addition_30 = Addition(A=multiplication_5, B=subtraction_52)
subsrf_38 = Isotrim(Surface=reparameterize(item_6), Domain=dom²num_28)
Z_39 = UnitZ(Factor=division_155)
merge_16 = Merge(Data1=subsrf_27, Data2=subsrf_28)
srfsplit = SurfaceSplit(Surface=subsrf_14, Curves=subsrf_36)
srfsplit_2 = SurfaceSplit(Surface=subsrf_15, Curves=subsrf_37)
merge_17 = Merge(Data1=subsrf_29, Data2=subsrf_30)
merge_18 = Merge(Data1=cull_22, Data2=cull_20, Data3=cull_21)
Z_40 = UnitZ(Factor=lab_bench_shelf_thickness)
neg_17 = Negative(Value=lab_bench_shelf_thickness)
move_38 = Move(Geometry=move_36.Geometry, Motion=Z_39)  # -> Geometry, Transform
item_15 = ListItem(List=srfsplit, Index=0, Wrap=True)
item_16 = ListItem(List=srfsplit_2, Index=0, Wrap=True)
merge_19 = Merge(Data1=subsrf_32, Data2=subsrf_33, Data3=subsrf_34, Data4=subsrf_35)
Z_41 = UnitZ(Factor=cabinet_wheel_joint_height)
clean_8 = CleanTree(RemoveNulls=True, RemoveInvalid=True, RemoveEmpty=True, Tree=merge_18)
circle_3 = CircleCNR(Center=area.Centroid, Normal=Vector(0, 0, 1), Radius=lab_bench_bottom_disk_radius)
circle_4 = CircleCNR(Center=area_3.Centroid, Normal=Vector(0, 0, 1), Radius=lab_bench_bottom_disk_radius)
circle_5 = CircleCNR(Center=area_2.Centroid, Normal=Vector(0, 0, 1), Radius=lab_bench_bottom_disk_radius)
circle_6 = CircleCNR(Center=area_4.Centroid, Normal=Vector(0, 0, 1), Radius=lab_bench_bottom_disk_radius)
neg_18 = Negative(Value=Z_40)
Z_42 = UnitZ(Factor=lab_bench_bottom_disk_thickness)
Z_43 = UnitZ(Factor=lab_bench_bottom_disk_thickness)
Z_44 = UnitZ(Factor=lab_bench_bottom_disk_thickness)
Z_45 = UnitZ(Factor=lab_bench_bottom_disk_thickness)
merge_20 = Merge(Data1=subsrf_36, Data2=subsrf_37)
merge_21 = Merge(Data1=item_15, Data2=item_16)
srf_3 = Surface(circle_3)
addition_31 = Addition(A=lab_bench_bottom_disk_thickness, B=lab_bench_bottom_disk_joint_thickness)
srf_4 = Surface(circle_4)
srf_5 = Surface(circle_5)
srf_6 = Surface(circle_6)
X_16 = UnitX(Factor=cabinet_handle_depth)
neg_19 = Negative(Value=Z_41)
Z_46 = UnitZ(Factor=addition_25)
move_39 = Move(Geometry=area.Centroid, Motion=Z_42)  # -> Geometry, Transform
move_40 = Move(Geometry=area_3.Centroid, Motion=Z_43)  # -> Geometry, Transform
move_41 = Move(Geometry=area_2.Centroid, Motion=Z_44)  # -> Geometry, Transform
move_42 = Move(Geometry=area_4.Centroid, Motion=Z_45)  # -> Geometry, Transform
move_43 = Move(Geometry=merge_19, Motion=neg_19)  # -> Geometry, Transform
extr_28 = Extrude(Base=merge_19, Direction=neg_19)
move_44 = Move(Geometry=subsrf_19, Motion=Z_46)  # -> Geometry, Transform
Z_47 = UnitZ(Factor=lab_bench_shelf_thickness)
move_45 = Move(Geometry=merge_16, Motion=X_10)  # -> Geometry, Transform
move_46 = Move(Geometry=subsrf_38, Motion=X_10)  # -> Geometry, Transform
Z_48 = UnitZ(Factor=num_2)
move_47 = Move(Geometry=merge_17, Motion=X_10)  # -> Geometry, Transform
move_48 = Move(Geometry=subsrf_31, Motion=X_10)  # -> Geometry, Transform
circle_7 = CircleCNR(Center=move_39.Geometry, Normal=Vector(0, 0, 1), Radius=lab_bench_bottom_disk_joint_radius)
debrep_3 = DeconstructBrep(Brep=move_43.Geometry)  # -> Faces, Edges, Vertices
circle_8 = CircleCNR(Center=move_40.Geometry, Normal=Vector(0, 0, 1), Radius=lab_bench_bottom_disk_joint_radius)
circle_9 = CircleCNR(Center=move_41.Geometry, Normal=Vector(0, 0, 1), Radius=lab_bench_bottom_disk_joint_radius)
circle_10 = CircleCNR(Center=move_42.Geometry, Normal=Vector(0, 0, 1), Radius=lab_bench_bottom_disk_joint_radius)
Z_49 = UnitZ(Factor=addition_31)
merge_22 = Merge(Data1=subsrf_14, Data2=subsrf_15)
X_17 = UnitX(Factor=wall_cabinet_panel_thickness)
X_18 = UnitX(Factor=wall_cabinet_glass_thickness_1)
subtraction_53 = Subtraction(A=lab_bench_leg_extension_height, B=addition_31)
neg_20 = Negative(Value=Z_47)
neg_21 = Negative(Value=Z_48)
neg_22 = Negative(Value=Z_48)
merge_23 = Merge(Data1=subsrf_22, Data2=subsrf_23, Data3=clean_8)
Z_50 = UnitZ(Factor=lab_bench_bottom_disk_joint_thickness)
merge_24 = Merge(Data1=extr_24, Data2=extr_25, Data3=extr_26, Data4=extr_27)
Z_51 = UnitZ(Factor=lab_bench_bottom_disk_joint_thickness)
Z_52 = UnitZ(Factor=lab_bench_bottom_disk_joint_thickness)
Z_53 = UnitZ(Factor=lab_bench_bottom_disk_joint_thickness)
srf_7 = Surface(circle_7)
srf_8 = Surface(circle_8)
srf_9 = Surface(circle_9)
srf_10 = Surface(circle_10)
move_49 = Move(Geometry=merge_15, Motion=Z_49)  # -> Geometry, Transform
Z_54 = UnitZ(Factor=subtraction_53)
item_17 = ListItem(List=debrep_3.Edges, Index=1, Wrap=True)
item_18 = ListItem(List=debrep_3.Edges, Index=3, Wrap=True)
extr_29 = Extrude(Base=move_38.Geometry, Direction=neg_18)
extr_30 = Extrude(Base=move_37.Geometry, Direction=Z_40)
extr_31 = Extrude(Base=move_44.Geometry, Direction=neg_20)
extr_32 = Extrude(Base=merge_22, Direction=X_17)
extr_33 = Extrude(Base=merge_21, Direction=X_17)
extr_34 = Extrude(Base=merge_20, Direction=X_18)
extr_35 = Extrude(Base=srf_7, Direction=Z_50)
extr_36 = Extrude(Base=srf_3, Direction=Z_42)
extr_37 = Extrude(Base=srf_8, Direction=Z_51)
extr_38 = Extrude(Base=srf_4, Direction=Z_43)
extr_39 = Extrude(Base=srf_9, Direction=Z_52)
extr_40 = Extrude(Base=srf_5, Direction=Z_44)
extr_41 = Extrude(Base=srf_10, Direction=Z_53)
extr_42 = Extrude(Base=srf_6, Direction=Z_45)
eval_5 = EvaluateLength(Curve=item_17, Length=0.5, Normalized=True)  # -> Point, Tangent, Parameter
eval_6 = EvaluateLength(Curve=item_18, Length=0.5, Normalized=True)  # -> Point, Tangent, Parameter
merge_25 = Merge(Data1=extr_35, Data2=extr_36)
merge_26 = Merge(Data1=extr_37, Data2=extr_38)
merge_27 = Merge(Data1=extr_39, Data2=extr_40)
merge_28 = Merge(Data1=extr_41, Data2=extr_42)
move_50 = Move(Geometry=eval_5.Point, Motion=neg_21)  # -> Geometry, Transform
move_51 = Move(Geometry=eval_6.Point, Motion=neg_22)  # -> Geometry, Transform
X_19 = UnitX(Factor=cabinet_handle_thickness)
subtraction_54 = Subtraction(A=wall_cabinet_type, B=1)
move_52 = Move(Geometry=move_46.Geometry, Motion=X_16)  # -> Geometry, Transform
extr_43 = ExtrudePoint(Base=item_17, Point=move_50.Geometry)
extr_44 = ExtrudePoint(Base=item_18, Point=move_51.Geometry)
move_53 = Move(Geometry=move_48.Geometry, Motion=X_16)  # -> Geometry, Transform
Z_55 = UnitZ(Factor=lab_bench_leg_extension_height)
cull_23 = CullPattern(List=extr_34, CullPattern=invert(subtraction_54))
cull_24 = CullPattern(List=extr_33, CullPattern=invert(subtraction_54))
cull_25 = CullPattern(List=extr_32, CullPattern=subtraction_54)
extr_45 = Extrude(Base=move_45.Geometry, Direction=X_16)
extr_46 = Extrude(Base=move_52.Geometry, Direction=X_19)
extr_47 = Extrude(Base=move_53.Geometry, Direction=X_19)
extr_48 = Extrude(Base=move_47.Geometry, Direction=X_16)
cull_26 = CullPattern(List=subsrf_21, CullPattern=invert(item_2))
cull_27 = CullPattern(List=clean_8, CullPattern=item_2)
merge_29 = Merge(Data1=cull_25, Data2=cull_24)
cull_28 = CullPattern(List=subsrf_21, CullPattern=invert(item_2))
sunion = SolidUnion(Breps=[extr_45, extr_46])
fillet = Fillet(Curve=extr_43, Parameter=0, Radius=cabinet_wheel_joint_fillet_radius)  # -> Curve, Parameter
fillet_2 = Fillet(Curve=extr_44, Parameter=0, Radius=cabinet_wheel_joint_fillet_radius)  # -> Curve, Parameter
cull_29 = CullPattern(List=merge_23, CullPattern=item_2)
clean_9 = CleanTree(RemoveNulls=True, RemoveInvalid=True, RemoveEmpty=True, Tree=merge_29)
merge_30 = Merge(Data1=cull_26, Data2=cull_27)
explode = Explode(Curve=fillet.Curve, Recursive=True)  # -> Segments, Vertices
explode_2 = Explode(Curve=fillet_2.Curve, Recursive=True)  # -> Segments, Vertices
move_54 = Move(Geometry=subsrf_15, Motion=X_17)  # -> Geometry, Transform
move_55 = Move(Geometry=subsrf_14, Motion=X_17)  # -> Geometry, Transform
sunion_2 = SolidUnion(Breps=[extr_47, extr_48])
merge_31 = Merge(Data1=cull_28, Data2=cull_29)
srf_11 = Surface(fillet.Curve)
srf_12 = Surface(fillet_2.Curve)
Z_56 = UnitZ(Factor=subtraction_29)
item_19 = ListItem(List=explode.Segments, Index=3, Wrap=True)
item_20 = ListItem(List=explode_2.Segments, Index=3, Wrap=True)
clean_10 = CleanTree(RemoveNulls=True, RemoveInvalid=True, RemoveEmpty=True, Tree=merge_30)  # -> graft(Tree)
fmerge = MergeFaces(Brep=sunion)  # -> Breps, Before, After
clean_11 = CleanTree(RemoveNulls=True, RemoveInvalid=True, RemoveEmpty=True, Tree=merge_31)
fmerge_2 = MergeFaces(Brep=sunion_2)  # -> Breps, Before, After
darc = DeconstructArc(Arc=item_19)  # -> BasePlane, Radius, Angle
darc_2 = DeconstructArc(Arc=item_20)  # -> BasePlane, Radius, Angle
Y_14 = UnitY(Factor=cabinet_wheel_joint_triangle_thickness)
pt_11 = Point(darc.BasePlane)
subtraction_55 = Subtraction(A=subtraction_29, B=lab_bench_leg_extension_height)
pt_12 = Point(darc_2.BasePlane)
move_56 = Move(Geometry=merge_8, Motion=Z_55)  # -> Geometry, Transform
neg_23 = Negative(Value=Y_14)
Z_57 = UnitZ(Factor=subtraction_55)
move_57 = Move(Geometry=merge_7, Motion=Z_56)  # -> Geometry, Transform
move_58 = Move(Geometry=pt_11, Motion=neg_23)  # -> Geometry, Transform
move_59 = Move(Geometry=pt_12, Motion=Y_14)  # -> Geometry, Transform
extr_49 = Extrude(Base=srf_11, Direction=neg_23)
extr_50 = Extrude(Base=srf_12, Direction=Y_14)
Z_58 = UnitZ(Factor=lab_bench_horizontal_bar_thickness)
addition_32 = Addition(A=wall_cabinet_handle_thickness, B=wall_cabinet_handle_location_v)
neg_24 = Negative(Value=Z_58)
ln_9 = Line(StartPoint=move_58.Geometry, EndPoint=move_59.Geometry)
addition_33 = Addition(A=wall_cabinet_handle_location_u, B=wall_cabinet_handle_thickness)
extr_51 = Extrude(Base=move_56.Geometry, Direction=Z_57)
extr_52 = Extrude(Base=move_57.Geometry, Direction=neg_24)
pipe = Pipe(Curve=ln_9, Radius=addition_30, Caps=1)
srf_13 = Surface(clean_10)
num_5 = Number(cabinet_handle_thickness)
panel_26 = Panel("""1
2""")
addition_34 = Addition(A=addition_32, B=wall_cabinet_handle_lenght)
addition_35 = Addition(A=wall_cabinet_handle_location_v, B=wall_cabinet_handle_lenght)
extr_53 = Extrude(Base=move_49.Geometry, Direction=Z_54)
merge_32 = Merge(Data1=extr_51, Data2=extr_52, Data3=merge_24)
merge_33 = Merge(Data1=merge_25, Data2=merge_26, Data3=merge_27, Data4=merge_28)
extr_54 = Extrude(Base=move_5.Geometry, Direction=neg_3)
merge_34 = Merge(Data1=extr_29, Data2=extr_30, Data3=extr_31)
mesh_5 = Mesh(flatten(extr_53))
mesh_6 = Mesh(flatten(merge_33))
mesh_7 = Mesh(flatten(merge_32))
swatch_5 = ColourSwatch(SwatchColor=RGB(59, 59, 59))
mesh_8 = Mesh(flatten(merge_34))
swatch_6 = ColourSwatch(SwatchColor=RGB(153, 153, 153))
mesh_9 = Mesh(flatten(extr_54))
swatch_7 = ColourSwatch(SwatchColor=RGB(201, 201, 201))
swatch_8 = ColourSwatch(SwatchColor=RGB(105, 68, 68))
merge_35 = Merge(Data1=extr_28, Data2=extr_49, Data3=extr_50)
filedge_3 = FilletEdge(Shape=pipe, Blend=0, Metric=2, Edges=panel_26, Radii=cabinet_wheel_edge_fillet_raidus)
mjoin_5 = MeshJoin(Meshes=mesh_5)
swatch_9 = ColourSwatch(SwatchColor=RGB(224, 192, 103))
merge_36 = Merge(Data1=swatch_8, Data2=swatch_7, Data3=swatch_6, Data4=swatch_5, Data5=swatch_9)
argb = SplitARGB(Colour=merge_36, IntegerChannels=True)  # -> Alpha, Red, Green, Blue
c_script = CSharpScript(r=argb.Red, g=argb.Green, b=argb.Blue)  # -> out, A; inputs r: Int32, g: Int32, b: Int32
# ---------- c_script: C# ----------
A = string.Format("{0:X2}{1:X2}{2:X2}", r, g, b);
# ---------- end c_script ----------
panel_27 = Panel(c_script.A)
concat = Concatenate(FragmentA="0x", FragmentB=panel_27)
join_3 = TextJoin(Text=concat, Join=",")
panel_28 = Panel(join_3)
mjoin_6 = MeshJoin(Meshes=mesh_6)
mjoin_7 = MeshJoin(Meshes=mesh_7)
mjoin_8 = MeshJoin(Meshes=mesh_8)
mjoin_9 = MeshJoin(Meshes=mesh_9)
merge_37 = Merge(Data1=mjoin_9, Data2=mjoin_7, Data3=mjoin_6, Data4=mjoin_5, Data5=mjoin_8)
rotate = Rotate(Geometry=merge_37, Angle=degrees("-90"), Plane=yz)  # -> Geometry, Transform
scale_5 = Scale(Geometry=rotate.Geometry, Center=Point(0, 0, 0), Factor=Slider(0.1, range=0..0.1))  # -> Geometry, Transform

# ---- group: RH_OUT:115:Mesh
mesh_10 = Mesh(scale_5.Geometry)

# ----
preview_9 = CustomPreview(Geometry=extr_53, Material=swatch_5)
preview_10 = CustomPreview(Geometry=merge_33, Material=swatch_6)
preview_11 = CustomPreview(Geometry=merge_34, Material=swatch_9)
preview_12 = CustomPreview(Geometry=merge_32, Material=swatch_7)
preview_13 = CustomPreview(Geometry=extr_54, Material=swatch_8)
dim_29 = Dimensions(Surface=srf_13)  # -> UDimension, VDimension
dim_30 = Dimensions(Surface=srf_13)  # -> UDimension, VDimension
dim_31 = Dimensions(Surface=srf_13)  # -> UDimension, VDimension
extr_55 = Extrude(Base=clean_11, Direction=X_10)
dim_32 = Dimensions(Surface=move_55.Geometry)  # -> UDimension, VDimension
dim_33 = Dimensions(Surface=move_55.Geometry)  # -> UDimension, VDimension
subtraction_56 = Subtraction(A=dim_33.VDimension, B=wall_cabinet_handle_location_u)
subtraction_57 = Subtraction(A=subtraction_56, B=wall_cabinet_handle_thickness)
dim_34 = Dimensions(Surface=move_55.Geometry)  # -> UDimension, VDimension
dim_35 = Dimensions(Surface=move_54.Geometry)  # -> UDimension, VDimension
dim_36 = Dimensions(Surface=move_54.Geometry)  # -> UDimension, VDimension
dim_37 = Dimensions(Surface=move_54.Geometry)  # -> UDimension, VDimension
dim_38 = Dimensions(Surface=srf_13)  # -> UDimension, VDimension
addition_36 = Addition(A=cabinet_handle_lenght, B=cabinet_handle_thickness)
division_156 = Division(A=addition_32, B=dim_33.UDimension)
division_157 = Division(A=wall_cabinet_handle_location_v, B=dim_33.UDimension)
division_158 = Division(A=subtraction_56, B=dim_33.VDimension)
division_159 = Division(A=subtraction_57, B=dim_33.VDimension)
division_160 = Division(A=addition_34, B=dim_32.UDimension)
division_161 = Division(A=addition_35, B=dim_32.UDimension)
division_162 = Division(A=subtraction_56, B=dim_32.VDimension)
division_163 = Division(A=subtraction_57, B=dim_32.VDimension)
division_164 = Division(A=wall_cabinet_handle_location_v, B=dim_34.UDimension)
division_165 = Division(A=addition_34, B=dim_34.UDimension)
division_166 = Division(A=subtraction_56, B=dim_34.VDimension)
division_167 = Division(A=subtraction_57, B=dim_34.VDimension)
division_168 = Division(A=addition_32, B=dim_35.UDimension)
division_169 = Division(A=wall_cabinet_handle_location_v, B=dim_35.UDimension)
division_170 = Division(A=addition_33, B=dim_35.VDimension)
division_171 = Division(A=wall_cabinet_handle_location_u, B=dim_35.VDimension)
division_172 = Division(A=addition_34, B=dim_36.UDimension)
division_173 = Division(A=addition_35, B=dim_36.UDimension)
division_174 = Division(A=addition_33, B=dim_36.VDimension)
division_175 = Division(A=wall_cabinet_handle_location_u, B=dim_36.VDimension)
division_176 = Division(A=wall_cabinet_handle_location_v, B=dim_37.UDimension)
division_177 = Division(A=addition_34, B=dim_37.UDimension)
division_178 = Division(A=addition_33, B=dim_37.VDimension)
division_179 = Division(A=wall_cabinet_handle_location_u, B=dim_37.VDimension)
dom²num_39 = ConstructDomain²(UMin=division_156, UMax=division_157, VMin=division_158, VMax=division_159)
dom²num_40 = ConstructDomain²(UMin=division_160, UMax=division_161, VMin=division_162, VMax=division_163)
dom²num_41 = ConstructDomain²(UMin=division_164, UMax=division_165, VMin=division_166, VMax=division_167)
dom²num_42 = ConstructDomain²(UMin=division_168, UMax=division_169, VMin=division_170, VMax=division_171)
dom²num_43 = ConstructDomain²(UMin=division_172, UMax=division_173, VMin=division_174, VMax=division_175)
dom²num_44 = ConstructDomain²(UMin=division_176, UMax=division_177, VMin=division_178, VMax=division_179)
subsrf_39 = Isotrim(Surface=reparameterize(move_55.Geometry), Domain=dom²num_39)
subsrf_40 = Isotrim(Surface=reparameterize(move_55.Geometry), Domain=dom²num_40)
subsrf_41 = Isotrim(Surface=reparameterize(move_55.Geometry), Domain=dom²num_41)
subsrf_42 = Isotrim(Surface=reparameterize(move_54.Geometry), Domain=dom²num_42)
subsrf_43 = Isotrim(Surface=reparameterize(move_54.Geometry), Domain=dom²num_43)
subsrf_44 = Isotrim(Surface=reparameterize(move_54.Geometry), Domain=dom²num_44)
division_180 = Division(A=dim_38.VDimension, B=2)
division_181 = Division(A=addition_36, B=2)
subtraction_58 = Subtraction(A=dim_38.UDimension, B=cabinet_horizontal_handle_location_v)
merge_38 = Merge(Data1=subsrf_42, Data2=subsrf_43)
merge_39 = Merge(Data1=subsrf_39, Data2=subsrf_40)
X_20 = UnitX(Factor=wall_cabinet_handle_depth)
X_21 = UnitX(Factor=wall_cabinet_handle_thickness)
subtraction_59 = Subtraction(A=division_180, B=division_181)
addition_37 = Addition(A=division_180, B=division_181)
move_60 = Move(Geometry=subsrf_41, Motion=X_20)  # -> Geometry, Transform
extr_56 = Extrude(Base=merge_39, Direction=X_20)
X_22 = UnitX(Factor=wall_cabinet_handle_depth)
X_23 = UnitX(Factor=wall_cabinet_handle_thickness)
extr_57 = Extrude(Base=move_60.Geometry, Direction=X_21)
move_61 = Move(Geometry=subsrf_44, Motion=X_22)  # -> Geometry, Transform
extr_58 = Extrude(Base=merge_38, Direction=X_22)
extr_59 = Extrude(Base=move_61.Geometry, Direction=X_23)
addition_38 = Addition(A=subtraction_59, B=num_5)
subtraction_60 = Subtraction(A=subtraction_58, B=num_5)
subtraction_61 = Subtraction(A=addition_37, B=num_5)
subtraction_62 = Subtraction(A=addition_37, B=addition_36)
sunion_3 = SolidUnion(Breps=[extr_56, extr_57])
sunion_4 = SolidUnion(Breps=[extr_58, extr_59])
fmerge_3 = MergeFaces(Brep=sunion_3)  # -> Breps, Before, After
fmerge_4 = MergeFaces(Brep=sunion_4)  # -> Breps, Before, After
division_182 = Division(A=subtraction_58, B=dim_29.UDimension)
division_183 = Division(A=subtraction_60, B=dim_29.UDimension)
division_184 = Division(A=subtraction_59, B=dim_29.VDimension)
division_185 = Division(A=addition_38, B=dim_29.VDimension)
division_186 = Division(A=subtraction_58, B=dim_30.UDimension)
division_187 = Division(A=subtraction_60, B=dim_30.UDimension)
division_188 = Division(A=subtraction_61, B=dim_30.VDimension)
division_189 = Division(A=addition_37, B=dim_30.VDimension)
division_190 = Division(A=subtraction_58, B=dim_31.UDimension)
division_191 = Division(A=subtraction_60, B=dim_31.UDimension)
division_192 = Division(A=subtraction_62, B=dim_31.VDimension)
division_193 = Division(A=addition_37, B=dim_31.VDimension)
dom²num_45 = ConstructDomain²(UMin=division_182, UMax=division_183, VMin=division_184, VMax=division_185)
dom²num_46 = ConstructDomain²(UMin=division_186, UMax=division_187, VMin=division_188, VMax=division_189)
dom²num_47 = ConstructDomain²(UMin=division_190, UMax=division_191, VMin=division_192, VMax=division_193)
subsrf_45 = Isotrim(Surface=reparameterize(clean_10), Domain=dom²num_47)
subsrf_46 = Isotrim(Surface=reparameterize(clean_10), Domain=dom²num_45)
subsrf_47 = Isotrim(Surface=reparameterize(clean_10), Domain=dom²num_46)
merge_40 = Merge(Data1=fmerge_3.Breps, Data2=fmerge_4.Breps)
merge_41 = Merge(Data1=subsrf_46, Data2=subsrf_47)
move_62 = Move(Geometry=subsrf_45, Motion=X_10)  # -> Geometry, Transform
move_63 = Move(Geometry=move_62.Geometry, Motion=X_16)  # -> Geometry, Transform
extr_60 = Extrude(Base=move_63.Geometry, Direction=X_19)
move_64 = Move(Geometry=merge_41, Motion=X_10)  # -> Geometry, Transform
extr_61 = Extrude(Base=move_64.Geometry, Direction=X_16)
sunion_5 = SolidUnion(Breps=[extr_61, extr_60])
fmerge_5 = MergeFaces(Brep=sunion_5)  # -> Breps, Before, After
merge_42 = Merge(Data1=fmerge.Breps, Data2=fmerge_2.Breps)
cull_30 = CullPattern(List=merge_42, CullPattern=item_2)
clean_12 = CleanTree(RemoveNulls=True, RemoveInvalid=True, RemoveEmpty=True, Tree=cull_30)
cull_31 = CullPattern(List=extr_14, CullPattern=invert(item_5))
cull_32 = CullPattern(List=[filedge_3, merge_35], CullPattern=item_5)
cull_33 = CullPattern(List=filedge_3, CullPattern=item_5)
merge_43 = Merge(Data1=clean_12, Data2=fmerge_5.Breps)
cull_34 = CullPattern(List=cull_31, CullPattern=item_4)
cull_35 = CullPattern(List=cull_32, CullPattern=item_4)
cull_36 = CullPattern(List=cull_33, CullPattern=item_4)
preview_14 = CustomPreview(Geometry=clean_9, Material=ColourSwatch(SwatchColor=RGB(224, 192, 103)))
preview_15 = CustomPreview(Geometry=cull_23, Material=ColourSwatch(SwatchColor=RGBA(145, 255, 233, 133)))
preview_16 = CustomPreview(Geometry=sdiff_2, Material=ColourSwatch(SwatchColor=RGBA(255, 255, 255, 180)))
preview_17 = CustomPreview(Geometry=merge_40, Material=ColourSwatch(SwatchColor=RGB(140, 105, 105)))
preview_18 = CustomPreview(Geometry=cull_34, Material=ColourSwatch(SwatchColor=RGB(219, 219, 219)))
preview_19 = CustomPreview(Geometry=sdiff, Material=ColourSwatch(SwatchColor=RGBA(255, 255, 255, 180)))
preview_20 = CustomPreview(Geometry=extr_55, Material=ColourSwatch(SwatchColor=RGB(224, 192, 103)))
preview_21 = CustomPreview(Geometry=merge_43, Material=ColourSwatch(SwatchColor=RGB(140, 105, 105)))
preview_22 = CustomPreview(Geometry=cull_35, Material=ColourSwatch(SwatchColor=RGB(181, 181, 181)))
preview_23 = CustomPreview(Geometry=cull_36, Material=ColourSwatch(SwatchColor=RGB(87, 87, 87)))
