# Grasshopper definition LabBench3.gh (Grasshopper 1.0.6)
# plug-ins: LabBench

# ---- group: RH_IN:201:Length
branch_length = Slider(10, range=0..10)

# ---- group: RH_IN:201:Radius
cell_radius = Slider(10, range=0..10)

# ---- group: RH_IN:201:Count
number_slider = Slider(10, range=1..10)

# ----
boolean_toggle = BooleanToggle(True)
multiplication = Multiplication(A=branch_length, B="12")
multiplication_2 = Multiplication(A=cell_radius, B="12")
multiplication_3 = Multiplication(A=number_slider, B="12")
shelfopts = ShelfOpts(IsOn=boolean_toggle, ShelfHeight=12, NumShelves=3)
cabinetopts = CabinetOpts(IsOn=Toggle(True), OnFloor=True, HasCasters=True, NumDrawers=3)
lab_bench_designer = LabBenchDesigner(
    BasePlane=PlaneXY(0, 0, 0),
    Height=multiplication,
    Width=multiplication_2,
    Length=multiplication_3,
    Casters=boolean_toggle,
    ShelfOptions=shelfopts,
    CabinetOptions=cabinetopts)
mesh = Mesh(lab_bench_designer)
mesh_join = MeshJoin(Meshes=mesh)

# ---- group: RH_OUT:115:Mesh
mesh_2 = Mesh(mesh_join)
