# Grasshopper definition LabBench5.gh (Grasshopper 1.0.6)

# ---- group: RH_IN:201:Length
branch_length = Slider(10, range=0..10)

# ---- group: RH_IN:201:Radius
cell_radius = Slider(10, range=0..10)

# ---- group: RH_IN:201:Count
number_slider = Slider(10, range=1..10)

# ----
construct_point = ConstructPoint(XCoordinate=branch_length, YCoordinate=cell_radius, ZCoordinate=number_slider)
construct_point_2 = ConstructPoint(XCoordinate=0, YCoordinate=0, ZCoordinate=0)
sphere = Sphere(Base=PlaneXY(0, 0, 0), Radius=number_slider)
box_2pt = Box2Pt(PointA=construct_point_2, PointB=construct_point, Plane=PlaneXY(0, 0, 0))
mesh = Mesh(flatten(sphere))
mesh_2 = Mesh(flatten(box_2pt))
unweld_mesh = UnweldMesh(Mesh=mesh_2, Angle="0")  # -> flatten(Result)

# ---- group: RH_OUT:115:Mesh
mesh_3 = Mesh([mesh, unweld_mesh])
