# Grasshopper definition LabBench7.gh (Grasshopper 1.0.6)

# ---- group: RH_IN:201:Length
branch_length = Slider(10, range=0..10)

# ---- group: RH_IN:201:Radius
cell_radius = Slider(10, range=0..10)

# ---- group: RH_IN:201:Count
number_slider = Slider(10, range=1..10)

# ----
construct_point = ConstructPoint(XCoordinate=branch_length, YCoordinate=cell_radius, ZCoordinate=number_slider)
construct_point_2 = ConstructPoint(XCoordinate=0, YCoordinate=0, ZCoordinate=0)
sphere = Sphere(Base=PlaneXY(0, 0, 0), Radius=number_slider)
box_2pt = Box2Pt(PointA=construct_point_2, PointB=construct_point, Plane=PlaneXY(0, 0, 0))
mesh_box = MeshBox(Base=box_2pt, XCount="2", YCount="2", ZCount="2")  # -> flatten(Mesh)
mesh = Mesh(flatten(sphere))

# ---- group: RH_OUT:115:Mesh
mesh_2 = Mesh([mesh, mesh_box])
