# Grasshopper definition LabBench8.gh (Grasshopper 1.0.6)

# ---- group: RH_IN:201:Length
branch_length = Slider(53.41, range=0..90)

# ---- group: RH_IN:201:Width
cell_radius = Slider(26.1, range=0..60)

# ---- group: RH_IN:201:Height
number_slider = Slider(2, range=1..10)

# ----
multiplication = Multiplication(A=number_slider, B="12")
Z = UnitZ(Factor=multiplication)
pt = ConstructPoint(XCoordinate="2", YCoordinate="2", ZCoordinate=Z)
pt_2 = ConstructPoint(XCoordinate=branch_length, YCoordinate=cell_radius, ZCoordinate="1.5")
pt_3 = ConstructPoint(XCoordinate=0, YCoordinate=0, ZCoordinate=0)
box = Box2Pt(PointA=pt_3, PointB=pt, Plane=PlaneXY(0, 0, 0))
box_2 = Box2Pt(PointA=pt_3, PointB=pt_2, Plane=PlaneXY(0, 0, 0))
mbox = MeshBox(Base=box_2, XCount="2", YCount="2", ZCount="2")  # -> flatten(Mesh)
subtraction = Subtraction(A=branch_length, B="2")
subtraction_2 = Subtraction(A=cell_radius, B="2")
X = UnitX(Factor=subtraction)
move = Move(Geometry=mbox, Motion=Z)  # -> Geometry, Transform
Y = UnitY(Factor=subtraction_2)
move_2 = Move(Geometry=box, Motion=X)  # -> Geometry, Transform
move_3 = Move(Geometry=[move_2.Geometry, box], Motion=Y)  # -> Geometry, Transform
mbox_2 = MeshBox(Base=[move_3.Geometry, move_2.Geometry, box], XCount="2", YCount="2", ZCount="2")  # -> flatten(Mesh)
mjoin = MeshJoin(Meshes=mbox_2)

# ---- group: RH_OUT:115:Mesh
mesh = Mesh([move.Geometry, mjoin])
