# Grasshopper definition Casework10.gh (Grasshopper 1.0.7)

# ---- group: RH_IN:201:Pegboard_Count
# Pegboard
number_slider = Slider(1, range=1..3)

# ---- group: RH_IN:201:Pegboard_Start_Position
number_slider_2 = Slider(0, range=0..100)

# ----
panel = Panel("0")

# ---- group: RH_IN:201:Wall_Cabinet_Count
# Wall_Cabinet
number_slider_3 = Slider(1, range=1..3)

# ---- group: RH_IN:201:Wall_Cabinet_Start_Position
number_slider_4 = Slider(0, range=0..100)

# ---- group: RH_IN:201:Cabinet_Count
# Cabinet
number_slider_5 = Slider(1, range=1..3)

# ---- group: RH_IN:201:Cabinet_Start_Position
number_slider_6 = Slider(0, range=0..100)

# ----
pt = ConstructPoint(XCoordinate=0, YCoordinate=0, ZCoordinate=0)

# ---- group: RH_IN:201:Lab_Bench_Count
# Lab_Bench
number_slider_7 = Slider(1, range=1..3)

# ---- group: RH_IN:201:Lab_Bench_Start_Position
number_slider_8 = Slider(0, range=0..100)

# ----
pegboard_height_from_ground = Slider(48, range=0..1000)
cabinet_height = Slider(30.5, range=0..100)
cabinet_width = Slider(27, range=0..100)
series = Series(Start=number_slider_6, Step=cabinet_width, Count=number_slider_5)
pt_2 = ConstructPoint(XCoordinate=0, YCoordinate=series, ZCoordinate=0)
cabinet_depth = Slider(23.25, range=0..100)
cabinet_base_height = Slider(4, range=0..10)
cabinet_base_recess = Slider(3, range=0..10)
cabinet_thickness = Slider(0.75, range=0..5)
cabinet_panel_thickness = Slider(0.75, range=0..10)
cabinet_middle_vertical_line_2_3 = Slider(0.5, range=0..1)
cabinet_horizontal_line_height_2_3_4 = Slider(5.7, range=0..10)
cabinet_vertical_handle_location_u_2_3_4 = Slider(1.25, range=0..10)
cabinet_vertical_handle_location_v_2_3_4 = Slider(2.75, range=0..10)
cabinet_horizontal_handle_location_v = Slider(1.75, range=-10..10)
cabinet_handle_depth = Slider(0.75, range=0..1)
cabinet_handle_lenght = Slider(4, range=0..100)
cabinet_handle_thickness = Slider(0.5, range=0..1)
drawer_heights_for_type_1 = Panel("""5.5
6
6
6
8""")
cabinet_wheel_offset = Slider(1, range=0..5)
cabinet_wheel_joint_lenght = Slider(4, range=0..10)
cabinet_wheel_joint_width = Slider(1.5, range=0..10)
cabinet_wheel_joint_height = Slider(0.5, range=0..10)
cabinet_wheel_joint_fillet_radius = Slider(0.5, range=0.1..1.1)
cabinet_wheel_joint_triangle_thickness = Slider(0.25, range=0..10)
cabinet_wheel_edge_fillet_raidus = Slider(0.5, range=0..1)
cabinet_height_from_ground = Slider(50, range=0..100)
wall_cabinet_depth = Slider(13, range=0..100)
wall_cabinet_width = Slider(27, range=0..100)
series_2 = Series(Start=number_slider_4, Step=wall_cabinet_width, Count=number_slider_3)
pt_3 = ConstructPoint(XCoordinate=0, YCoordinate=series_2, ZCoordinate=0)
pt_4 = Point(pt_3)
wall_cabinet_height = Slider(30, range=0..100)
wall_cabinet_thickness = Slider(0.75, range=0..5)
wall_cabinet_middle_vertical_line = Slider(0.5, range=0..1)
wall_cabinet_panel_thickness = Slider(0.75, range=0..10)
wall_cabinet_panel_offset_1 = Slider(2, range=0..5)
wall_cabinet_glass_thickness_1 = Slider(0.25, range=0..10)
wall_cabinet_handle_location_v = Slider(3, range=-10..100)
wall_cabinet_handle_location_u = Slider(0.75, range=0..20)
wall_cabinet_handle_lenght = Slider(4, range=0..10)
wall_cabinet_handle_depth = Slider(0.75, range=0..10)
wall_cabinet_handle_thickness = Slider(0.5, range=0..1)

# ---- group: RH_IN:201:Pegboard_Length
pegboard_length = Slider(52, range=0..100)

# ----
series_3 = Series(Start=number_slider_2, Step=pegboard_length, Count=number_slider)
pt_5 = ConstructPoint(XCoordinate=0, YCoordinate=series_3, ZCoordinate=0)
pt_6 = Point(pt_5)
pegboard_heigth = Slider(36, range=0..36)
pegboard_thickness = Slider(1, range=0..36)
pegbard_crop_bottom = Slider(5, range=0..100)
pegboard_crop_top = Slider(5, range=0..100)
pegboard_crop_left = Slider(20, range=0..100)
pegboard_crop_right = Slider(4, range=0..100)
pegboard_hook_u_count = Slider(7, range=0..10)
pegboard_hook_v_count = Slider(12, range=0..100)
pegboard_hook_pattern_type = Slider(2, range=1..3)
pegboard_hook_angle = Slider(50, range=-90..90)
pegboard_hook_length = Slider(5, range=0..100)
pegboard_hook_radius = Slider(0.125, range=0..1)
pegboard_base_depth = Slider(2, range=0..10)
pegboard_base_thickness = Slider(0.0625, range=0..1)
pegboard_base_extension_height = Slider(0.75, range=0..10)
pegboard_base_extension_thickness = Slider(0.125, range=0..1)
pegboard_hook_joint_upper_horizontal_sca = Slider(0, range=0..10)  # "Pegboard_Hook_Joint_Upper_Horizontal_Scale"
pegboard_hook_joint_upper_vertical_scale = Slider(0.5, range=0..1)
pegboard_hook_joint_lower_horizontal_sca = Slider(0.25, range=0..10)  # "Pegboard_Hook_Joint_Lower_Horizontal_Scale"
pegboard_hook_joint_upper_vertical_scale_2 = Slider(0.25, range=0..1)
pegboard_hook_joint_thickness = Slider(0.15, range=0..1)
pegboard_hook_joint_fillet = Slider(0, range=0..1)

# ---- group: RH_IN:201:Wall_Cabinet_Type
wall_cabinet_type = Slider(1, range=1..2)

# ---- group: RH_IN:201:Cabinet_Type
cabinet_type = Slider(2, range=1..4)

# ---- group: RH_IN:201:Cabinet_Type_Base
cabinet_base_type = Slider(3, range=1..3)

# ----
pt_7 = Point(pt_2)
lab_bench_counter_thickness = Slider(1, range=0..10)

# ---- group: RH_IN:201:Lab_Bench_Width
lab_bench_width = Slider(30, range=0..100)

# ---- group: RH_IN:201:Lab_Bench_Height
lab_bench_height = Slider(37, range=0..100)

# ----
lab_bench_front_horizontal_bar_recess = Slider(0, range=0..20)
lab_bench_back_horizontal_bar_recess = Slider(1, range=0..10)
lab_bench_shelf_horizontal_division_numb = Slider(2, range=1..10)  # "Lab_Bench_Shelf_Horizontal_Division_Number"
lab_bench_shelf_lower_bar_height_from_co = Slider(14, range=0..100)  # "Lab_Bench_Shelf_Lower_Bar_Height_From_Counter"
lab_bench_shelf_lower_bar_height = Slider(3, range=0..10)
lab_bench_shelf_vertical_structure_heigh = Slider(48, range=0..100)  # "Lab_Bench_Shelf_Vertical_Structure_Height"
lab_bench_horizontal_bar_thickness = Slider(1.5, range=0..10)
lab_bench_main_structure_thickness = Slider(2, range=0..5)
lab_bench_front_leg_recess = Slider(1, range=0..100)
lab_bench_back_leg_recess = Slider(1.5, range=0..10)
lab_bench_outer_horizontal_frame_thickne = Slider(0.816, range=0..2)  # "Lab_Bench_Outer_Horizontal_Frame_Thickness"
lab_bench_inner_horizontal_frame_thickne = Slider(1.5, range=0..10)  # "Lab_Bench_Inner_Horizontal_Frame_Thickness"
lab_bench_bottom_disk_thickness = Slider(0.25, range=0..10)
lab_bench_bottom_disk_joint_radius = Slider(0.35, range=0..1)
lab_bench_leg_extension_height = Slider(6, range=0..10)
lab_bench_shelf_thickness = Slider(1, range=0..10)
lab_bench_shelf_depth = Slider(12, range=0..100)
lab_bench_top_shelf_depth = Slider(21, range=0..100)
lab_bench_bottom_disk_radius = Slider(1, range=0..10)
lab_bench_bottom_disk_joint_thickness = Slider(0.25, range=0..10)
lab_bench_leg_extension_thickness = Slider(1.25, range=0..10)
lab_bench_shelf_vertical_division_number = Slider(2, range=0..10)

# ---- group: RH_IN:201:Lab_Bench_Length
lab_bench_length = Slider(72, range=0..100)

# ----
series_4 = Series(Start=number_slider_8, Step=lab_bench_length, Count=number_slider_7)
pt_8 = ConstructPoint(XCoordinate=0, YCoordinate=series_4, ZCoordinate=0)
pt_9 = Point(pt_8)
X = UnitX(Factor=lab_bench_width)
Y = UnitY(Factor=lab_bench_length)
Z = UnitZ(Factor=lab_bench_height)
Z_2 = UnitZ(Factor=lab_bench_counter_thickness)
move = Move(Geometry=pt_9, Motion=X)  # -> Geometry, Transform
addition = Addition(A=pegboard_thickness, B=pegboard_base_depth)
neg = Negative(Value=Z_2)
ln = Line(StartPoint=move.Geometry, EndPoint=pt_9)
neg_2 = Negative(Value=pegboard_base_thickness)
neg_3 = Negative(Value=pegboard_base_extension_thickness)
extr = Extrude(Base=ln, Direction=Y)
Z_3 = UnitZ(Factor=pegboard_height_from_ground)
Y_2 = UnitY(Factor=pegboard_length)
Z_4 = UnitZ(Factor=pegboard_heigth)
X_2 = UnitX(Factor=pegboard_thickness)
X_3 = UnitX(Factor=addition)
Z_5 = UnitZ(Factor=neg_2)
Z_6 = UnitZ(Factor=pegboard_base_extension_height)
X_4 = UnitX(Factor=neg_3)
move_2 = Move(Geometry=extr, Motion=Z)  # -> Geometry, Transform
move_3 = Move(Geometry=pt_6, Motion=Z_3)  # -> Geometry, Transform
move_4 = Move(Geometry=move_3.Geometry, Motion=Y_2)  # -> Geometry, Transform
dim = Dimensions(Surface=extr)  # -> UDimension, VDimension
ln_2 = Line(StartPoint=move_3.Geometry, EndPoint=move_4.Geometry)
extr_2 = Extrude(Base=ln_2, Direction=Z_4)
move_5 = Move(Geometry=extr_2, Motion=X_2)  # -> Geometry, Transform
dim_2 = Dimensions(Surface=move_5.Geometry)  # -> UDimension, VDimension
subtraction = Subtraction(A=dim.VDimension, B=lab_bench_back_leg_recess)
addition_2 = Addition(A=lab_bench_main_structure_thickness, B=lab_bench_front_leg_recess)
equals = Equality(FirstNumber=cabinet_type, SecondNumber=1)  # -> Equality, Inequality
equals_2 = Equality(FirstNumber=cabinet_type, SecondNumber=2)  # -> Equality, Inequality
equals_3 = Equality(FirstNumber=cabinet_type, SecondNumber=3)  # -> Equality, Inequality
equals_4 = Equality(FirstNumber=cabinet_type, SecondNumber=4)  # -> Equality, Inequality
equals_5 = Equality(FirstNumber=cabinet_base_type, SecondNumber=1)  # -> Equality, Inequality
equals_6 = Equality(FirstNumber=cabinet_base_type, SecondNumber=2)  # -> Equality, Inequality
equals_7 = Equality(FirstNumber=cabinet_base_type, SecondNumber=3)  # -> Equality, Inequality
panel_3 = Panel(subtraction)
addition_3 = Addition(A=addition_2, B=lab_bench_front_horizontal_bar_recess)
subtraction_2 = Subtraction(A=dim_2.UDimension, B=pegboard_crop_top)
subtraction_3 = Subtraction(A=dim_2.VDimension, B=pegboard_crop_right)
panel_4 = Panel("""0
0""")
panel_5 = Panel("""1
0""")
panel_6 = Panel("""1
1""")
panel_7 = Panel("""1
0
0""")
panel_8 = Panel("""1
1
0""")
panel_9 = Panel("""0
1
0""")
panel_10 = Panel("""1
1
1""")
subtraction_4 = Subtraction(A=subtraction, B=lab_bench_main_structure_thickness)
cull = CullPattern(List=panel_7, CullPattern=equals.Equality)
cull_2 = CullPattern(List=panel_8, CullPattern=equals_2.Equality)
cull_3 = CullPattern(List=panel_9, CullPattern=equals_3.Equality)
cull_4 = CullPattern(List=panel_10, CullPattern=equals_4.Equality)
cull_5 = CullPattern(List=panel_4, CullPattern=equals_5.Equality)
cull_6 = CullPattern(List=panel_5, CullPattern=equals_6.Equality)
cull_7 = CullPattern(List=panel_6, CullPattern=equals_7.Equality)
division = Division(A=pegbard_crop_bottom, B=dim_2.UDimension)
division_2 = Division(A=subtraction_2, B=dim_2.UDimension)
division_3 = Division(A=pegboard_crop_left, B=dim_2.VDimension)
division_4 = Division(A=subtraction_3, B=dim_2.VDimension)
panel_11 = Panel(subtraction_4)
subtraction_5 = Subtraction(A=dim.UDimension, B=lab_bench_main_structure_thickness)
panel_12 = Panel(addition_2)
panel_13 = Panel(addition_3)
merge = Merge(Data1=cull_5, Data2=cull_6, Data3=cull_7)
merge_2 = Merge(Data1=cull, Data2=cull_2, Data3=cull_3, Data4=cull_4)
subtraction_6 = Subtraction(A=subtraction_4, B=lab_bench_inner_horizontal_frame_thickne)
dom²num = ConstructDomain²(UMin=division, UMax=division_2, VMin=division_3, VMax=division_4)
addition_4 = Addition(A=cabinet_depth, B=cabinet_panel_thickness)
subtraction_7 = Subtraction(A=cabinet_height, B=cabinet_horizontal_line_height_2_3_4)
panel_14 = Panel(subtraction_5)
clean = CleanTree(RemoveNulls=True, RemoveInvalid=True, RemoveEmpty=True, Tree=merge)
clean_2 = CleanTree(RemoveNulls=True, RemoveInvalid=True, RemoveEmpty=True, Tree=merge_2)
panel_15 = Panel(subtraction_6)
subtraction_8 = Subtraction(A=addition_4, B=cabinet_base_recess)
equals_8 = Equality(FirstNumber=pegboard_hook_pattern_type, SecondNumber=1)  # -> Equality, Inequality
equals_9 = Equality(FirstNumber=pegboard_hook_pattern_type, SecondNumber=2)  # -> Equality, Inequality
equals_10 = Equality(FirstNumber=pegboard_hook_pattern_type, SecondNumber=3)  # -> Equality, Inequality
move_6 = Move(Geometry=ln_2, Motion=X_3)  # -> Geometry, Transform
X_5 = UnitX(Factor=subtraction_8)
X_6 = UnitX(Factor=cabinet_depth)
Y_3 = UnitY(Factor=cabinet_width)
Z_7 = UnitZ(Factor=cabinet_base_height)
Z_8 = UnitZ(Factor=cabinet_height)
X_7 = UnitX(Factor=cabinet_panel_thickness)
item = ListItem(List=clean_2, Index=0, Wrap=True)
item_2 = ListItem(List=clean_2, Index=1, Wrap=True)
item_3 = ListItem(List=clean_2, Index=2, Wrap=True)
item_4 = ListItem(List=clean, Index=0, Wrap=True)
item_5 = ListItem(List=clean, Index=1, Wrap=True)
panel_16 = Panel("""1
0""")
panel_17 = Panel("""0
1""")
panel_18 = Panel("""1
1""")
subsrf = Isotrim(Surface=reparameterize(move_5.Geometry), Domain=dom²num)
sdivide = DivideSurface(Surface=move_5.Geometry, UCount=pegboard_hook_u_count, VCount=pegboard_hook_v_count)  # -> Points, Normals, Parameters
move_7 = Move(Geometry=pt_7, Motion=X_5)  # -> Geometry, Transform
move_8 = Move(Geometry=pt_7, Motion=X_6)  # -> Geometry, Transform
cull_8 = CullPattern(List=cabinet_middle_vertical_line_2_3, CullPattern=invert(item_3))
extr_3 = Extrude(Base=move_6.Geometry, Direction=Z_6)
extr_4 = Extrude(Base=ln_2, Direction=X_3)
cull_9 = CullPattern(List=0, CullPattern=item_3)
trim = TrimTree(Tree=sdivide.Points, Depth=1)
cull_10 = CullPattern(List=panel_16, CullPattern=equals_8.Equality)
cull_11 = CullPattern(List=panel_17, CullPattern=equals_9.Equality)
cull_12 = CullPattern(List=panel_18, CullPattern=equals_10.Equality)
ln_3 = Line(StartPoint=move_7.Geometry, EndPoint=pt_7)
ln_4 = Line(StartPoint=move_8.Geometry, EndPoint=pt_7)
merge_3 = Merge(Data1=cull_8, Data2=cull_9)
shift = ShiftList(List=trim, Shift=1, Wrap=True)
extr_5 = Extrude(Base=ln_3, Direction=Y_3)
extr_6 = Extrude(Base=ln_4, Direction=Y_3)
clean_3 = CleanTree(RemoveNulls=True, RemoveInvalid=True, RemoveEmpty=True, Tree=merge_3)
merge_4 = Merge(Data1=cull_10, Data2=cull_11, Data3=cull_12)
extr_7 = Extrude(Base=extr_3, Direction=X_4)
extr_8 = Extrude(Base=extr_4, Direction=Z_5)
clean_4 = CleanTree(RemoveNulls=True, RemoveInvalid=True, RemoveEmpty=True, Tree=merge_4)
move_9 = Move(Geometry=extr_6, Motion=Z_7)  # -> Geometry, Transform
extr_9 = Extrude(Base=extr_5, Direction=Z_7)
extr_10 = Extrude(Base=move_9.Geometry, Direction=Z_8)
sift = SiftPattern(List=shift, SiftPattern=clean_4)  # -> Output0, Output1
subtraction_9 = Subtraction(A=subtraction_6, B=lab_bench_back_horizontal_bar_recess)
addition_5 = Addition(A=lab_bench_front_leg_recess, B=lab_bench_outer_horizontal_frame_thickne)
evalsrf = EvaluateSurface(Surface=reparameterize(move_5.Geometry), Point="0.5,0.5")  # -> Point, Normal, UDirection, VDirection, Frame
addition_6 = Addition(A=addition_2, B=lab_bench_inner_horizontal_frame_thickne)
clean_5 = CleanTree(RemoveNulls=True, RemoveInvalid=True, RemoveEmpty=True, Tree=sift.Output1)
debrep = DeconstructBrep(Brep=extr_10)  # -> Faces, Edges, Vertices
panel_19 = Panel(addition_6)
addition_7 = Addition(A=addition_6, B=lab_bench_front_horizontal_bar_recess)
subtraction_10 = Subtraction(A=dim.UDimension, B=lab_bench_outer_horizontal_frame_thickne)
addition_8 = Addition(A=subtraction_9, B=lab_bench_inner_horizontal_frame_thickne)
panel_20 = Panel(addition_5)
Z_9 = UnitZ(Factor=cabinet_height_from_ground)
X_8 = UnitX(Factor=wall_cabinet_depth)
Y_4 = UnitY(Factor=wall_cabinet_width)
Z_10 = UnitZ(Factor=wall_cabinet_height)
panel_21 = Panel(subtraction_9)
dim_3 = Dimensions(Surface=move_9.Geometry)  # -> UDimension, VDimension
panel_22 = Panel(addition_7)
addition_9 = Addition(A=cabinet_vertical_handle_location_u_2_3_4, B=cabinet_handle_thickness)
incurve = PointInCurve(Point=clean_5, Curve=graft(subsrf))  # -> Relationship, Point
panel_23 = Panel(subtraction_10)
panel_24 = Panel(addition_8)
subtraction_11 = Subtraction(A=subtraction_7, B=cabinet_vertical_handle_location_v_2_3_4)
move_10 = Move(Geometry=pt_4, Motion=Z_9)  # -> Geometry, Transform
X_9 = UnitX(Factor=pegboard_hook_length)
cull_13 = CullPattern(List=clean_5, CullPattern=incurve.Relationship)
subtraction_12 = Subtraction(A=dim_3.VDimension, B=cabinet_thickness)
subtraction_13 = Subtraction(A=dim_3.UDimension, B=cabinet_thickness)
move_11 = Move(Geometry=move_10.Geometry, Motion=X_8)  # -> Geometry, Transform
subtraction_14 = Subtraction(A=subtraction_11, B=cabinet_handle_thickness)
division_5 = Division(A=0, B=dim.UDimension)
division_6 = Division(A=lab_bench_main_structure_thickness, B=dim.UDimension)
division_7 = Division(A=lab_bench_front_leg_recess, B=dim.VDimension)
division_8 = Division(A=addition_2, B=dim.VDimension)
division_9 = Division(A=subtraction_5, B=dim.UDimension)
division_10 = Division(A=dim.UDimension, B=dim.UDimension)
division_11 = Division(A=lab_bench_front_leg_recess, B=dim.VDimension)
division_12 = Division(A=addition_2, B=dim.VDimension)
division_13 = Division(A=0, B=dim.UDimension)
division_14 = Division(A=lab_bench_main_structure_thickness, B=dim.UDimension)
division_15 = Division(A=subtraction_4, B=dim.VDimension)
division_16 = Division(A=subtraction, B=dim.VDimension)
division_17 = Division(A=subtraction_5, B=dim.UDimension)
division_18 = Division(A=dim.UDimension, B=dim.UDimension)
division_19 = Division(A=subtraction_4, B=dim.VDimension)
division_20 = Division(A=subtraction, B=dim.VDimension)
division_21 = Division(A=0, B=dim.UDimension)
division_22 = Division(A=lab_bench_outer_horizontal_frame_thickne, B=dim.UDimension)
division_23 = Division(A=addition_2, B=dim.VDimension)
division_24 = Division(A=subtraction_4, B=dim.VDimension)
division_25 = Division(A=subtraction_10, B=dim.UDimension)
division_26 = Division(A=dim.UDimension, B=dim.UDimension)
division_27 = Division(A=addition_2, B=dim.VDimension)
division_28 = Division(A=subtraction_4, B=dim.VDimension)
division_29 = Division(A=lab_bench_outer_horizontal_frame_thickne, B=dim.UDimension)
division_30 = Division(A=subtraction_10, B=dim.UDimension)
division_31 = Division(A=addition_3, B=dim.VDimension)
division_32 = Division(A=addition_7, B=dim.VDimension)
division_33 = Division(A=subtraction_10, B=dim.UDimension)
division_34 = Division(A=lab_bench_outer_horizontal_frame_thickne, B=dim.UDimension)
division_35 = Division(A=addition_8, B=dim.VDimension)
division_36 = Division(A=subtraction_9, B=dim.VDimension)
division_37 = Division(A=subtraction_5, B=dim.UDimension)
division_38 = Division(A=lab_bench_main_structure_thickness, B=dim.UDimension)
division_39 = Division(A=addition_5, B=dim.VDimension)
division_40 = Division(A=cabinet_thickness, B=dim_3.UDimension)
division_41 = Division(A=subtraction_13, B=dim_3.UDimension)
division_42 = Division(A=subtraction_12, B=dim_3.VDimension)
division_43 = Division(A=lab_bench_front_leg_recess, B=dim.VDimension)
neg_4 = Negative(Value=pegboard_hook_angle)
ln_5 = Line(StartPoint=move_11.Geometry, EndPoint=move_10.Geometry)
dom²num_2 = ConstructDomain²(UMin=division_5, UMax=division_6, VMin=division_7, VMax=division_8)
dom²num_3 = ConstructDomain²(UMin=division_9, UMax=division_10, VMin=division_11, VMax=division_12)
dom²num_4 = ConstructDomain²(UMin=division_13, UMax=division_14, VMin=division_15, VMax=division_16)
multiplication = Multiplication(A=cabinet_thickness, B=2)
move_12 = Move(Geometry=cull_13, Motion=X_9)  # -> Geometry, Transform
dom²num_5 = ConstructDomain²(UMin=division_17, UMax=division_18, VMin=division_19, VMax=division_20)
dom²num_6 = ConstructDomain²(UMin=division_40, UMax=division_41, VMin=division_42, VMax=0)
item_6 = ListItem(List=debrep.Faces, Index=1, Wrap=True)
dom²num_7 = ConstructDomain²(UMin=division_21, UMax=division_22, VMin=division_23, VMax=division_24)
dom²num_8 = ConstructDomain²(UMin=division_25, UMax=division_26, VMin=division_27, VMax=division_28)
dom²num_9 = ConstructDomain²(UMin=division_29, UMax=division_30, VMin=division_31, VMax=division_32)
dom²num_10 = ConstructDomain²(UMin=division_33, UMax=division_34, VMin=division_35, VMax=division_36)
dom²num_11 = ConstructDomain²(UMin=division_37, UMax=division_38, VMin=division_39, VMax=division_43)
extr_11 = Extrude(Base=ln_5, Direction=Y_4)
multiplication_2 = Multiplication(A=wall_cabinet_thickness, B=2)
dim_4 = Dimensions(Surface=extr_11)  # -> UDimension, VDimension
subsrf_2 = Isotrim(Surface=reparameterize(extr), Domain=dom²num_3)
subsrf_3 = Isotrim(Surface=reparameterize(extr), Domain=dom²num_2)
subsrf_4 = Isotrim(Surface=reparameterize(extr), Domain=dom²num_4)
subtraction_15 = Subtraction(A=cabinet_height, B=multiplication)
subsrf_5 = Isotrim(Surface=reparameterize(extr), Domain=dom²num_5)
subsrf_6 = Isotrim(Surface=reparameterize(extr), Domain=dom²num_7)
subsrf_7 = Isotrim(Surface=reparameterize(extr), Domain=dom²num_8)
subsrf_8 = Isotrim(Surface=reparameterize(extr), Domain=dom²num_9)
subsrf_9 = Isotrim(Surface=reparameterize(extr), Domain=dom²num_10)
subsrf_10 = Isotrim(Surface=reparameterize(extr), Domain=dom²num_11)
rot3d = Rotate3D(Geometry=move_12.Geometry, Angle=degrees(neg_4), Center=cull_13, Axis=Vector(0, 1, 0))  # -> Geometry, Transform
subsrf_11 = Isotrim(Surface=reparameterize(move_9.Geometry), Domain=dom²num_6)
Z_11 = UnitZ(Factor=cabinet_thickness)
Z_12 = UnitZ(Factor=subtraction_15)
subtraction_16 = Subtraction(A=dim_4.UDimension, B=wall_cabinet_thickness)
subtraction_17 = Subtraction(A=dim_4.VDimension, B=wall_cabinet_thickness)
subtraction_18 = Subtraction(A=wall_cabinet_height, B=multiplication_2)
ln_6 = Line(StartPoint=cull_13, EndPoint=rot3d.Geometry)
rad = Radians(Degrees=pegboard_hook_angle)
move_13 = Move(Geometry=subsrf_11, Motion=Z_11)  # -> Geometry, Transform
division_44 = Division(A=wall_cabinet_thickness, B=dim_4.UDimension)
division_45 = Division(A=subtraction_16, B=dim_4.UDimension)
division_46 = Division(A=0, B=dim_4.VDimension)
division_47 = Division(A=subtraction_17, B=dim_4.VDimension)
cos = Cosine(Value=rad)
extr_12 = Extrude(Base=move_13.Geometry, Direction=Z_12)
dom²num_12 = ConstructDomain²(UMin=division_44, UMax=division_45, VMin=division_46, VMax=division_47)
dim_5 = Dimensions(Surface=item_6)  # -> UDimension, VDimension
division_48 = Division(A=pegboard_hook_radius, B=cos)
pl = PlaneNormal(Origin=cull_13, ZAxis=evalsrf.Normal)
Z_13 = UnitZ(Factor=wall_cabinet_thickness)
merge_5 = Merge(Data1=subsrf_6, Data2=subsrf_7, Data3=subsrf_8, Data4=subsrf_9, Data5=subsrf_10)
subsrf_12 = Isotrim(Surface=reparameterize(extr_11), Domain=dom²num_12)
Z_14 = UnitZ(Factor=subtraction_18)
sdiff = SolidDifference(BrepsA=extr_10, BrepsB=extr_12)
multiplication_3 = Multiplication(A=dim_5.VDimension, B=clean_3)
subtraction_19 = Subtraction(A=subtraction_14, B=cabinet_handle_lenght)
move_14 = Move(Geometry=subsrf_12, Motion=Z_13)  # -> Geometry, Transform
subtraction_20 = Subtraction(A=dim.UDimension, B=lab_bench_main_structure_thickness)
circle = CircleCNR(Center=rot3d.Geometry, Normal=ln_6, Radius=pegboard_hook_radius)  # -> graft(Circle)
ellipse = Ellipse(Plane=pl, Radius1=pegboard_hook_radius, Radius2=division_48)  # -> graft(Ellipse), Focus1, Focus2
extr_13 = Extrude(Base=extr_11, Direction=Z_10)
extr_14 = Extrude(Base=move_14.Geometry, Direction=Z_14)
subtraction_21 = Subtraction(A=dim.UDimension, B=lab_bench_main_structure_thickness)
addition_10 = Addition(A=cabinet_wheel_offset, B=cabinet_wheel_joint_width)
item_7 = ListItem(List=debrep.Faces, Index=0, Wrap=True)
eval = EvaluateLength(Curve=ellipse.Ellipse, Length=0.25, Normalized=True)  # -> Point, Tangent, Parameter
eval_2 = EvaluateLength(Curve=ellipse.Ellipse, Length=0.75, Normalized=True)  # -> Point, Tangent, Parameter
sph = Sphere(Base=circle, Radius=pegboard_hook_radius)
division_49 = Division(A=subtraction_20, B=lab_bench_shelf_horizontal_division_numb)
ma = MassAddition(Input=drawer_heights_for_type_1)  # -> Result, PartialResults
num = Number(cabinet_height)
neg_5 = Negative(Value=pegboard_hook_joint_lower_horizontal_sca)
neg_6 = Negative(Value=pegboard_hook_joint_upper_horizontal_sca)
neg_7 = Negative(Value=pegboard_hook_joint_upper_vertical_scale_2)
neg_8 = Negative(Value=pegboard_hook_joint_upper_vertical_scale_2)
merge_6 = Merge(Data1=subsrf_3, Data2=subsrf_4, Data3=subsrf_2, Data4=subsrf_5)
split = SplitBrep(Brep=sph, Cutter=circle)
loft = Loft(
    Curves=[ellipse.Ellipse, circle],
    Options={Adjust=True, Closed=False, LoftEnds=0, LoftSimp=0, LoftType=0, Rebuild=10, Refit=0.01})  # -> simplify(Loft)
division_50 = Division(A=subtraction_21, B=lab_bench_shelf_horizontal_division_numb)
debrep_2 = DeconstructBrep(Brep=extr_13)  # -> Faces, Edges, Vertices
sdiff_2 = SolidDifference(BrepsA=extr_13, BrepsB=extr_14)
Z_15 = UnitZ(Factor=pegboard_hook_joint_upper_vertical_scale)
Y_5 = UnitY(Factor=pegboard_hook_joint_upper_horizontal_sca)
Z_16 = UnitZ(Factor=pegboard_hook_joint_upper_vertical_scale)
Y_6 = UnitY(Factor=neg_6)
Z_17 = UnitZ(Factor=neg_8)
Y_7 = UnitY(Factor=pegboard_hook_joint_lower_horizontal_sca)
Z_18 = UnitZ(Factor=neg_7)
Y_8 = UnitY(Factor=neg_5)
item_8 = ListItem(List=division_49, Index=0, Wrap=True)
item_9 = ListItem(List=split, Index=0, Wrap=True)  # -> simplify(Item)
subtraction_22 = Subtraction(A=lab_bench_shelf_horizontal_division_numb, B=1)
addition_11 = Addition(A=Z_18, B=Y_8)
item_10 = ListItem(List=division_50, Index=0, Wrap=True)
addition_12 = Addition(A=multiplication_3, B=addition_9)
merge_7 = Merge(Data1=extr_7, Data2=extr_8)
addition_13 = Addition(A=Z_17, B=Y_7)
extr_15 = Extrude(Base=extr_2, Direction=X_2)
addition_14 = Addition(A=Z_15, B=Y_5)
addition_15 = Addition(A=Z_16, B=Y_6)
subtraction_23 = Subtraction(A=multiplication_3, B=addition_9)
subtraction_24 = Subtraction(A=dim.UDimension, B=lab_bench_main_structure_thickness)
item_11 = ListItem(List=debrep_2.Faces, Index=1, Wrap=True)
join = BrepJoin(Breps=[item_9, loft])  # -> Breps, Closed
subtraction_25 = Subtraction(A=addition_12, B=cabinet_handle_thickness)
division_51 = Division(A=cabinet_base_height, B=4)
subtraction_26 = Subtraction(A=dim.UDimension, B=lab_bench_main_structure_thickness)
series_5 = Series(Start=item_8, Step=item_8, Count=subtraction_22)  # -> graft(Series)
addition_16 = Addition(A=subtraction_23, B=cabinet_handle_thickness)
dim_6 = Dimensions(Surface=item_7)  # -> UDimension, VDimension
dim_7 = Dimensions(Surface=item_7)  # -> UDimension, VDimension
dim_8 = Dimensions(Surface=item_7)  # -> UDimension, VDimension
dim_9 = Dimensions(Surface=item_7)  # -> UDimension, VDimension
move_15 = Move(Geometry=eval.Point, Motion=addition_14)  # -> graft(Geometry), Transform
move_16 = Move(Geometry=eval.Point, Motion=addition_15)  # -> graft(Geometry), Transform
move_17 = Move(Geometry=eval_2.Point, Motion=addition_13)  # -> graft(Geometry), Transform
move_18 = Move(Geometry=eval_2.Point, Motion=addition_11)  # -> graft(Geometry), Transform
cap = CapHoles(Brep=join.Breps)
multiplication_4 = Multiplication(A=division_51, B=2.75)
series_6 = Series(Start=lab_bench_main_structure_thickness, Step=item_10, Count=lab_bench_shelf_horizontal_division_numb)  # -> graft(Series)
series_7 = Series(Start=item_10, Step=item_10, Count=lab_bench_shelf_horizontal_division_numb)  # -> graft(Series)
subtraction_27 = Subtraction(A=lab_bench_height, B=lab_bench_counter_thickness)
addition_17 = Addition(A=series_5, B=lab_bench_main_structure_thickness)
division_52 = Division(A=subtraction_24, B=lab_bench_shelf_horizontal_division_numb)
dim_10 = Dimensions(Surface=subsrf_3)  # -> UDimension, VDimension
area = Area(Geometry=subsrf_3)  # -> Area, Centroid
dim_11 = Dimensions(Surface=subsrf_4)  # -> UDimension, VDimension
area_2 = Area(Geometry=subsrf_2)  # -> Area, Centroid
num_2 = Number(multiplication_4)
dim_12 = Dimensions(Surface=subsrf_2)  # -> UDimension, VDimension
area_3 = Area(Geometry=subsrf_4)  # -> Area, Centroid
dim_13 = Dimensions(Surface=subsrf_5)  # -> UDimension, VDimension
area_4 = Area(Geometry=subsrf_5)  # -> Area, Centroid
division_53 = Division(A=subtraction_26, B=lab_bench_shelf_horizontal_division_numb)
intcrv = Interpolate(Vertices=[move_15.Geometry, move_17.Geometry, move_18.Geometry, move_16.Geometry], Degree=3, Periodic=True, KnotStyle=1)  # -> Curve, Length, Domain
dom²num_13 = ConstructDomain²(UMin=0, UMax=1, VMin=0, VMax=wall_cabinet_middle_vertical_line)
dom²num_14 = ConstructDomain²(UMin=0, UMax=1, VMin=wall_cabinet_middle_vertical_line, VMax=1)
X_10 = UnitX(Factor=pegboard_hook_joint_thickness)
merge_8 = Merge(Data1=0, Data2=ma.PartialResults)
move_19 = Move(Geometry=cap, Motion=X_10)  # -> Geometry, Transform
item_12 = ListItem(List=division_52, Index=0, Wrap=True)
srf = Surface(intcrv.Curve)
division_54 = Division(A=series_5, B=dim.UDimension)
division_55 = Division(A=addition_17, B=dim.UDimension)
division_56 = Division(A=subtraction, B=dim.VDimension)
division_57 = Division(A=subtraction_4, B=dim.VDimension)
division_58 = Division(A=series_6, B=dim.UDimension)
division_59 = Division(A=series_7, B=dim.UDimension)
division_60 = Division(A=subtraction, B=dim.VDimension)
division_61 = Division(A=subtraction_4, B=dim.VDimension)
merge_9 = Merge(Data1=ma.PartialResults, Data2=num)
item_13 = ListItem(List=division_53, Index=0, Wrap=True)
division_62 = Division(A=lab_bench_leg_extension_thickness, B=dim_10.UDimension)
division_63 = Division(A=lab_bench_leg_extension_thickness, B=dim_11.UDimension)
division_64 = Division(A=lab_bench_leg_extension_thickness, B=dim_12.UDimension)
sort = SortList(Keys=merge_8, ValuesA=merge_8)  # -> Keys, ValuesA
dim_14 = Dimensions(Surface=item_6)  # -> UDimension, VDimension
dom²num_15 = ConstructDomain²(UMin=division_54, UMax=division_55, VMin=division_56, VMax=division_57)
division_65 = Division(A=lab_bench_leg_extension_thickness, B=dim_13.UDimension)
extr_16 = Extrude(Base=srf, Direction=X_10)  # -> simplify(Extrusion)
sort_2 = SortList(Keys=merge_9, ValuesA=merge_9)  # -> Keys, ValuesA
dom²num_16 = ConstructDomain²(UMin=division_58, UMax=division_59, VMin=division_60, VMax=division_61)
subtraction_28 = Subtraction(A=dim_7.UDimension, B=cabinet_wheel_offset)
subtraction_29 = Subtraction(A=dim_7.UDimension, B=addition_10)
subtraction_30 = Subtraction(A=dim_7.VDimension, B=cabinet_wheel_offset)
subtraction_31 = Subtraction(A=num, B=sort.ValuesA)
dim_15 = Dimensions(Surface=item_6)  # -> UDimension, VDimension
dim_16 = Dimensions(Surface=item_6)  # -> UDimension, VDimension
dim_17 = Dimensions(Surface=item_6)  # -> UDimension, VDimension
dim_18 = Dimensions(Surface=item_6)  # -> UDimension, VDimension
dim_19 = Dimensions(Surface=item_6)  # -> UDimension, VDimension
dim_20 = Dimensions(Surface=item_6)  # -> UDimension, VDimension
dim_21 = Dimensions(Surface=item_6)  # -> UDimension, VDimension
dim_22 = Dimensions(Surface=item_6)  # -> UDimension, VDimension
dim_23 = Dimensions(Surface=item_6)  # -> UDimension, VDimension
dim_24 = Dimensions(Surface=item_6)  # -> UDimension, VDimension
dim_25 = Dimensions(Surface=item_6)  # -> UDimension, VDimension
subtraction_32 = Subtraction(A=num, B=sort_2.ValuesA)
scale = Scale(Geometry=subsrf_4, Center=area_3.Centroid, Factor=division_63)  # -> Geometry, Transform
scale_2 = Scale(Geometry=subsrf_3, Center=area.Centroid, Factor=division_62)  # -> Geometry, Transform
scale_3 = Scale(Geometry=subsrf_2, Center=area_2.Centroid, Factor=division_64)  # -> Geometry, Transform
subsrf_13 = Isotrim(Surface=reparameterize(item_11), Domain=dom²num_13)
subsrf_14 = Isotrim(Surface=reparameterize(item_11), Domain=dom²num_14)
addition_18 = Addition(A=lab_bench_height, B=lab_bench_shelf_lower_bar_height)
subtraction_33 = Subtraction(A=lab_bench_shelf_vertical_structure_heigh, B=lab_bench_counter_thickness)
addition_19 = Addition(A=lab_bench_shelf_lower_bar_height_from_co, B=lab_bench_shelf_lower_bar_height)
division_66 = Division(A=lab_bench_main_structure_thickness, B=dim.UDimension)
division_67 = Division(A=subtraction_5, B=dim.UDimension)
division_68 = Division(A=subtraction_4, B=dim.VDimension)
division_69 = Division(A=subtraction, B=dim.VDimension)
series_8 = Series(Start=lab_bench_main_structure_thickness, Step=item_12, Count=lab_bench_shelf_horizontal_division_numb)  # -> graft(Series)
series_9 = Series(Start=item_12, Step=item_12, Count=lab_bench_shelf_horizontal_division_numb)  # -> graft(Series)
subtraction_34 = Subtraction(A=lab_bench_width, B=lab_bench_top_shelf_depth)
scale_4 = Scale(Geometry=subsrf_5, Center=area_4.Centroid, Factor=division_65)  # -> Geometry, Transform
addition_20 = Addition(A=lab_bench_shelf_vertical_structure_heigh, B=subtraction_27)
subtraction_35 = Subtraction(A=lab_bench_width, B=lab_bench_shelf_depth)
mesh = Mesh(flatten(move_19.Geometry))
mesh_2 = Mesh(flatten(merge_7))
series_10 = Series(Start=lab_bench_main_structure_thickness, Step=item_13, Count=lab_bench_shelf_horizontal_division_numb)  # -> graft(Series)
series_11 = Series(Start=item_13, Step=item_13, Count=lab_bench_shelf_horizontal_division_numb)  # -> graft(Series)
larger = LargerThan(FirstNumber=subtraction_32, SecondNumber=0)  # -> LargerThan, OrEqualTo
larger_2 = LargerThan(FirstNumber=subtraction_31, SecondNumber=0)  # -> LargerThan, OrEqualTo
addition_21 = Addition(A=cabinet_wheel_offset, B=cabinet_wheel_joint_lenght)
subtraction_36 = Subtraction(A=subtraction_30, B=cabinet_wheel_joint_lenght)
subsrf_15 = Isotrim(Surface=reparameterize(extr), Domain=dom²num_16)
dom²num_17 = ConstructDomain²(UMin=division_66, UMax=division_67, VMin=division_68, VMax=division_69)
mjoin = MeshJoin(Meshes=mesh)
mjoin_2 = MeshJoin(Meshes=mesh_2)
filedge = FilletEdge(Shape=extr_16, Blend=0, Metric=0, Edges="1", Radii=pegboard_hook_joint_fillet)
num_3 = Number(cabinet_handle_lenght)
num_4 = Number(cabinet_handle_lenght)
cull_14 = CullPattern(List=subtraction_32, CullPattern=larger.OrEqualTo)
subtraction_37 = Subtraction(A=addition_20, B=lab_bench_shelf_thickness)
cull_15 = CullPattern(List=subtraction_31, CullPattern=larger_2.OrEqualTo)
division_70 = Division(A=series_8, B=dim.UDimension)
division_71 = Division(A=series_9, B=dim.UDimension)
division_72 = Division(A=subtraction_34, B=dim.VDimension)
division_73 = Division(A=lab_bench_width, B=dim.VDimension)
dim_26 = Dimensions(Surface=subsrf_14)  # -> UDimension, VDimension
dim_27 = Dimensions(Surface=subsrf_13)  # -> UDimension, VDimension
Z_19 = UnitZ(Factor=addition_18)
subsrf_16 = Isotrim(Surface=reparameterize(extr), Domain=dom²num_17)
division_74 = Division(A=series_10, B=dim.UDimension)
division_75 = Division(A=series_11, B=dim.UDimension)
division_76 = Division(A=subtraction_35, B=dim.VDimension)
division_77 = Division(A=lab_bench_width, B=dim.VDimension)
Z_20 = UnitZ(Factor=subtraction_37)
swatch = ColourSwatch(SwatchColor=RGB(74, 74, 74))
swatch_2 = ColourSwatch(SwatchColor=RGB(140, 105, 105))
swatch_3 = ColourSwatch(SwatchColor=RGB(224, 192, 103))
swatch_4 = ColourSwatch(SwatchColor=RGB(158, 156, 152))
mesh_3 = Mesh(flatten(filedge))
mesh_4 = Mesh(flatten(extr_15))
Z_21 = UnitZ(Factor=lab_bench_height)
subtraction_38 = Subtraction(A=lab_bench_height, B=lab_bench_counter_thickness)
subtraction_39 = Subtraction(A=lab_bench_shelf_vertical_division_number, B=1)
dom²num_18 = ConstructDomain²(UMin=division_70, UMax=division_71, VMin=division_72, VMax=division_73)
subtraction_40 = Subtraction(A=subtraction_11, B=num_3)
subtraction_41 = Subtraction(A=subtraction_14, B=num_3)
subtraction_42 = Subtraction(A=subtraction_14, B=num_4)
subtraction_43 = Subtraction(A=subtraction_11, B=num_4)
merge_10 = Merge(Data1=subsrf_4, Data2=subsrf_5)
subsrf_17 = Isotrim(Surface=reparameterize(extr), Domain=dom²num_15)
subtraction_44 = Subtraction(A=subtraction_33, B=addition_19)
division_78 = Division(A=subtraction_44, B=lab_bench_shelf_vertical_division_number)
dom²num_19 = ConstructDomain²(UMin=division_74, UMax=division_75, VMin=division_76, VMax=division_77)
merge_11 = Merge(Data1=scale_2.Geometry, Data2=scale.Geometry, Data3=scale_3.Geometry, Data4=scale_4.Geometry)
Z_22 = UnitZ(Factor=lab_bench_shelf_lower_bar_height_from_co)
Z_23 = UnitZ(Factor=lab_bench_shelf_lower_bar_height)
mjoin_3 = MeshJoin(Meshes=mesh_3)
Z_24 = UnitZ(Factor=subtraction_38)
mjoin_4 = MeshJoin(Meshes=mesh_4)
move_20 = Move(Geometry=subsrf_16, Motion=Z_21)  # -> Geometry, Transform
series_12 = Series(Start=division_78, Step=division_78, Count=subtraction_39)
move_21 = Move(Geometry=subsrf_15, Motion=Z_20)  # -> Geometry, Transform
neg_9 = Negative(Value=lab_bench_main_structure_thickness)
division_79 = Division(A=cull_14, B=dim_14.UDimension)
division_80 = Division(A=cull_15, B=dim_14.UDimension)
division_81 = Division(A=0, B=dim_14.VDimension)
division_82 = Division(A=dim_14.VDimension, B=dim_14.VDimension)
division_83 = Division(A=0, B=dim_15.UDimension)
division_84 = Division(A=subtraction_7, B=dim_15.UDimension)
division_85 = Division(A=0, B=dim_15.VDimension)
division_86 = Division(A=0, B=dim_16.UDimension)
division_87 = Division(A=subtraction_7, B=dim_16.UDimension)
division_88 = Division(A=dim_16.VDimension, B=dim_16.VDimension)
division_89 = Division(A=subtraction_7, B=dim_17.UDimension)
division_90 = Division(A=dim_17.UDimension, B=dim_17.UDimension)
division_91 = Division(A=0, B=dim_17.VDimension)
division_92 = Division(A=dim_17.VDimension, B=dim_17.VDimension)
division_93 = Division(A=subtraction_7, B=dim_18.UDimension)
division_94 = Division(A=dim_18.UDimension, B=dim_18.UDimension)
division_95 = Division(A=0, B=dim_18.VDimension)
division_96 = Division(A=dim_18.VDimension, B=dim_18.VDimension)
division_97 = Division(A=subtraction_7, B=dim_19.UDimension)
division_98 = Division(A=dim_19.UDimension, B=dim_19.UDimension)
division_99 = Division(A=dim_19.VDimension, B=dim_19.VDimension)
division_100 = Division(A=subtraction_11, B=dim_20.UDimension)
division_101 = Division(A=subtraction_14, B=dim_20.UDimension)
division_102 = Division(A=subtraction_23, B=dim_20.VDimension)
division_103 = Division(A=addition_16, B=dim_20.VDimension)
division_104 = Division(A=subtraction_40, B=dim_21.UDimension)
division_105 = Division(A=subtraction_41, B=dim_21.UDimension)
division_106 = Division(A=subtraction_23, B=dim_21.VDimension)
division_107 = Division(A=addition_16, B=dim_21.VDimension)
division_108 = Division(A=subtraction_11, B=dim_22.UDimension)
division_109 = Division(A=subtraction_19, B=dim_22.UDimension)
division_110 = Division(A=subtraction_23, B=dim_22.VDimension)
division_111 = Division(A=addition_16, B=dim_22.VDimension)
division_112 = Division(A=subtraction_14, B=dim_23.UDimension)
division_113 = Division(A=subtraction_11, B=dim_23.UDimension)
division_114 = Division(A=subtraction_25, B=dim_23.VDimension)
division_115 = Division(A=addition_12, B=dim_23.VDimension)
division_116 = Division(A=subtraction_42, B=dim_24.UDimension)
division_117 = Division(A=subtraction_43, B=dim_24.UDimension)
division_118 = Division(A=subtraction_25, B=dim_24.VDimension)
division_119 = Division(A=addition_12, B=dim_24.VDimension)
division_120 = Division(A=subtraction_11, B=dim_25.UDimension)
division_121 = Division(A=subtraction_19, B=dim_25.UDimension)
division_122 = Division(A=subtraction_25, B=dim_25.VDimension)
division_123 = Division(A=addition_12, B=dim_25.VDimension)
division_124 = Division(A=cabinet_wheel_offset, B=dim_6.UDimension)
division_125 = Division(A=addition_10, B=dim_6.UDimension)
division_126 = Division(A=addition_21, B=dim_6.VDimension)
division_127 = Division(A=cabinet_wheel_offset, B=dim_6.VDimension)
division_128 = Division(A=subtraction_28, B=dim_7.UDimension)
division_129 = Division(A=subtraction_29, B=dim_7.UDimension)
division_130 = Division(A=subtraction_30, B=dim_7.VDimension)
division_131 = Division(A=subtraction_36, B=dim_7.VDimension)
division_132 = Division(A=subtraction_29, B=dim_8.UDimension)
division_133 = Division(A=subtraction_28, B=dim_8.UDimension)
division_134 = Division(A=cabinet_wheel_offset, B=dim_8.VDimension)
division_135 = Division(A=addition_21, B=dim_8.VDimension)
division_136 = Division(A=cabinet_wheel_offset, B=dim_9.UDimension)
division_137 = Division(A=addition_10, B=dim_9.UDimension)
division_138 = Division(A=subtraction_30, B=dim_9.VDimension)
division_139 = Division(A=subtraction_36, B=dim_9.VDimension)
division_140 = Division(A=cabinet_wheel_joint_lenght, B=2)
move_22 = Move(Geometry=subsrf_17, Motion=Z_19)  # -> Geometry, Transform
subsrf_18 = Isotrim(Surface=reparameterize(extr), Domain=dom²num_18)
move_23 = Move(Geometry=move_20.Geometry, Motion=Z_22)  # -> Geometry, Transform
subtraction_45 = Subtraction(A=dim_27.VDimension, B=wall_cabinet_panel_offset_1)
subtraction_46 = Subtraction(A=dim_26.VDimension, B=wall_cabinet_panel_offset_1)
Z_25 = UnitZ(Factor=lab_bench_shelf_lower_bar_height_from_co)
subtraction_47 = Subtraction(A=dim_27.UDimension, B=wall_cabinet_panel_offset_1)
subtraction_48 = Subtraction(A=dim_26.UDimension, B=wall_cabinet_panel_offset_1)
preview = CustomPreview(Geometry=filedge, Material=swatch_4)
preview_2 = CustomPreview(Geometry=move_19.Geometry, Material=swatch)
preview_3 = CustomPreview(Geometry=merge_7, Material=swatch_2)
preview_4 = CustomPreview(Geometry=extr_15, Material=swatch_3)
Z_26 = UnitZ(Factor=lab_bench_shelf_vertical_structure_heigh)
move_24 = Move(Geometry=merge_10, Motion=Z_24)  # -> Geometry, Transform
subsrf_19 = Isotrim(Surface=reparameterize(extr), Domain=dom²num_19)
addition_22 = Addition(A=addition_18, B=lab_bench_shelf_lower_bar_height_from_co)
dom²num_20 = ConstructDomain²(UMin=division_79, UMax=division_80, VMin=division_81, VMax=division_82)
dom²num_21 = ConstructDomain²(UMin=division_83, UMax=division_84, VMin=division_85, VMax=clean_3)
dom²num_22 = ConstructDomain²(UMin=division_86, UMax=division_87, VMin=clean_3, VMax=division_88)
dom²num_23 = ConstructDomain²(UMin=division_89, UMax=division_90, VMin=division_91, VMax=division_92)
dom²num_24 = ConstructDomain²(UMin=division_93, UMax=division_94, VMin=division_95, VMax=clean_3)
dom²num_25 = ConstructDomain²(UMin=division_97, UMax=division_98, VMin=clean_3, VMax=division_99)
dom²num_26 = ConstructDomain²(UMin=division_104, UMax=division_105, VMin=division_106, VMax=division_107)
dom²num_27 = ConstructDomain²(UMin=division_108, UMax=division_109, VMin=division_110, VMax=division_111)
dom²num_28 = ConstructDomain²(UMin=division_112, UMax=division_113, VMin=division_114, VMax=division_115)
dom²num_29 = ConstructDomain²(UMin=division_116, UMax=division_117, VMin=division_118, VMax=division_119)
dom²num_30 = ConstructDomain²(UMin=division_120, UMax=division_121, VMin=division_122, VMax=division_123)
Z_27 = UnitZ(Factor=neg_9)
dom²num_31 = ConstructDomain²(UMin=division_100, UMax=division_101, VMin=division_102, VMax=division_103)
dom²num_32 = ConstructDomain²(UMin=division_124, UMax=division_125, VMin=division_126, VMax=division_127)
dom²num_33 = ConstructDomain²(UMin=division_128, UMax=division_129, VMin=division_130, VMax=division_131)
dom²num_34 = ConstructDomain²(UMin=division_132, UMax=division_133, VMin=division_134, VMax=division_135)
dom²num_35 = ConstructDomain²(UMin=division_136, UMax=division_137, VMin=division_138, VMax=division_139)
division_141 = Division(A=wall_cabinet_panel_offset_1, B=dim_27.UDimension)
division_142 = Division(A=subtraction_47, B=dim_27.UDimension)
division_143 = Division(A=wall_cabinet_panel_offset_1, B=dim_27.VDimension)
division_144 = Division(A=subtraction_45, B=dim_27.VDimension)
division_145 = Division(A=wall_cabinet_panel_offset_1, B=dim_26.UDimension)
division_146 = Division(A=subtraction_48, B=dim_26.UDimension)
division_147 = Division(A=wall_cabinet_panel_offset_1, B=dim_26.VDimension)
division_148 = Division(A=subtraction_46, B=dim_26.VDimension)
move_25 = Move(Geometry=move_22.Geometry, Motion=Z_25)  # -> Geometry, Transform
division_149 = Division(A=num_2, B=division_140)
Z_28 = UnitZ(Factor=subtraction_44)
subsrf_20 = Isotrim(Surface=reparameterize(item_6), Domain=dom²num_20)
sqr = Square(Value=division_149)
subtraction_49 = Subtraction(A=cabinet_base_height, B=cabinet_wheel_joint_height)
subsrf_21 = Isotrim(Surface=reparameterize(item_6), Domain=dom²num_21)
subsrf_22 = Isotrim(Surface=reparameterize(item_6), Domain=dom²num_22)
subsrf_23 = Isotrim(Surface=reparameterize(item_6), Domain=dom²num_23)
subsrf_24 = Isotrim(Surface=reparameterize(item_6), Domain=dom²num_24)
subsrf_25 = Isotrim(Surface=reparameterize(item_6), Domain=dom²num_25)
subsrf_26 = Isotrim(Surface=reparameterize(item_6), Domain=dom²num_31)
subsrf_27 = Isotrim(Surface=reparameterize(item_6), Domain=dom²num_26)
subsrf_28 = Isotrim(Surface=reparameterize(item_6), Domain=dom²num_28)
subsrf_29 = Isotrim(Surface=reparameterize(item_6), Domain=dom²num_29)
subsrf_30 = Isotrim(Surface=reparameterize(item_6), Domain=dom²num_30)
subsrf_31 = Isotrim(Surface=reparameterize(item_7), Domain=dom²num_32)
subsrf_32 = Isotrim(Surface=reparameterize(item_7), Domain=dom²num_33)
subsrf_33 = Isotrim(Surface=reparameterize(item_7), Domain=dom²num_34)
subsrf_34 = Isotrim(Surface=reparameterize(item_7), Domain=dom²num_35)
dom²num_36 = ConstructDomain²(UMin=division_141, UMax=division_142, VMin=division_143, VMax=division_144)
dom²num_37 = ConstructDomain²(UMin=division_145, UMax=division_146, VMin=division_147, VMax=division_148)
addition_23 = Addition(A=sqr, B=1)
subtraction_50 = Subtraction(A=subtraction_49, B=num_2)
addition_24 = Addition(A=series_12, B=addition_22)
extr_17 = Extrude(Base=move_21.Geometry, Direction=Z_27)
sqrt = SquareRoot(Value=addition_23)
extr_18 = Extrude(Base=move_25.Geometry, Direction=Z_28)
Z_29 = UnitZ(Factor=addition_24)
Z_30 = UnitZ(Factor=addition_22)
extr_19 = Extrude(Base=move_23.Geometry, Direction=Z_23)
extr_20 = Extrude(Base=move_24.Geometry, Direction=Z_26)
cull_16 = CullPattern(List=subsrf_24, CullPattern=invert(item))
cull_17 = CullPattern(List=subsrf_25, CullPattern=invert(item))
multiplication_5 = Multiplication(A=sqrt, B=cabinet_wheel_joint_fillet_radius)
cull_18 = CullPattern(List=subsrf_23, CullPattern=item)
subsrf_35 = Isotrim(Surface=reparameterize(subsrf_13), Domain=dom²num_36)
subsrf_36 = Isotrim(Surface=reparameterize(subsrf_14), Domain=dom²num_37)
move_26 = Move(Geometry=graft(subsrf_19), Motion=Z_29)  # -> Geometry, Transform
division_150 = Division(A=lab_bench_shelf_thickness, B=2)
move_27 = Move(Geometry=subsrf_19, Motion=Z_30)  # -> Geometry, Transform
addition_25 = Addition(A=multiplication_5, B=subtraction_50)
subsrf_37 = Isotrim(Surface=reparameterize(item_6), Domain=dom²num_27)
Z_31 = UnitZ(Factor=division_150)
merge_12 = Merge(Data1=subsrf_26, Data2=subsrf_27)
srfsplit = SurfaceSplit(Surface=subsrf_13, Curves=subsrf_35)
srfsplit_2 = SurfaceSplit(Surface=subsrf_14, Curves=subsrf_36)
merge_13 = Merge(Data1=subsrf_28, Data2=subsrf_29)
merge_14 = Merge(Data1=cull_18, Data2=cull_16, Data3=cull_17)
Z_32 = UnitZ(Factor=lab_bench_shelf_thickness)
neg_10 = Negative(Value=lab_bench_shelf_thickness)
move_28 = Move(Geometry=move_26.Geometry, Motion=Z_31)  # -> Geometry, Transform
item_14 = ListItem(List=srfsplit, Index=0, Wrap=True)
item_15 = ListItem(List=srfsplit_2, Index=0, Wrap=True)
merge_15 = Merge(Data1=subsrf_31, Data2=subsrf_32, Data3=subsrf_33, Data4=subsrf_34)
Z_33 = UnitZ(Factor=cabinet_wheel_joint_height)
clean_6 = CleanTree(RemoveNulls=True, RemoveInvalid=True, RemoveEmpty=True, Tree=merge_14)
circle_2 = CircleCNR(Center=area.Centroid, Normal=Vector(0, 0, 1), Radius=lab_bench_bottom_disk_radius)
circle_3 = CircleCNR(Center=area_3.Centroid, Normal=Vector(0, 0, 1), Radius=lab_bench_bottom_disk_radius)
circle_4 = CircleCNR(Center=area_2.Centroid, Normal=Vector(0, 0, 1), Radius=lab_bench_bottom_disk_radius)
circle_5 = CircleCNR(Center=area_4.Centroid, Normal=Vector(0, 0, 1), Radius=lab_bench_bottom_disk_radius)
neg_11 = Negative(Value=Z_32)
Z_34 = UnitZ(Factor=lab_bench_bottom_disk_thickness)
Z_35 = UnitZ(Factor=lab_bench_bottom_disk_thickness)
Z_36 = UnitZ(Factor=lab_bench_bottom_disk_thickness)
Z_37 = UnitZ(Factor=lab_bench_bottom_disk_thickness)
merge_16 = Merge(Data1=subsrf_35, Data2=subsrf_36)
merge_17 = Merge(Data1=item_14, Data2=item_15)
srf_2 = Surface(circle_2)
addition_26 = Addition(A=lab_bench_bottom_disk_thickness, B=lab_bench_bottom_disk_joint_thickness)
srf_3 = Surface(circle_3)
srf_4 = Surface(circle_4)
srf_5 = Surface(circle_5)
X_11 = UnitX(Factor=cabinet_handle_depth)
neg_12 = Negative(Value=Z_33)
Z_38 = UnitZ(Factor=addition_20)
move_29 = Move(Geometry=area.Centroid, Motion=Z_34)  # -> Geometry, Transform
move_30 = Move(Geometry=area_3.Centroid, Motion=Z_35)  # -> Geometry, Transform
move_31 = Move(Geometry=area_2.Centroid, Motion=Z_36)  # -> Geometry, Transform
move_32 = Move(Geometry=area_4.Centroid, Motion=Z_37)  # -> Geometry, Transform
move_33 = Move(Geometry=merge_15, Motion=neg_12)  # -> Geometry, Transform
extr_21 = Extrude(Base=merge_15, Direction=neg_12)
move_34 = Move(Geometry=subsrf_18, Motion=Z_38)  # -> Geometry, Transform
Z_39 = UnitZ(Factor=lab_bench_shelf_thickness)
move_35 = Move(Geometry=merge_12, Motion=X_7)  # -> Geometry, Transform
move_36 = Move(Geometry=subsrf_37, Motion=X_7)  # -> Geometry, Transform
Z_40 = UnitZ(Factor=num_2)
move_37 = Move(Geometry=merge_13, Motion=X_7)  # -> Geometry, Transform
move_38 = Move(Geometry=subsrf_30, Motion=X_7)  # -> Geometry, Transform
circle_6 = CircleCNR(Center=move_29.Geometry, Normal=Vector(0, 0, 1), Radius=lab_bench_bottom_disk_joint_radius)
debrep_3 = DeconstructBrep(Brep=move_33.Geometry)  # -> Faces, Edges, Vertices
circle_7 = CircleCNR(Center=move_30.Geometry, Normal=Vector(0, 0, 1), Radius=lab_bench_bottom_disk_joint_radius)
circle_8 = CircleCNR(Center=move_31.Geometry, Normal=Vector(0, 0, 1), Radius=lab_bench_bottom_disk_joint_radius)
circle_9 = CircleCNR(Center=move_32.Geometry, Normal=Vector(0, 0, 1), Radius=lab_bench_bottom_disk_joint_radius)
Z_41 = UnitZ(Factor=addition_26)
merge_18 = Merge(Data1=subsrf_13, Data2=subsrf_14)
X_12 = UnitX(Factor=wall_cabinet_panel_thickness)
X_13 = UnitX(Factor=wall_cabinet_glass_thickness_1)
subtraction_51 = Subtraction(A=lab_bench_leg_extension_height, B=addition_26)
neg_13 = Negative(Value=Z_39)
neg_14 = Negative(Value=Z_40)
neg_15 = Negative(Value=Z_40)
merge_19 = Merge(Data1=subsrf_21, Data2=subsrf_22, Data3=clean_6)
Z_42 = UnitZ(Factor=lab_bench_bottom_disk_joint_thickness)
merge_20 = Merge(Data1=extr_17, Data2=extr_18, Data3=extr_19, Data4=extr_20)
Z_43 = UnitZ(Factor=lab_bench_bottom_disk_joint_thickness)
Z_44 = UnitZ(Factor=lab_bench_bottom_disk_joint_thickness)
Z_45 = UnitZ(Factor=lab_bench_bottom_disk_joint_thickness)
srf_6 = Surface(circle_6)
srf_7 = Surface(circle_7)
srf_8 = Surface(circle_8)
srf_9 = Surface(circle_9)
move_39 = Move(Geometry=merge_11, Motion=Z_41)  # -> Geometry, Transform
Z_46 = UnitZ(Factor=subtraction_51)
item_16 = ListItem(List=debrep_3.Edges, Index=1, Wrap=True)
item_17 = ListItem(List=debrep_3.Edges, Index=3, Wrap=True)
extr_22 = Extrude(Base=move_28.Geometry, Direction=neg_11)
extr_23 = Extrude(Base=move_27.Geometry, Direction=Z_32)
extr_24 = Extrude(Base=move_34.Geometry, Direction=neg_13)
extr_25 = Extrude(Base=merge_18, Direction=X_12)
extr_26 = Extrude(Base=merge_17, Direction=X_12)
extr_27 = Extrude(Base=merge_16, Direction=X_13)
extr_28 = Extrude(Base=srf_6, Direction=Z_42)
extr_29 = Extrude(Base=srf_2, Direction=Z_34)
extr_30 = Extrude(Base=srf_7, Direction=Z_43)
extr_31 = Extrude(Base=srf_3, Direction=Z_35)
extr_32 = Extrude(Base=srf_8, Direction=Z_44)
extr_33 = Extrude(Base=srf_4, Direction=Z_36)
extr_34 = Extrude(Base=srf_9, Direction=Z_45)
extr_35 = Extrude(Base=srf_5, Direction=Z_37)
eval_3 = EvaluateLength(Curve=item_16, Length=0.5, Normalized=True)  # -> Point, Tangent, Parameter
eval_4 = EvaluateLength(Curve=item_17, Length=0.5, Normalized=True)  # -> Point, Tangent, Parameter
merge_21 = Merge(Data1=extr_28, Data2=extr_29)
merge_22 = Merge(Data1=extr_30, Data2=extr_31)
merge_23 = Merge(Data1=extr_32, Data2=extr_33)
merge_24 = Merge(Data1=extr_34, Data2=extr_35)
move_40 = Move(Geometry=eval_3.Point, Motion=neg_14)  # -> Geometry, Transform
move_41 = Move(Geometry=eval_4.Point, Motion=neg_15)  # -> Geometry, Transform
X_14 = UnitX(Factor=cabinet_handle_thickness)
subtraction_52 = Subtraction(A=wall_cabinet_type, B=1)
move_42 = Move(Geometry=move_36.Geometry, Motion=X_11)  # -> Geometry, Transform
extr_36 = ExtrudePoint(Base=item_16, Point=move_40.Geometry)
extr_37 = ExtrudePoint(Base=item_17, Point=move_41.Geometry)
move_43 = Move(Geometry=move_38.Geometry, Motion=X_11)  # -> Geometry, Transform
Z_47 = UnitZ(Factor=lab_bench_leg_extension_height)
cull_19 = CullPattern(List=extr_27, CullPattern=invert(subtraction_52))
cull_20 = CullPattern(List=extr_26, CullPattern=invert(subtraction_52))
cull_21 = CullPattern(List=extr_25, CullPattern=subtraction_52)
extr_38 = Extrude(Base=move_35.Geometry, Direction=X_11)
extr_39 = Extrude(Base=move_42.Geometry, Direction=X_14)
extr_40 = Extrude(Base=move_43.Geometry, Direction=X_14)
extr_41 = Extrude(Base=move_37.Geometry, Direction=X_11)
cull_22 = CullPattern(List=subsrf_20, CullPattern=invert(item_2))
cull_23 = CullPattern(List=clean_6, CullPattern=item_2)
merge_25 = Merge(Data1=cull_21, Data2=cull_20)
cull_24 = CullPattern(List=subsrf_20, CullPattern=invert(item_2))
sunion = SolidUnion(Breps=[extr_38, extr_39])
fillet = Fillet(Curve=extr_36, Parameter=0, Radius=cabinet_wheel_joint_fillet_radius)  # -> Curve, Parameter
fillet_2 = Fillet(Curve=extr_37, Parameter=0, Radius=cabinet_wheel_joint_fillet_radius)  # -> Curve, Parameter
cull_25 = CullPattern(List=merge_19, CullPattern=item_2)
clean_7 = CleanTree(RemoveNulls=True, RemoveInvalid=True, RemoveEmpty=True, Tree=merge_25)
merge_26 = Merge(Data1=cull_22, Data2=cull_23)
explode = Explode(Curve=fillet.Curve, Recursive=True)  # -> Segments, Vertices
explode_2 = Explode(Curve=fillet_2.Curve, Recursive=True)  # -> Segments, Vertices
move_44 = Move(Geometry=subsrf_14, Motion=X_12)  # -> Geometry, Transform
move_45 = Move(Geometry=subsrf_13, Motion=X_12)  # -> Geometry, Transform
sunion_2 = SolidUnion(Breps=[extr_40, extr_41])
merge_27 = Merge(Data1=cull_24, Data2=cull_25)
srf_10 = Surface(fillet.Curve)
srf_11 = Surface(fillet_2.Curve)
Z_48 = UnitZ(Factor=subtraction_27)
item_18 = ListItem(List=explode.Segments, Index=3, Wrap=True)
item_19 = ListItem(List=explode_2.Segments, Index=3, Wrap=True)
clean_8 = CleanTree(RemoveNulls=True, RemoveInvalid=True, RemoveEmpty=True, Tree=merge_26)  # -> graft(Tree)
fmerge = MergeFaces(Brep=sunion)  # -> Breps, Before, After
clean_9 = CleanTree(RemoveNulls=True, RemoveInvalid=True, RemoveEmpty=True, Tree=merge_27)
fmerge_2 = MergeFaces(Brep=sunion_2)  # -> Breps, Before, After
darc = DeconstructArc(Arc=item_18)  # -> BasePlane, Radius, Angle
darc_2 = DeconstructArc(Arc=item_19)  # -> BasePlane, Radius, Angle
Y_9 = UnitY(Factor=cabinet_wheel_joint_triangle_thickness)
pt_10 = Point(darc.BasePlane)
subtraction_53 = Subtraction(A=subtraction_27, B=lab_bench_leg_extension_height)
pt_11 = Point(darc_2.BasePlane)
move_46 = Move(Geometry=merge_6, Motion=Z_47)  # -> Geometry, Transform
neg_16 = Negative(Value=Y_9)
Z_49 = UnitZ(Factor=subtraction_53)
move_47 = Move(Geometry=merge_5, Motion=Z_48)  # -> Geometry, Transform
move_48 = Move(Geometry=pt_10, Motion=neg_16)  # -> Geometry, Transform
move_49 = Move(Geometry=pt_11, Motion=Y_9)  # -> Geometry, Transform
extr_42 = Extrude(Base=srf_10, Direction=neg_16)
extr_43 = Extrude(Base=srf_11, Direction=Y_9)
Z_50 = UnitZ(Factor=lab_bench_horizontal_bar_thickness)
addition_27 = Addition(A=wall_cabinet_handle_thickness, B=wall_cabinet_handle_location_v)
neg_17 = Negative(Value=Z_50)
ln_7 = Line(StartPoint=move_48.Geometry, EndPoint=move_49.Geometry)
addition_28 = Addition(A=wall_cabinet_handle_location_u, B=wall_cabinet_handle_thickness)
extr_44 = Extrude(Base=move_46.Geometry, Direction=Z_49)
extr_45 = Extrude(Base=move_47.Geometry, Direction=neg_17)
pipe = Pipe(Curve=ln_7, Radius=addition_25, Caps=1)
srf_12 = Surface(clean_8)
num_5 = Number(cabinet_handle_thickness)
panel_25 = Panel("""1
2""")
addition_29 = Addition(A=addition_27, B=wall_cabinet_handle_lenght)
addition_30 = Addition(A=wall_cabinet_handle_location_v, B=wall_cabinet_handle_lenght)
extr_46 = Extrude(Base=move_39.Geometry, Direction=Z_46)
merge_28 = Merge(Data1=extr_44, Data2=extr_45, Data3=merge_20)
merge_29 = Merge(Data1=merge_21, Data2=merge_22, Data3=merge_23, Data4=merge_24)
extr_47 = Extrude(Base=move_2.Geometry, Direction=neg)
merge_30 = Merge(Data1=extr_22, Data2=extr_23, Data3=extr_24)
mesh_5 = Mesh(flatten(extr_46))
mesh_6 = Mesh(flatten(merge_29))
mesh_7 = Mesh(flatten(merge_28))
swatch_5 = ColourSwatch(SwatchColor=RGB(59, 59, 59))
mesh_8 = Mesh(flatten(merge_30))
swatch_6 = ColourSwatch(SwatchColor=RGB(153, 153, 153))
mesh_9 = Mesh(flatten(extr_47))
swatch_7 = ColourSwatch(SwatchColor=RGB(201, 201, 201))
swatch_8 = ColourSwatch(SwatchColor=RGB(105, 68, 68))
merge_31 = Merge(Data1=extr_21, Data2=extr_42, Data3=extr_43)
filedge_2 = FilletEdge(Shape=pipe, Blend=0, Metric=2, Edges=panel_25, Radii=cabinet_wheel_edge_fillet_raidus)
mjoin_5 = MeshJoin(Meshes=mesh_5)
swatch_9 = ColourSwatch(SwatchColor=RGB(224, 192, 103))
mjoin_6 = MeshJoin(Meshes=mesh_6)
mjoin_7 = MeshJoin(Meshes=mesh_7)
mjoin_8 = MeshJoin(Meshes=mesh_8)
mjoin_9 = MeshJoin(Meshes=mesh_9)
preview_5 = CustomPreview(Geometry=extr_46, Material=swatch_5)
preview_6 = CustomPreview(Geometry=merge_29, Material=swatch_6)
preview_7 = CustomPreview(Geometry=merge_30, Material=swatch_9)
preview_8 = CustomPreview(Geometry=merge_28, Material=swatch_7)
preview_9 = CustomPreview(Geometry=extr_47, Material=swatch_8)
dim_28 = Dimensions(Surface=srf_12)  # -> UDimension, VDimension
dim_29 = Dimensions(Surface=srf_12)  # -> UDimension, VDimension
dim_30 = Dimensions(Surface=srf_12)  # -> UDimension, VDimension
extr_48 = Extrude(Base=clean_9, Direction=X_7)
dim_31 = Dimensions(Surface=move_45.Geometry)  # -> UDimension, VDimension
dim_32 = Dimensions(Surface=move_45.Geometry)  # -> UDimension, VDimension
subtraction_54 = Subtraction(A=dim_32.VDimension, B=wall_cabinet_handle_location_u)
subtraction_55 = Subtraction(A=subtraction_54, B=wall_cabinet_handle_thickness)
dim_33 = Dimensions(Surface=move_45.Geometry)  # -> UDimension, VDimension
dim_34 = Dimensions(Surface=move_44.Geometry)  # -> UDimension, VDimension
dim_35 = Dimensions(Surface=move_44.Geometry)  # -> UDimension, VDimension
dim_36 = Dimensions(Surface=move_44.Geometry)  # -> UDimension, VDimension
dim_37 = Dimensions(Surface=srf_12)  # -> UDimension, VDimension
addition_31 = Addition(A=cabinet_handle_lenght, B=cabinet_handle_thickness)
division_151 = Division(A=addition_27, B=dim_32.UDimension)
division_152 = Division(A=wall_cabinet_handle_location_v, B=dim_32.UDimension)
division_153 = Division(A=subtraction_54, B=dim_32.VDimension)
division_154 = Division(A=subtraction_55, B=dim_32.VDimension)
division_155 = Division(A=addition_29, B=dim_31.UDimension)
division_156 = Division(A=addition_30, B=dim_31.UDimension)
division_157 = Division(A=subtraction_54, B=dim_31.VDimension)
division_158 = Division(A=subtraction_55, B=dim_31.VDimension)
division_159 = Division(A=wall_cabinet_handle_location_v, B=dim_33.UDimension)
division_160 = Division(A=addition_29, B=dim_33.UDimension)
division_161 = Division(A=subtraction_54, B=dim_33.VDimension)
division_162 = Division(A=subtraction_55, B=dim_33.VDimension)
division_163 = Division(A=addition_27, B=dim_34.UDimension)
division_164 = Division(A=wall_cabinet_handle_location_v, B=dim_34.UDimension)
division_165 = Division(A=addition_28, B=dim_34.VDimension)
division_166 = Division(A=wall_cabinet_handle_location_u, B=dim_34.VDimension)
division_167 = Division(A=addition_29, B=dim_35.UDimension)
division_168 = Division(A=addition_30, B=dim_35.UDimension)
division_169 = Division(A=addition_28, B=dim_35.VDimension)
division_170 = Division(A=wall_cabinet_handle_location_u, B=dim_35.VDimension)
division_171 = Division(A=wall_cabinet_handle_location_v, B=dim_36.UDimension)
division_172 = Division(A=addition_29, B=dim_36.UDimension)
division_173 = Division(A=addition_28, B=dim_36.VDimension)
division_174 = Division(A=wall_cabinet_handle_location_u, B=dim_36.VDimension)
dom²num_38 = ConstructDomain²(UMin=division_151, UMax=division_152, VMin=division_153, VMax=division_154)
dom²num_39 = ConstructDomain²(UMin=division_155, UMax=division_156, VMin=division_157, VMax=division_158)
dom²num_40 = ConstructDomain²(UMin=division_159, UMax=division_160, VMin=division_161, VMax=division_162)
dom²num_41 = ConstructDomain²(UMin=division_163, UMax=division_164, VMin=division_165, VMax=division_166)
dom²num_42 = ConstructDomain²(UMin=division_167, UMax=division_168, VMin=division_169, VMax=division_170)
dom²num_43 = ConstructDomain²(UMin=division_171, UMax=division_172, VMin=division_173, VMax=division_174)
subsrf_38 = Isotrim(Surface=reparameterize(move_45.Geometry), Domain=dom²num_38)
subsrf_39 = Isotrim(Surface=reparameterize(move_45.Geometry), Domain=dom²num_39)
subsrf_40 = Isotrim(Surface=reparameterize(move_45.Geometry), Domain=dom²num_40)
subsrf_41 = Isotrim(Surface=reparameterize(move_44.Geometry), Domain=dom²num_41)
subsrf_42 = Isotrim(Surface=reparameterize(move_44.Geometry), Domain=dom²num_42)
subsrf_43 = Isotrim(Surface=reparameterize(move_44.Geometry), Domain=dom²num_43)
division_175 = Division(A=dim_37.VDimension, B=2)
division_176 = Division(A=addition_31, B=2)
subtraction_56 = Subtraction(A=dim_37.UDimension, B=cabinet_horizontal_handle_location_v)
merge_32 = Merge(Data1=subsrf_41, Data2=subsrf_42)
merge_33 = Merge(Data1=subsrf_38, Data2=subsrf_39)
X_15 = UnitX(Factor=wall_cabinet_handle_depth)
X_16 = UnitX(Factor=wall_cabinet_handle_thickness)
subtraction_57 = Subtraction(A=division_175, B=division_176)
addition_32 = Addition(A=division_175, B=division_176)
move_50 = Move(Geometry=subsrf_40, Motion=X_15)  # -> Geometry, Transform
extr_49 = Extrude(Base=merge_33, Direction=X_15)
X_17 = UnitX(Factor=wall_cabinet_handle_depth)
X_18 = UnitX(Factor=wall_cabinet_handle_thickness)
extr_50 = Extrude(Base=move_50.Geometry, Direction=X_16)
move_51 = Move(Geometry=subsrf_43, Motion=X_17)  # -> Geometry, Transform
extr_51 = Extrude(Base=merge_32, Direction=X_17)
extr_52 = Extrude(Base=move_51.Geometry, Direction=X_18)
addition_33 = Addition(A=subtraction_57, B=num_5)
subtraction_58 = Subtraction(A=subtraction_56, B=num_5)
subtraction_59 = Subtraction(A=addition_32, B=num_5)
subtraction_60 = Subtraction(A=addition_32, B=addition_31)
sunion_3 = SolidUnion(Breps=[extr_49, extr_50])
sunion_4 = SolidUnion(Breps=[extr_51, extr_52])
fmerge_3 = MergeFaces(Brep=sunion_3)  # -> Breps, Before, After
fmerge_4 = MergeFaces(Brep=sunion_4)  # -> Breps, Before, After
division_177 = Division(A=subtraction_56, B=dim_28.UDimension)
division_178 = Division(A=subtraction_58, B=dim_28.UDimension)
division_179 = Division(A=subtraction_57, B=dim_28.VDimension)
division_180 = Division(A=addition_33, B=dim_28.VDimension)
division_181 = Division(A=subtraction_56, B=dim_29.UDimension)
division_182 = Division(A=subtraction_58, B=dim_29.UDimension)
division_183 = Division(A=subtraction_59, B=dim_29.VDimension)
division_184 = Division(A=addition_32, B=dim_29.VDimension)
division_185 = Division(A=subtraction_56, B=dim_30.UDimension)
division_186 = Division(A=subtraction_58, B=dim_30.UDimension)
division_187 = Division(A=subtraction_60, B=dim_30.VDimension)
division_188 = Division(A=addition_32, B=dim_30.VDimension)
dom²num_44 = ConstructDomain²(UMin=division_177, UMax=division_178, VMin=division_179, VMax=division_180)
dom²num_45 = ConstructDomain²(UMin=division_181, UMax=division_182, VMin=division_183, VMax=division_184)
dom²num_46 = ConstructDomain²(UMin=division_185, UMax=division_186, VMin=division_187, VMax=division_188)
subsrf_44 = Isotrim(Surface=reparameterize(clean_8), Domain=dom²num_46)
subsrf_45 = Isotrim(Surface=reparameterize(clean_8), Domain=dom²num_44)
subsrf_46 = Isotrim(Surface=reparameterize(clean_8), Domain=dom²num_45)
merge_34 = Merge(Data1=fmerge_3.Breps, Data2=fmerge_4.Breps)
merge_35 = Merge(Data1=subsrf_45, Data2=subsrf_46)
move_52 = Move(Geometry=subsrf_44, Motion=X_7)  # -> Geometry, Transform
move_53 = Move(Geometry=move_52.Geometry, Motion=X_11)  # -> Geometry, Transform
extr_53 = Extrude(Base=move_53.Geometry, Direction=X_14)
move_54 = Move(Geometry=merge_35, Motion=X_7)  # -> Geometry, Transform
extr_54 = Extrude(Base=move_54.Geometry, Direction=X_11)
mesh_10 = Mesh(flatten(merge_34))
mesh_11 = Mesh(flatten(cull_19))
mesh_12 = Mesh(flatten(sdiff_2))
mesh_13 = Mesh(flatten(clean_7))
mjoin_10 = MeshJoin(Meshes=mesh_10)
mjoin_11 = MeshJoin(Meshes=mesh_11)
mjoin_12 = MeshJoin(Meshes=mesh_12)
mjoin_13 = MeshJoin(Meshes=mesh_13)
swatch_10 = ColourSwatch(SwatchColor=RGB(224, 192, 103))
swatch_11 = ColourSwatch(SwatchColor=RGBA(145, 255, 233, 133))
swatch_12 = ColourSwatch(SwatchColor=RGBA(255, 255, 255, 180))
swatch_13 = ColourSwatch(SwatchColor=RGB(140, 105, 105))
sunion_5 = SolidUnion(Breps=[extr_54, extr_53])
fmerge_5 = MergeFaces(Brep=sunion_5)  # -> Breps, Before, After
merge_36 = Merge(Data1=fmerge.Breps, Data2=fmerge_2.Breps)
preview_10 = CustomPreview(Geometry=clean_7, Material=swatch_10)
preview_11 = CustomPreview(Geometry=cull_19, Material=swatch_11)
preview_12 = CustomPreview(Geometry=sdiff_2, Material=swatch_12)
preview_13 = CustomPreview(Geometry=merge_34, Material=swatch_13)
cull_26 = CullPattern(List=merge_36, CullPattern=item_2)
clean_10 = CleanTree(RemoveNulls=True, RemoveInvalid=True, RemoveEmpty=True, Tree=cull_26)
cull_27 = CullPattern(List=extr_9, CullPattern=invert(item_5))
cull_28 = CullPattern(List=[filedge_2, merge_31], CullPattern=item_5)
cull_29 = CullPattern(List=filedge_2, CullPattern=item_5)
merge_37 = Merge(Data1=clean_10, Data2=fmerge_5.Breps)
cull_30 = CullPattern(List=cull_27, CullPattern=item_4)
cull_31 = CullPattern(List=cull_28, CullPattern=item_4)
cull_32 = CullPattern(List=cull_29, CullPattern=item_4)
swatch_14 = ColourSwatch(SwatchColor=RGB(219, 219, 219))
swatch_15 = ColourSwatch(SwatchColor=RGBA(255, 255, 255, 180))
swatch_16 = ColourSwatch(SwatchColor=RGB(224, 192, 103))
swatch_17 = ColourSwatch(SwatchColor=RGB(140, 105, 105))
swatch_18 = ColourSwatch(SwatchColor=RGB(181, 181, 181))
swatch_19 = ColourSwatch(SwatchColor=RGB(87, 87, 87))
preview_14 = CustomPreview(Geometry=cull_30, Material=swatch_14)
preview_15 = CustomPreview(Geometry=sdiff, Material=swatch_15)
preview_16 = CustomPreview(Geometry=extr_48, Material=swatch_16)
preview_17 = CustomPreview(Geometry=merge_37, Material=swatch_17)
preview_18 = CustomPreview(Geometry=cull_31, Material=swatch_18)
preview_19 = CustomPreview(Geometry=cull_32, Material=swatch_19)
mesh_14 = Mesh(flatten(cull_32))
mesh_15 = Mesh(flatten(extr_48))
mesh_16 = Mesh(flatten(cull_31))
mesh_17 = Mesh(flatten(merge_37))
mesh_18 = Mesh(flatten(sdiff))
mesh_19 = Mesh(flatten(cull_30))
mjoin_14 = MeshJoin(Meshes=mesh_14)
mjoin_15 = MeshJoin(Meshes=mesh_15)
mjoin_16 = MeshJoin(Meshes=mesh_16)
mjoin_17 = MeshJoin(Meshes=mesh_17)
mjoin_18 = MeshJoin(Meshes=mesh_18)
mjoin_19 = MeshJoin(Meshes=mesh_19)
merge_38 = Merge(Data1=mjoin, Data2=mjoin_2, Data3=mjoin_4, Data4=mjoin_3)
merge_39 = Merge(Data1=swatch, Data2=swatch_2, Data3=swatch_3, Data4=swatch_4)
merge_40 = Merge(Data1=mjoin_19, Data2=mjoin_18, Data3=mjoin_15, Data4=mjoin_17, Data5=mjoin_16, Data6=mjoin_14)
merge_41 = Merge(Data1=swatch_14, Data2=swatch_15, Data3=swatch_16, Data4=swatch_17, Data5=swatch_18, Data6=swatch_19)
merge_42 = Merge(Data1=mjoin_13, Data2=mjoin_11, Data3=mjoin_12, Data4=mjoin_10)
merge_43 = Merge(Data1=swatch_10, Data2=swatch_11, Data3=swatch_12, Data4=swatch_13)
merge_44 = Merge(Data1=swatch_8, Data2=swatch_7, Data3=swatch_6, Data4=swatch_5, Data5=swatch_9)
merge_45 = Merge(Data1=mjoin_9, Data2=mjoin_7, Data3=mjoin_6, Data4=mjoin_5, Data5=mjoin_8)
merge_46 = Merge(Data1=merge_41, Data2=merge_43, Data3=merge_39, Data4=merge_44)
merge_47 = Merge(Data1=merge_40, Data2=merge_42, Data3=merge_38, Data4=merge_45)
number_slider_9 = Slider(0.001, range=0..0.001)
yz = YZPlane(Origin=Point(0, 0, 0))
argb = SplitARGB(Colour=merge_46, IntegerChannels=True)  # -> Alpha, Red, Green, Blue
move_55 = Move(Motion=Vector(0, 0, 10))  # -> Geometry, Transform
number_slider_10 = Slider(0.5, range=0..1)
rotate = Rotate(Geometry=merge_47, Angle=degrees("-90"), Plane=yz)  # -> Geometry, Transform
number_slider_11 = Slider(0.1, range=0..0.1)
box = CenterBox(Base=PlaneXY(0, 0, 0), X=number_slider_9, Y=number_slider_9, Z=number_slider_9)
c_script = CSharpScript(r=argb.Red, g=argb.Green, b=argb.Blue)  # -> out, A; inputs r: Int32, g: Int32, b: Int32
# ---------- c_script: C# ----------
A = string.Format("{0:X2}{1:X2}{2:X2}", r, g, b);
# ---------- end c_script ----------
neg_18 = Negative(Value=Slider(4, range=0..10))
panel_26 = Panel(c_script.A)
mbox = MeshBox(Base=box, XCount="1", YCount="1", ZCount="1")
Y_10 = UnitY(Factor=neg_18)
scale_5 = Scale(Geometry=rotate.Geometry, Center=Point(0, 0, 0), Factor="1/12")  # -> Geometry, Transform
concat = Concatenate(FragmentA="0x", FragmentB=panel_26)
join_2 = TextJoin(Text=concat, Join=",")
panel_27 = Panel(join_2)
move_56 = Move(Geometry=scale_5.Geometry, Motion=Y_10)  # -> Geometry, Transform
nullrep = ReplaceNulls(Items=move_56.Geometry, Replacements=mbox)  # -> Items, Count

# ---- group: RH_OUT:115:Mesh
mesh_20 = Mesh(nullrep.Items)
