# Grasshopper definition Casework5.gh (Grasshopper 1.0.7)

# ---- group: RH_IN:201:Length
branch_length = Slider(53.41, range=0..90)

# ---- group: RH_IN:201:Width
cell_radius = Slider(26.1, range=0..60)

# ---- group: RH_IN:201:Height
number_slider = Slider(2, range=1..10)

# ----
series = Series(Start=0, Step=Slider(50, range=0..100), Count=Slider(3, range=0..10))
pt = ConstructPoint(XCoordinate=series, YCoordinate=0, ZCoordinate=0)
xy = XYPlane(Origin=pt)
mbox = MeshBox(Base=xy, XCount=branch_length, YCount=cell_radius, ZCount=number_slider)

# ---- group: RH_OUT:115:Mesh
mesh = Mesh(mbox)
