# Grasshopper definition LabBench13.gh (Grasshopper 1.0.6)

# ---- group: RH_IN:201:Length
branch_length = Slider(53.41, range=0..90)

# ---- group: RH_IN:201:Width
cell_radius = Slider(26.1, range=0..60)

# ---- group: RH_IN:201:Height
number_slider = Slider(2, range=1..10)

# ----
multiplication = Multiplication(A=number_slider, B="12")
Z = UnitZ(Factor=multiplication)
pt = ConstructPoint(XCoordinate=branch_length, YCoordinate="2", ZCoordinate="1.5")
pt_2 = ConstructPoint(XCoordinate="2", YCoordinate=cell_radius, ZCoordinate="1.5")
pt_3 = ConstructPoint(XCoordinate="2", YCoordinate="2", ZCoordinate=Z)
pt_4 = ConstructPoint(XCoordinate=branch_length, YCoordinate=cell_radius, ZCoordinate="1.5")
pt_5 = ConstructPoint(XCoordinate=0, YCoordinate=0, ZCoordinate=0)
box = Box2Pt(PointA=pt_5, PointB=pt, Plane=PlaneXY(0, 0, 0))
box_2 = Box2Pt(PointA=pt_5, PointB=pt_2, Plane=PlaneXY(0, 0, 0))
area = Area(Geometry=box)  # -> Area, Centroid
box_3 = Box2Pt(PointA=pt_5, PointB=pt_3, Plane=PlaneXY(0, 0, 0))
scale_nu = ScaleNU(Geometry=box, Plane=area.Centroid, ScaleX="0.95", ScaleY="0.95", ScaleZ=1)  # -> Geometry, Transform
area_2 = Area(Geometry=box_2)  # -> Area, Centroid
box_4 = Box2Pt(PointA=pt_5, PointB=pt_4, Plane=PlaneXY(0, 0, 0))
mbox = MeshBox(Base=box_4, XCount="2", YCount="2", ZCount="2")  # -> flatten(Mesh)
subtraction = Subtraction(A=branch_length, B="2")
subtraction_2 = Subtraction(A=cell_radius, B="2")
scale_nu_2 = ScaleNU(Geometry=box_2, Plane=area_2.Centroid, ScaleX="0.95", ScaleY="0.95", ScaleZ=1)  # -> Geometry, Transform
subtraction_3 = Subtraction(A=multiplication, B="1.5")
X = UnitX(Factor=subtraction)
area_3 = Area(Geometry=box_4)  # -> Area, Centroid
move = Move(Geometry=mbox, Motion=Z)  # -> Geometry, Transform
Z_2 = UnitZ(Factor=subtraction_3)
Y = UnitY(Factor=subtraction_2)
move_2 = Move(Geometry=box_3, Motion=X)  # -> Geometry, Transform
move_3 = Move(Geometry=[scale_nu.Geometry, scale_nu_2.Geometry], Motion=Z_2)  # -> Geometry, Transform
move_4 = Move(Geometry=[move_2.Geometry, box_3], Motion=Y)  # -> Geometry, Transform
rotate = Rotate(Geometry=move_3.Geometry, Angle=degrees("180"), Plane=area_3.Centroid)  # -> Geometry, Transform
mbox_2 = MeshBox(Base=[move_4.Geometry, move_2.Geometry, box_3], XCount="2", YCount="2", ZCount="2")  # -> flatten(Mesh)
mbox_3 = MeshBox(Base=[move_3.Geometry, rotate.Geometry], XCount="2", YCount="2", ZCount="2")  # -> flatten(Mesh)
area_4 = Area(Geometry=mbox_2)  # -> Area, Centroid
mjoin = MeshJoin(Meshes=mbox_2)
mjoin_2 = MeshJoin(Meshes=flatten([mbox_3, mjoin]))
division = Division(A=Z, B="2")
scale_nu_3 = ScaleNU(Geometry=mbox_2, Plane=area_4.Centroid, ScaleX=".75", ScaleY=".75", ScaleZ=Slider(0.2, range=0..1))  # -> Geometry, Transform
Z_3 = UnitZ(Factor=division)
neg = Negative(Value=Z_3)
move_5 = Move(Geometry=scale_nu_3.Geometry, Motion=neg)  # -> Geometry, Transform
bbox = BoundingBox(Content=move_5.Geometry, Plane=PlaneXY(0, 0, 0))  # -> Box, Box_2
debox = DeconstructBox(Box=bbox.Box)  # -> Plane, X, Y, Z
dedomain = DeconstructDomain(Domain=debox.Z)  # -> Start, End
boxprop = BoxProperties(Box=bbox.Box)  # -> Center, Diagonal, Area, Volume, Degeneracy
pdecon = Deconstruct(Point=boxprop.Center)  # -> XComponent, YComponent, ZComponent
number_slider_2 = Slider(1.5, range=0..10)
pt_6 = ConstructPoint(XCoordinate=pdecon.XComponent, YCoordinate=pdecon.YComponent, ZCoordinate=dedomain.Start)
box_5 = CenterBox(Base=pt_6, X=number_slider_2, Y=number_slider_2, Z=Slider(0.5, range=0..1))
mbox_4 = MeshBox(Base=box_5, XCount="2", YCount="2", ZCount="2")
mjoin_3 = MeshJoin(Meshes=flatten([move_5.Geometry, mbox_4]))
X_2 = UnitX(Factor=1)
data = Data([move.Geometry, mjoin_2, mjoin_3])
division_2 = Division(A=branch_length, B="2")
rot3d = Rotate3D(Geometry=data, Angle=-1.570796327, Center=Point(0, 0, 0), Axis=X_2)  # -> Geometry, Transform
division_3 = Division(A=cell_radius, B="2")
Y_2 = UnitY(Factor=division_3)
neg_2 = Negative(Value=Y_2)
Z_4 = UnitZ(Factor=division_3)
move_6 = Move(Geometry=rot3d.Geometry, Motion=neg_2)  # -> flatten(Geometry), Transform
X_3 = UnitX(Factor=division_2)
move_7 = Move(Geometry=move_6.Geometry, Motion=Z_4)  # -> flatten(Geometry), Transform
neg_3 = Negative(Value=X_3)
move_8 = Move(Geometry=move_7.Geometry, Motion=neg_3)  # -> Geometry, Transform
scale = Scale(Geometry=move_8.Geometry, Center=Point(0, 0, 0), Factor=0.5)  # -> flatten(Geometry), Transform

# ---- group: RH_OUT:115:Mesh
mesh = Mesh(scale.Geometry)
