# Grasshopper definition SolarComfort4.gh (Grasshopper 1.0.7)

# ---- group: RH_IN:201:Pegboard_Length
pegboard_length = Slider(52, range=0..100)

# ---- group: RH_IN:201:Wall_Cabinet_Type
wall_cabinet_type = Slider(1, range=1..2)

# ---- group: RH_IN:201:Lab_Bench_Width
number_slider = Slider(30, range=0..100)

# ---- group: RH_IN:201:Lab_Bench_Length
number_slider_2 = Slider(40, range=0..100)

# ---- group: RH_IN:201:Lab_Bench_Height
number_slider_3 = Slider(10, range=0..10)

# ---- group: RH_IN:201:Lab_Bench_Start_Position
number_slider_4 = Slider(7, range=0..10)

# ---- group: RH_IN:201:Wall_Cabinet_Start_Position
number_slider_5 = Slider(0, range=0..100)

# ---- group: RH_IN:201:Wall_Cabinet_Count
number_slider_6 = Slider(1, range=1..3)

# ---- group: RH_IN:201:Pegboard_Count
number_slider_7 = Slider(1, range=1..3)

# ---- group: RH_IN:201:Lab_Bench_Count
number_slider_8 = Slider(2, range=0..10)

# ---- group: RH_IN:201:Pegboard_Start_Position
number_slider_9 = Slider(0, range=0..100)

# ----
pt = ConstructPoint(XCoordinate=number_slider, YCoordinate=number_slider_2, ZCoordinate=0)
Z = UnitZ(Factor=number_slider_3)
sqgrid = Square(Plane=PlaneXY(0, 0, 0), Size=1, ExtentX=number_slider, ExtentY=number_slider_2)  # -> Cells, Points
rec_2pt = Rectangle2Pt(Plane=PlaneXY(0, 0, 0), PointA=Point(0, 0, 0), PointB=pt, Radius=0)  # -> Rectangle, Length
extr = Extrude(Base=rec_2pt.Rectangle, Direction=Z)
pt_2 = ConstructPoint(XCoordinate=0, YCoordinate=0, ZCoordinate=0)
debrep = DeconstructBrep(Brep=extr)  # -> Faces, Edges, Vertices
X = UnitX(Factor=1)
explode = Explode(Curve=sqgrid.Cells, Recursive=True)  # -> Segments, Vertices
line = LineSDL(Start=pt_2, Direction=X, Length=number_slider)
data = Data(debrep.Edges)
item = ListItem(List=explode.Segments, Index=0, Wrap=True)  # -> Item, Item1
multiplication = Multiplication(A=number_slider_8, B=Slider(2, range=0..10))
addition = Addition(A=multiplication, B="1")
divide = DivideCurve(Curve=line, Count=addition, Kinks=False)  # -> Points, Tangents, Parameters
shatter = Shatter(Curve=line, Parameters=divide.Parameters)
merge = Merge(Data1=item.Item, Data2=item.Item1)  # -> flatten(Result)
data_2 = Data(merge)
dispatch = Dispatch(List=shatter, DispatchPattern=[True, False])  # -> ListA, ListB
data_3 = Data(dispatch.ListB)
Z_2 = UnitZ(Factor=number_slider_4)
Z_3 = UnitZ(Factor=Slider(1, range=0..10))
move = Move(Geometry=data_3, Motion=Z_2)  # -> graft(Geometry), Transform
move_2 = Move(Geometry=data_3, Motion=Z_3)  # -> graft(Geometry), Transform
merge_2 = Merge(Data1=move.Geometry, Data2=move_2.Geometry)
loft = Loft(Curves=merge_2, Options={Adjust=False, Closed=False, LoftEnds=0, LoftSimp=0, LoftType=0, Rebuild=10, Refit=0.01})
debrep_2 = DeconstructBrep(Brep=loft)  # -> Faces, Edges, Vertices

# ---- group: RH_IN:201:Cabinet_Count
number_slider_10 = Slider(1, range=1..3)

# ----
item_2 = ListItem(List=simplify(debrep_2.Edges), Index=0, Wrap=True)  # -> Item, Item1, Item2, Item3

# ---- group: RH_IN:201:Cabinet_Start_Position
number_slider_11 = Slider(0, range=0..100)

# ----
item_3 = ListItem(List=simplify(debrep_2.Edges), Index=0, Wrap=True)  # -> Item, Item1, Item2, Item3

# ---- group: RH_IN:201:Cabinet_Type_Base
number_slider_12 = Slider(3, range=0..3)

# ----
Y = UnitY(Factor=1)

# ---- group: RH_IN:201:Cabinet_Type
number_slider_13 = Slider(0, range=0..5)

# ----
Y_2 = UnitY(Factor=1)
Z_4 = UnitZ(Factor=number_slider_12)
neg = Negative(Value=Y)
neg_2 = Negative(Value=Y_2)
move_3 = Move(Geometry=item_3.Item1, Motion=Z_4)  # -> Geometry, Transform
move_4 = Move(Geometry=item_2.Item, Motion=neg)  # -> Geometry, Transform
move_5 = Move(Geometry=item_2.Item2, Motion=neg)  # -> Geometry, Transform
range = Range(Domain=Domain(0, 1), Steps=number_slider_10)
move_6 = Move(Geometry=move_3.Geometry, Motion=neg_2)  # -> Geometry, Transform
move_7 = Move(Geometry=item_3.Item3, Motion=neg_2)  # -> Geometry, Transform
range_2 = Range(Domain=Domain(0, 1), Steps=number_slider_13)
flip = FlipCurve(Curve=item_2.Item2)  # -> Curve, Flag
flip_2 = FlipCurve(Curve=move_5.Geometry)  # -> Curve, Flag
flip_3 = FlipCurve(Curve=item_3.Item3)  # -> Curve, Flag
flip_4 = FlipCurve(Curve=move_7.Geometry)  # -> Curve, Flag
tweencrv = TweenCurve(CurveA=move_4.Geometry, CurveB=flip_2.Curve, Factor=range, BlendType=0)  # -> graft(Tween)
tweencrv_2 = TweenCurve(CurveA=item_2.Item, CurveB=flip.Curve, Factor=range, BlendType=0)  # -> graft(Tween)
tweencrv_3 = TweenCurve(CurveA=move_6.Geometry, CurveB=flip_4.Curve, Factor=range_2, BlendType=0)  # -> graft(Tween)
tweencrv_4 = TweenCurve(CurveA=move_3.Geometry, CurveB=flip_3.Curve, Factor=range_2, BlendType=0)  # -> graft(Tween)
merge_3 = Merge(Data1=tweencrv, Data2=tweencrv_2)
merge_4 = Merge(Data1=tweencrv_3, Data2=tweencrv_4)
loft_2 = Loft(Curves=merge_3, Options={Adjust=False, Closed=False, LoftEnds=0, LoftSimp=0, LoftType=0, Rebuild=10, Refit=0.01})
loft_3 = Loft(Curves=merge_4, Options={Adjust=False, Closed=False, LoftEnds=0, LoftSimp=0, LoftType=0, Rebuild=10, Refit=0.01})
mesh = Mesh(flatten(loft))
mesh_2 = Mesh(flatten(loft_2))
mesh_3 = Mesh(flatten(loft_3))
number_slider_14 = Slider(0.01, range=0..0.01)
merge_5 = Merge(Data1=mesh_2, Data2=mesh, Data3=mesh_3)
number_slider_15 = Slider(0.05, range=0..0.1)
merge_6 = Merge(Data1=flatten(data_2), Data2=flatten(data))
number_slider_16 = Slider(0.1, range=0..0.1)
vec = VectorXYZ(XComponent=number_slider_14, YComponent=number_slider_14, ZComponent=number_slider_15)  # -> Vector, Length
Z_5 = UnitZ(Factor=number_slider_15)
data_4 = Data(simplify(graft(merge_6)))
move_8 = Move(Geometry=merge_6, Motion=vec.Vector)  # -> simplify(graft(Geometry)), Transform
loft_4 = Loft(
    Curves=[data_4, move_8.Geometry],
    Options={Adjust=False, Closed=False, LoftEnds=0, LoftSimp=0, LoftType=0, Rebuild=10, Refit=0.01})  # -> flatten(Loft)
clean = CleanTree(RemoveNulls=True, RemoveInvalid=True, RemoveEmpty=True, Tree=loft_4)
smesh = SimpleMesh(Brep=clean)
mjoin = MeshJoin(Meshes=smesh)
mjoin_2 = MeshJoin(Meshes=[merge_5, mjoin])
yz = YZPlane(Origin=Point(0, 0, 0))
move_9 = Move(Motion=Vector(0, 0, 10))  # -> Geometry, Transform
number_slider_17 = Slider(0.5, range=0..1)
rotate = Rotate(Geometry=mjoin_2, Angle=degrees("-90"), Plane=yz)  # -> Geometry, Transform
number_slider_18 = Slider(0.1, range=0..0.1)
neg_3 = Negative(Value=Slider(6, range=0..10))
Y_3 = UnitY(Factor=neg_3)
scale = Scale(Geometry=rotate.Geometry, Center=Point(0, 0, 0), Factor="1/12")  # -> Geometry, Transform
number_slider_19 = Slider(0.001, range=0..0.001)
move_10 = Move(Geometry=scale.Geometry, Motion=Y_3)  # -> Geometry, Transform
box = CenterBox(Base=PlaneXY(0, 0, 0), X="0.01", Y="0.01", Z="0.01")
mbox = MeshBox(Base=box, XCount="1", YCount="1", ZCount="1")
nullrep = ReplaceNulls(Items=move_10.Geometry, Replacements=mbox)  # -> Items, Count
rh_out_107_curve = Curve()

# ---- group: RH_OUT:115:Mesh
mesh_4 = Mesh(nullrep.Items)
