# Grasshopper definition SolarComfort7.gh (Grasshopper 1.0.7)

# ---- group: RH_IN:201:Pegboard_Count
number_slider = Slider(1, range=1..3)

# ---- group: RH_IN:201:Pegboard_Start_Position
number_slider_2 = Slider(0, range=0..100)

# ---- group: RH_IN:201:Wall_Cabinet_Count
number_slider_3 = Slider(1, range=1..3)

# ---- group: RH_IN:201:Wall_Cabinet_Start_Position
number_slider_4 = Slider(0, range=0..100)

# ---- group: RH_IN:201:Wall_Cabinet_Type
wall_cabinet_type = Slider(1, range=1..2)

# ---- group: RH_IN:201:Pegboard_Length
pegboard_length = Slider(52, range=0..100)

# ----
lab_bench_width = Slider(30, range=0..100)
lab_bench_length = Slider(72, range=0..100)
number_slider_5 = Slider(1, range=1..3)
number_slider_6 = Slider(0, range=0..100)

# ---- group: RH_IN:201:Lab_Bench_Width
number_slider_7 = Slider(30, range=0..100)

# ---- group: RH_IN:201:Lab_Bench_Length
number_slider_8 = Slider(40, range=0..100)

# ---- group: RH_IN:201:Lab_Bench_Count
number_slider_9 = Slider(2, range=0..10)

# ---- group: RH_IN:201:Lab_Bench_Start_Position
number_slider_10 = Slider(7, range=0..10)

# ---- group: RH_IN:201:Lab_Bench_Height
number_slider_11 = Slider(10, range=0..10)

# ----
pt = ConstructPoint(XCoordinate=number_slider_7, YCoordinate=number_slider_8, ZCoordinate=0)
Z = UnitZ(Factor=number_slider_11)
sqgrid = Square(Plane=PlaneXY(0, 0, 0), Size=1, ExtentX=number_slider_7, ExtentY=number_slider_8)  # -> Cells, Points
rec_2pt = Rectangle2Pt(Plane=PlaneXY(0, 0, 0), PointA=Point(0, 0, 0), PointB=pt, Radius=0)  # -> Rectangle, Length
extr = Extrude(Base=rec_2pt.Rectangle, Direction=Z)
pt_2 = ConstructPoint(XCoordinate=0, YCoordinate=0, ZCoordinate=0)
debrep = DeconstructBrep(Brep=extr)  # -> Faces, Edges, Vertices
boundary = BoundarySurfaces(Edges=sqgrid.Cells)
X = UnitX(Factor=1)
line = LineSDL(Start=pt_2, Direction=X, Length=number_slider_7)
data = Data(debrep.Edges)
smesh = SimpleMesh(Brep=boundary)
multiplication = Multiplication(A=number_slider_9, B=Slider(2, range=0..10))
addition = Addition(A=multiplication, B="1")
data_2 = Data(sqgrid.Cells)
divide = DivideCurve(Curve=line, Count=addition, Kinks=False)  # -> Points, Tangents, Parameters
mesh = Mesh(extr)
shatter = Shatter(Curve=line, Parameters=divide.Parameters)
merge = Merge(Data1=smesh, Data2=mesh)  # -> flatten(Result)
mjoin = MeshJoin(Meshes=merge)
dispatch = Dispatch(List=shatter, DispatchPattern=[True, False])  # -> ListA, ListB
data_3 = Data(dispatch.ListB)
Z_2 = UnitZ(Factor=number_slider_10)
Z_3 = UnitZ(Factor=Slider(1, range=0..10))
move = Move(Geometry=data_3, Motion=Z_2)  # -> graft(Geometry), Transform
move_2 = Move(Geometry=data_3, Motion=Z_3)  # -> graft(Geometry), Transform
merge_2 = Merge(Data1=move.Geometry, Data2=move_2.Geometry)
loft = Loft(Curves=merge_2, Options={Adjust=False, Closed=False, LoftEnds=0, LoftSimp=0, LoftType=0, Rebuild=10, Refit=0.01})

# ---- group: RH_IN:201:Cabinet_Type_Base
number_slider_12 = Slider(3, range=0..3)

# ----
debrep_2 = DeconstructBrep(Brep=loft)  # -> Faces, Edges, Vertices

# ---- group: RH_IN:201:Cabinet_Count
number_slider_13 = Slider(1, range=1..3)

# ----
item = ListItem(List=simplify(debrep_2.Edges), Index=0, Wrap=True)  # -> Item, Item1, Item2, Item3

# ---- group: RH_IN:201:Cabinet_Start_Position
number_slider_14 = Slider(0, range=0..100)

# ----
item_2 = ListItem(List=simplify(debrep_2.Edges), Index=0, Wrap=True)  # -> Item, Item1, Item2, Item3
Y = UnitY(Factor=1)

# ---- group: RH_IN:201:Cabinet_Type
number_slider_15 = Slider(0, range=0..5)

# ----
Y_2 = UnitY(Factor=1)
Z_4 = UnitZ(Factor=number_slider_12)
neg = Negative(Value=Y)
neg_2 = Negative(Value=Y_2)
move_3 = Move(Geometry=item_2.Item1, Motion=Z_4)  # -> Geometry, Transform
move_4 = Move(Geometry=item.Item, Motion=neg)  # -> Geometry, Transform
move_5 = Move(Geometry=item.Item2, Motion=neg)  # -> Geometry, Transform
range = Range(Domain=Domain(0, 1), Steps=number_slider_13)
move_6 = Move(Geometry=move_3.Geometry, Motion=neg_2)  # -> Geometry, Transform
move_7 = Move(Geometry=item_2.Item3, Motion=neg_2)  # -> Geometry, Transform
range_2 = Range(Domain=Domain(0, 1), Steps=number_slider_15)
flip = FlipCurve(Curve=item.Item2)  # -> Curve, Flag
flip_2 = FlipCurve(Curve=move_5.Geometry)  # -> Curve, Flag
flip_3 = FlipCurve(Curve=item_2.Item3)  # -> Curve, Flag
flip_4 = FlipCurve(Curve=move_7.Geometry)  # -> Curve, Flag
tweencrv = TweenCurve(CurveA=move_4.Geometry, CurveB=flip_2.Curve, Factor=range, BlendType=0)  # -> graft(Tween)
tweencrv_2 = TweenCurve(CurveA=item.Item, CurveB=flip.Curve, Factor=range, BlendType=0)  # -> graft(Tween)
tweencrv_3 = TweenCurve(CurveA=move_6.Geometry, CurveB=flip_4.Curve, Factor=range_2, BlendType=0)  # -> graft(Tween)
tweencrv_4 = TweenCurve(CurveA=move_3.Geometry, CurveB=flip_3.Curve, Factor=range_2, BlendType=0)  # -> graft(Tween)
merge_3 = Merge(Data1=tweencrv, Data2=tweencrv_2)
merge_4 = Merge(Data1=tweencrv_3, Data2=tweencrv_4)
loft_2 = Loft(Curves=merge_3, Options={Adjust=False, Closed=False, LoftEnds=0, LoftSimp=0, LoftType=0, Rebuild=10, Refit=0.01})
loft_3 = Loft(Curves=merge_4, Options={Adjust=False, Closed=False, LoftEnds=0, LoftSimp=0, LoftType=0, Rebuild=10, Refit=0.01})
mesh_2 = Mesh(flatten(loft))
mesh_3 = Mesh(flatten(loft_2))
mesh_4 = Mesh(flatten(loft_3))
merge_5 = Merge(Data1=mesh_3, Data2=mesh_2, Data3=mesh_4)
mjoin_2 = MeshJoin(Meshes=merge_5)
merge_6 = Merge(Data1=flatten(data_2), Data2=flatten(data))
number_slider_16 = Slider(0.001, range=0..0.001)
yz = YZPlane(Origin=Point(0, 0, 0))
move_8 = Move(Motion=Vector(0, 0, 10))  # -> Geometry, Transform
number_slider_17 = Slider(0.5, range=0..1)
rotate = Rotate(Geometry=[mjoin_2, mjoin], Angle=degrees("-90"), Plane=yz)  # -> Geometry, Transform
box = CenterBox(Base=PlaneXY(0, 0, 0), X=number_slider_16, Y=number_slider_16, Z=number_slider_16)
number_slider_18 = Slider(0.1, range=0..0.1)
neg_3 = Negative(Value=Slider(6, range=0..10))
mbox = MeshBox(Base=box, XCount="1", YCount="1", ZCount="1")
Y_3 = UnitY(Factor=neg_3)
scale = Scale(Geometry=rotate.Geometry, Center=Point(0, 0, 0), Factor="1/12")  # -> Geometry, Transform
move_9 = Move(Geometry=rotate.Geometry, Motion=Y_3)  # -> Geometry, Transform
nullrep = ReplaceNulls(Items=move_9.Geometry, Replacements=mbox)  # -> Items, Count

# ---- group: RH_OUT:115:Mesh
mesh_5 = Mesh(nullrep.Items)

# ---- group: RH_OUT:108:Curve
crv = Curve(merge_6)
